# Grasshopper definition RoboticAssemblyPrototype.gh (Grasshopper 1.0.8)
# plug-ins: Aggregations, RhinoCodePluginGH, Pufferfish, Human, Hops, MetaHopper, Kangaroo2 Components, Palette, Telepathy

palette = Palette(
    ModeCustomStandard=Toggle(True),
    Component_Normal_Deselected_Fill_Color=RGB(255, 255, 255),
    Component_Normal_Deselected_Edge_Color=RGB(0, 0, 0),
    Component_Normal_Deselected_Text_Color=RGB(0, 0, 0),
    Component_Normal_Selected_Fill_Color=RGB(149, 199, 101),
    Component_Normal_Selected_Edge_Color=RGB(255, 0, 0),
    Component_Normal_Selected_Text_Color=RGB(0, 25, 0),
    Component_Hidden_Deselected_Fill_Color=RGB(138, 138, 153),
    Component_Hidden_Deselected_Edge_Color=RGB(0, 0, 0),
    Component_Hidden_Deselected_Text_Color=RGB(0, 0, 0),
    Component_Hidden_Selected_Fill_Color=RGB(182, 227, 150),
    Component_Hidden_Selected_Edge_Color=RGB(0, 35, 0),
    Component_Hidden_Selected_Text_Color=RGB(0, 25, 0),
    Component_Disabled_Deselected_Fill_Color=RGB(204, 0, 0),
    Component_Disabled_Deselected_Edge_Color=RGB(0, 0, 0),
    Component_Disabled_Deselected_Text_Color=RGB(0, 0, 0),
    Component_Disabled_Selected_Fill_Color=RGB(212, 131, 131),
    Component_Disabled_Selected_Edge_Color=RGB(0, 0, 0),
    Component_Disabled_Selected_Text_Color=RGB(0, 0, 0),
    Component_Warning_Deselected_Fill_Color=RGB(255, 132, 0),
    Component_Warning_Deselected_Edge_Color=RGB(80, 10, 0),
    Component_Warning_Deselected_Text_Color=RGB(0, 0, 0),
    Component_Warning_Selected_Fill_Color=RGB(185, 205, 0),
    Component_Warning_Selected_Edge_Color=RGB(0, 50, 0),
    Component_Warning_Selected_Text_Color=RGB(0, 0, 0),
    Component_Error_Deselected_Fill_Color=RGB(200, 0, 0),
    Component_Error_Deselected_Edge_Color=RGB(60, 0, 0),
    Component_Error_Deselected_Text_Color=RGB(0, 0, 0),
    Component_Error_Selected_Fill_Color=RGB(125, 155, 0),
    Component_Error_Selected_Edge_Color=RGB(0, 50, 0),
    Component_Error_Selected_Text_Color=RGB(255, 255, 255),
    Component_Label_Deselected_Fill_Color=RGB(50, 50, 50),
    Component_Label_Deselected_Edge_Color=RGB(0, 0, 0),
    Component_Label_Deselected_Text_Color=RGB(255, 255, 255),
    Component_Label_Selected_Fill_Color=RGB(25, 60, 25),
    Component_Label_Selected_Edge_Color=RGB(0, 35, 0),
    Component_Label_Selected_Text_Color=RGB(190, 250, 180),
    Galapagos_Deselected_Fill_Color=RGB(255, 0, 125),
    Galapagos_Deselected_Edge_Color=RGB(100, 0, 50),
    Galapagos_Selected_Fill_Color=RGB(160, 210, 30),
    Galapagos_Selected_Edge_Color=RGB(0, 50, 0),
    Wire_Normal_Color=RGBA(0, 0, 0, 150),
    Wire_Empty_Color=RGBA(255, 60, 0, 180),
    Wire_Selected_Start_Color=RGB(125, 210, 40),
    Wire_Selected_End_Color=RGBA(0, 0, 0, 50),
    Panel_Default_Color=RGB(255, 255, 255),
    Group_Default_Color=RGB(255, 255, 255),
    Canvas_Background_Color=RGB(224, 224, 224),
    Canvas_Gridline_Color=RGBA(0, 0, 0, 30),
    Canvas_Gridline_Width=150,
    Canvas_Gridline_Height=50,
    Canvas_Edge_Color=RGB(255, 255, 255),
    Canvas_Shadow_Color=RGBA(0, 0, 0, 80),
    Canvas_Shadow_Size=30,
    MonochromaticOnOff=False,
    Monochromatic_Color=RGB(212, 208, 200))

# ----
# Set Hops Connection
panel = Panel("http://localhost:5000/robot_a")
hops = Hops(
    _Path=panel,
    _Enabled=Toggle(False),
    CacheResultsInMemory=True,
    CacheSolveResults=True,
    RemoteDefinitionLocation="http://localhost:5000/robot_a",
    RemoteSolveVersion=(0, 1, 0),
    ShowInput_Enabled=True,
    ShowInput_Path=True,
    SynchronousSolve=True)  # -> Name, Base, ReferenceFrame, ModelType
hops_2 = Hops(
    _Path="http://localhost:5000/robot_b",
    _Enabled=Toggle(False),
    CacheResultsInMemory=True,
    CacheSolveResults=True,
    RemoteDefinitionLocation="http://localhost:5000/robot_b",
    RemoteSolveVersion=(0, 1, 0),
    ShowInput_Enabled=True,
    ShowInput_Path=True,
    SynchronousSolve=False)  # -> Name, Base, ReferenceFrame, ModelType
merge = Merge(Data1=hops.Name, Data2=hops.Base, Data3=hops.ReferenceFrame)
merge_2 = Merge(Data1=hops_2.Name, Data2=hops_2.Base, Data3=hops_2.ReferenceFrame)
dam = DataDam(DataA=merge, BufferDelay=10000000, BufferMode=1)
dam_2 = DataDam(DataA=merge_2, BufferDelay=10000000, BufferMode=1)
merge_3 = Merge(Data1=dam, Data2=dam_2)

# ----
# Robot ID
# Robot Base A
# Robot ID
# Robot Base B
number_slider = Slider(1654, range=0..1682)
merge_4 = Merge(Data1="UR5 A", Data2=number_slider, Data3="0,0,0")  # -> flatten(Result)
merge_5 = Merge(Data1="COMAU", Data2=Slider(680, range=0..3672), Data3="0,0,0")  # -> flatten(Result)
merge_6 = Merge(Data1=merge_4, Data2=merge_5)

list = ValueList({"MANUAL": 0, "EXTERNAL": 1}, selected="MANUAL")
filter = StreamFilter(Gate=list, Stream0=merge_6, Stream1=merge_3)
dam_3 = DataDam(DataA=filter, BufferDelay=10000000, BufferMode=0)
bang = ExplodeTree(Data=graft(dam_3))  # -> Branch0, Branch1, Branch2, Branch3, Branch4, Branch5

# ---- group: b_Phase A / in_Structure
# Structure Geometry
panel_2 = Panel("1.Prototype::BaseEdge")
dpipeline = DynamicGeometryPipeline(
    LayerFilter="1.Prototype",
    TypeFilter="Curve",
    NameFilter="*",
    GroupByLayer=False,
    GroupByType=False,
    IncludeHidden=True,
    IncludeLocked=True,
    enableFullPath=True,
    listenToAttributes=True)
dpipeline_2 = DynamicGeometryPipeline(
    LayerFilter="1.Prototype",
    TypeFilter="Point",
    NameFilter="*",
    GroupByLayer=False,
    GroupByType=False,
    IncludeHidden=True,
    IncludeLocked=True,
    enableFullPath=True,
    listenToAttributes=True)
dpipeline_3 = DynamicGeometryPipeline(
    LayerFilter="1.Prototype::Start",
    TypeFilter="Point",
    NameFilter="*",
    GroupByLayer=False,
    GroupByType=False,
    IncludeHidden=True,
    IncludeLocked=True,
    enableFullPath=True,
    listenToAttributes=True)
dpipeline_4 = DynamicGeometryPipeline(
    LayerFilter=panel_2,
    TypeFilter="Curve",
    NameFilter="*",
    GroupByLayer=False,
    GroupByType=False,
    IncludeHidden=True,
    IncludeLocked=True,
    enableFullPath=True,
    listenToAttributes=True)
in_rigid_points = Data(dpipeline_2)
in_start_point = Data(dpipeline_3)
baseedge = Data(dpipeline_4)
in_lines = Data(dpipeline)
base_edges = RemoteSender(baseedge)
input_lines = RemoteSender(in_lines)

# ---- group: viz_3D MODEL / ctrl_
hub_size = Slider(10.5, range=0..50)
node_size = Slider(50, range=0..100)
gap_material = Slider(8, range=0..30)
element_thickness_width = Slider(18, range=0..30)
overlap_node = Slider(1, range=0..50)
thickness_montageband = Slider(12, range=0..30)

# ---- group: ctrl_Control Panel / out_
robotnamea = RemoteSender(bang.Branch0)
robotbaseindexa = RemoteSender(bang.Branch1)
baserotationa = RemoteSender(bang.Branch2)
robotnameb = RemoteSender(bang.Branch3)
baserotationb = RemoteSender(bang.Branch5)
robotbaseindexb = RemoteSender(bang.Branch4)

# ---- group: other_
# Color Groups & Script Requirements
out = ColourSwatch(SwatchColor=RGB(204, 255, 251))
b = ColourSwatch(SwatchColor=RGB(196, 196, 196))
in = ColourSwatch(SwatchColor=RGB(208, 255, 204))
ctrl = ColourSwatch(SwatchColor=RGB(255, 252, 204))
viz = ColourSwatch(SwatchColor=RGB(218, 192, 240))
other = ColourSwatch(SwatchColor=RGB(255, 255, 255))
calc = ColourSwatch(SwatchColor=RGB(255, 204, 204))
connected = GetConnectedObjects(Objects=[in, b, out, ctrl, calc, viz, other])
object_info = ObjectInfo(Objects=connected)  # -> Name, NickName, Type, Pivot, Bounds, Value, Enabled, Preview
concat = Concatenate(FragmentA=object_info.NickName, FragmentB="*")
groups = GetGroups()  # -> Groups, GroupStyles, Nickname, Color
graft = GraftTree(Tree=concat, IncludeEmptyLists=True, IncludeNullItems=True)
tmatch = MatchText(Text=groups.Nickname, Pattern=graft, Case=True)
cull = CullPattern(List=groups.Groups, CullPattern=tmatch)
tstat = TreeStatistics(Tree=cull)  # -> Paths, Length, Count
equals = Equality(FirstNumber=tstat.Length, SecondNumber=0)  # -> Equality, Inequality
cull_2 = CullPattern(List=object_info.Value, CullPattern=equals.Inequality)
prune = PruneTree(Tree=cull, Minimum="1", Maximum=0)
graft_2 = GraftTree(Tree=cull_2, IncludeEmptyLists=True, IncludeNullItems=True)
setgroup = SetGroupProperties(Group=simplify(prune), Color=simplify(graft_2))

# ---- group: b_Phase A / in_Structure / calc_AssemblySequence
py3_trussemble = Python3Script(in_lines=in_lines, in_rigid_points=in_rigid_points, in_start_point=in_start_point)  # -> out, assembly_steps, ordered_nodes, line_indices; inputs in_lines: list of Line, in_rigid_points: list of Point3d, in_start_point: Point3d
# ---------- py3_trussemble: Python ----------
import rhinoscriptsyntax as rs
import Grasshopper as gh
import Grasshopper.Kernel as ghk
from Grasshopper.Kernel.Data import GH_Path
import Rhino.Geometry as rg
import networkx as nx
from collections import Counter
import math
import numpy as np
import itertools
from itertools import combinations

class Trussemble:
    def __init__(self, lines, rigid_points, start_point):
        ## inputs
        self.lines = lines
        self.points, self.connection_tree = self.__get_line_connectivity()
        self.rigid_points = rigid_points
        self.rigid_indices = self.__get_rigid_point_indices()
        self.start_point = start_point
        ## outputs
        self.edge_list = None
        self.graph = self.__turn_tree_to_graph(self.connection_tree)
        self.assembly_steps = gh.DataTree[object]()
        self.assembly_step_line_indices = gh.DataTree[object]()
        self.processed_nodes = []

    def __average_point(self, pt1, pt2, pt3):
        avg_x = (pt1.X + pt2.X + pt3.X) / 3
        avg_y = (pt1.Y + pt2.Y + pt3.Y) / 3
        avg_z = (pt1.Z + pt2.Z + pt3.Z) / 3
        return rg.Point3d(avg_x, avg_y, avg_z)

    def __get_rigid_point_indices(self):
        rigid_indices = []
        points_array = np.array([[pt.X, pt.Y, pt.Z] for pt in self.points])

        for rigid_point in self.rigid_points:
            if rigid_point in self.points:
                rigid_indices.append(self.points.index(rigid_point))
            else:
                rigid_point_array = np.array([rigid_point.X, rigid_point.Y, rigid_point.Z])
                distances = np.linalg.norm(points_array - rigid_point_array, axis=1)
                rigid_idx = np.argmin(distances)
                rigid_indices.append(rigid_idx)
        return rigid_indices

    def __get_line_connectivity(self):
        lines = self.lines
        connectivity_tree = gh.DataTree[object]()
        unique_points = {}

        for line_index, line in enumerate(lines):
            # Convert GH_Curve to Rhino.Geometry.Curve if necessary
            if hasattr(line, "Value"):
                line = line.Value

            # Get the start and end points of the line if it's a Line or a linear Curve
            if isinstance(line, rg.Line):
                start_point = line.From
                end_point = line.To
            elif isinstance(line, rg.Curve) and line.IsLinear():
                start_point = line.PointAtStart
                end_point = line.PointAtEnd
            else:
                raise ValueError("Line input must be of type Line or linear Curve")

            # Ensure that points are rounded to avoid floating point issues
            start_point3d = rg.Point3d(round(start_point.X, 3), round(start_point.Y, 3), round(start_point.Z, 3))
            end_point3d = rg.Point3d(round(end_point.X, 3), round(end_point.Y, 3), round(end_point.Z, 3))

            if start_point3d not in unique_points:
                unique_points[start_point3d] = len(unique_points)
            if end_point3d not in unique_points:
                unique_points[end_point3d] = len(unique_points)

            start_index = unique_points[start_point3d]
            end_index = unique_points[end_point3d]

            connectivity_tree.EnsurePath(GH_Path(line_index))
            connectivity_tree.AddRange([start_index, end_index], GH_Path(line_index))

        unique_points_list = list(unique_points.keys())
        return unique_points_list, connectivity_tree

    def __can_node_be_rigid(self, node):
        if node in self.rigid_indices:
            return True
        else:
            neighbours = list(self.graph.neighbors(node))
            count_existing_neighbours = sum(1 for neighbour in neighbours if neighbour in self.processed_nodes)
            return count_existing_neighbours >= 3

    def __turn_tree_to_graph(self, connections_tree):
        list_of_tuples = []
        for i in range(connections_tree.BranchCount):
            branch = connections_tree.Branch(i)
            if len(branch) == 2:
                list_of_tuples.append(tuple(branch))
        self.edge_list = list_of_tuples
        G = nx.Graph()
        G.add_edges_from(list_of_tuples)
        return G

    def __get_first_move(self):
        start_point = self.start_point
        rigid_ids = self.rigid_indices
        points = self.points
        graph = self.graph

        min_avg_distance_to_start = float('inf')
        neighbours_to_connect_to = []
        first_supports = None

        def find_common_neighbour_combinations(graph, rigid_points_indices):
            valid_combinations = []
            common_neighbors = []
            for comb in combinations(rigid_points_indices, 3):
                neighbors_1 = set(graph.neighbors(comb[0]))
                neighbors_2 = set(graph.neighbors(comb[1]))
                neighbors_3 = set(graph.neighbors(comb[2]))
                common_neighbor = neighbors_1 & neighbors_2 & neighbors_3
                if common_neighbor:
                    valid_combinations.append(comb)
                    common_neighbors.append(list(common_neighbor)[0])
            return valid_combinations, common_neighbors

        starting_three_candidates, common_neighbours = find_common_neighbour_combinations(graph, rigid_ids)

        for i, starting_three in enumerate(starting_three_candidates):
            p1 = points[starting_three[0]]
            p2 = points[starting_three[1]]
            p3 = points[starting_three[2]]
            centre = self.__average_point(p1, p2, p3)
            avg_distance = rs.Distance(start_point, centre)
            if avg_distance < min_avg_distance_to_start:
                min_avg_distance_to_start = avg_distance
                first_supports = starting_three
                neighbours_to_connect_to.append(list([common_neighbours[i]]))

        neighbour_to_connect_to = neighbours_to_connect_to[-1][0]
        self.processed_nodes.extend(first_supports)
        self.processed_nodes.append(neighbour_to_connect_to)
        return list(first_supports), neighbour_to_connect_to

    def __check_missing_edges(self, sub_graph_edges):
        edges_to_add = []
        for node1, node2 in combinations(sub_graph_edges, 2):
            if self.graph.has_edge(node1, node2):
                edges_to_add.append((node1, node2))
        return edges_to_add

    def __find_unprocessed_neighbors_subgraphs(self):
        graph = self.graph
        processed_nodes = self.processed_nodes
        processed_nodes_set = set(processed_nodes)
        points = self.points

        unprocessed_neighbors = set()
        last_node = processed_nodes[-1]
        neighbors_last_node = set(graph.neighbors(last_node))
        unprocessed_neighbors_last_node = neighbors_last_node - processed_nodes_set

        for node in processed_nodes_set:
            if node == last_node:
                continue
            neighbors = set(graph.neighbors(node))
            unprocessed_neighbors.update(neighbors - processed_nodes_set)

        unprocessed_neighbors.update(unprocessed_neighbors_last_node)

        subgraphs = []
        unprocessed_subgraph = graph.subgraph(unprocessed_neighbors)

        for component in nx.connected_components(unprocessed_subgraph):
            subgraphs.append(list(component))

        subgraphs_sorted = []
        subgraph_last_node = [comp for comp in subgraphs if any(node in unprocessed_neighbors_last_node for node in comp)]
        other_subgraphs = [comp for comp in subgraphs if comp not in subgraph_last_node]

        if subgraph_last_node:
            subgraphs_sorted.extend(subgraph_last_node)
            subgraphs_sorted.extend(other_subgraphs)
            return subgraphs_sorted[0]
        else:
            closest_distance = float('inf')
            first_comp = None
            for comp in subgraphs:
                for node in comp:
                    distance = (points[last_node] - points[node]).Length
                    if distance < closest_distance:
                        first_comp = comp
                        closest_distance = distance
            return first_comp

    def __get_possible_connections(self, node):
        return [neighbour for neighbour in self.graph.neighbors(node) if neighbour in self.processed_nodes]

    def __sort_rigid_candidates(self, candidates):
        origin = self.processed_nodes[-1]
        points = self.points

        def distance_to_origin(c):
            return (points[origin] - points[c]).Length

        return sorted(candidates, key=distance_to_origin)

    def __get_sorted_supports(self, candidate, supports):
        support_combinations = list(itertools.combinations([x for x in range(len(supports))], 3))
        score_per_combination = {}
        result_supports = []

        def get_combined_distance_to_supports(supports):
            support_coords = np.array([[pt.X, pt.Y, pt.Z] for pt in supports])
            num_supports = len(support_coords)
            diff = support_coords[:, np.newaxis, :] - support_coords[np.newaxis, :, :]
            distances = np.linalg.norm(diff, axis=2)
            distances += np.eye(num_supports) * 1e-8
            combined_distance = np.prod(distances)
            return combined_distance

        def triangle_area(rs_pointA, rs_pointB, rs_pointC):
            A = np.array([rs_pointA.X, rs_pointA.Y, rs_pointA.Z])
            B = np.array([rs_pointB.X, rs_pointB.Y, rs_pointB.Z])
            C = np.array([rs_pointC.X, rs_pointC.Y, rs_pointC.Z])
            area = 0.5 * np.linalg.norm(np.cross(B - A, C - A))
            return area

        for c in support_combinations:
            supports_list = [supports[c[0]], supports[c[1]], supports[c[2]]]
            combined_distance = float(get_combined_distance_to_supports(supports_list))
            area = float(triangle_area(supports_list[0], supports_list[1], supports_list[2]))
            score = combined_distance if area == 0.0 else combined_distance / area
            score_per_combination[c] = score

        score_per_combination = dict(sorted(score_per_combination.items(), key=lambda item: item[1]))
        support_combinations = list(score_per_combination.keys())
        for support_combination in support_combinations:
            result_support = list(support_combination)
            for i, support in enumerate(supports):
                if i not in support_combination:
                    result_support.append(i)
                result_supports.append(result_support)

        return result_supports[0]

    def __check_if_door(self, support_nodes, load_node):
        support_points = [self.points[x] for x in support_nodes]
        load_point = self.points[load_node]
        combination = []

        def point_plane_distance(plane_pts, test_pt):
            A, B, C = plane_pts
            AB = B - A
            AC = C - A
            normal_vector = rg.Vector3d.CrossProduct(AB, AC)
            if normal_vector.IsZero:
                return 0.0
            normal_vector.Unitize()
            D = -(normal_vector.X * A.X + normal_vector.Y * A.Y + normal_vector.Z * A.Z)
            numerator = abs(normal_vector.X * test_pt.X + normal_vector.Y * test_pt.Y + normal_vector.Z * test_pt.Z + D)
            return numerator

        def distance_to_centroid(pts, test_pt):
            centroid = rg.Point3d((pts[0].X + pts[1].X + pts[2].X) / 3, (pts[0].Y + pts[1].Y + pts[2].Y) / 3, (pts[0].Z + pts[1].Z + pts[2].Z) / 3)
            return (test_pt - centroid).Length

        def is_door(three_supports, load_point, span_height_ratio=0.25):
            distance = point_plane_distance(three_supports, load_point)
            effective_span = distance_to_centroid(three_supports, load_point)
            if effective_span == 0:
                return False
            ratio = distance / effective_span
            return ratio <= span_height_ratio

        first_three = support_points[:3]
        if not is_door(first_three, load_point):
            return support_nodes
        else:
            for comb in combinations(support_nodes, 3):
                comb_points = [self.points[x] for x in list(comb)]
                if not is_door(list(comb_points), load_point):
                    combination.extend(list(comb))
                    missing = [x for x in support_nodes if x not in list(comb)]
                    if missing:
                        combination.extend(missing)
                    return combination
            return True

    def __find_edge_index(self, edge):
        if edge in self.edge_list or (edge[1], edge[0]) in self.edge_list:
            return self.edge_list.index(edge) if edge in self.edge_list else self.edge_list.index((edge[1], edge[0]))
        return -1

    def assemble(self):
        while True:
            if len(self.processed_nodes) == 0:
                first_supports, first_neighbour = self.__get_first_move()
                lines_to_add = []
                lines_indices = []

                for support in first_supports:
                    line = rs.AddLine(self.points[support], self.points[first_neighbour])
                    lines_to_add.append(line)
                    lines_indices.append(self.__find_edge_index((int(support), int(first_neighbour))))

                missing_edges = self.__check_missing_edges(first_supports)
                for missing_edge in missing_edges:
                    line = rs.AddLine(self.points[missing_edge[0]], self.points[missing_edge[1]])
                    lines_to_add.append(line)
                    lines_indices.append(self.__find_edge_index((int(missing_edge[0]), int(missing_edge[1]))))

                path = GH_Path(0)
                self.assembly_steps.AddRange(lines_to_add, path)
                self.assembly_step_line_indices.AddRange(lines_indices, path)

            elif len(self.processed_nodes) < len(self.points):
                non_rigid_candidates = self.__find_unprocessed_neighbors_subgraphs()
                rigid_candidates = [candidate for candidate in non_rigid_candidates if self.__can_node_be_rigid(candidate)]
                sorted_rigid_candidates = self.__sort_rigid_candidates(rigid_candidates)

                for candidate in sorted_rigid_candidates:
                    lines_to_add = []
                    lines_indices = []
                    nodes_to_connect_to = self.__get_possible_connections(candidate)

                    if len(nodes_to_connect_to) == 1 and nodes_to_connect_to[0] in self.rigid_indices:
                        continue

                    if len(nodes_to_connect_to) < 3:
                        for node in nodes_to_connect_to:
                            line = rs.AddLine(self.points[candidate], self.points[node])
                            lines_indices.append(self.__find_edge_index((int(candidate), int(node))))
                            lines_to_add.append(line)

                        self.processed_nodes.append(candidate)
                        path = GH_Path(self.assembly_steps.BranchCount)
                        self.assembly_steps.AddRange(lines_to_add, path)
                        self.assembly_step_line_indices.AddRange(lines_indices, path)

                    else:
                        nodes_sorted_indices = self.__get_sorted_supports(self.points[candidate], [self.points[x] for x in nodes_to_connect_to])
                        sorted_support_nodes = [nodes_to_connect_to[x] for x in nodes_sorted_indices]

                        if self.__check_if_door(sorted_support_nodes, candidate) == True:
                            continue
                        else:
                            sorted_support_indices = self.__check_if_door(sorted_support_nodes, candidate)

                        for point_index in sorted_support_indices:
                            line = rs.AddLine(self.points[candidate], self.points[point_index])
                            lines_indices.append(self.__find_edge_index((int(candidate), int(point_index))))
                            lines_to_add.append(line)

                        self.processed_nodes.append(candidate)
                        path = GH_Path(self.assembly_steps.BranchCount)
                        self.assembly_steps.AddRange(lines_to_add, path)
                        self.assembly_step_line_indices.AddRange(lines_indices, path)
            else:
                return self.assembly_steps

if not in_lines:
    raise ValueError('silly billy, no lines input')

if not in_rigid_points:
    raise ValueError('silly billy, no rigid points input')

if not in_start_point:
    raise ValueError('silly billy, no start point input')

my_truss = Trussemble(in_lines, in_rigid_points, in_start_point)
assembly_steps = my_truss.assemble()
processed_nodes = my_truss.processed_nodes
nodes = my_truss.points
processed_points = nodes
ordered_nodes = processed_points
line_indices = my_truss.assembly_step_line_indices
# ---------- end py3_trussemble ----------

# ---- group: viz_AssemblySequence
# Structure Assembly Sequence Visualization
number_slider_2 = Slider(0, range=0..3)
assembly_steps = Data(py3_trussemble.assembly_steps)
tstat_2 = TreeStatistics(Tree=assembly_steps)  # -> Paths, Length, Count
item = ListItem(List=tstat_2.Paths, Index=number_slider_2, Wrap=True)
branch = TreeBranch(Tree=assembly_steps, Path=item, MaintainPaths=True)
previewlw = CustomPreviewLineweights(Geometry=branch, Shader=ColourSwatch(SwatchColor=RGB(234, 0, 255)), Thickness=Slider(30, range=0..40), Absolute=False)

# ---- group: calc_LinePartition
# Structure elements are split in pairs of 3
# to set the framework for Type 1 movements.
number_slider_3 = Slider(6, range=0..9)
partition = PartitionList(List=assembly_steps, Size="3")
panel_3 = Panel(partition)
dom = ConstructDomain(DomainStart=0, DomainEnd=number_slider_3)
range = Range(Domain=dom, Steps=number_slider_3)  # -> flatten(Range)
concat_2 = Concatenate(FragmentA="{", FragmentB=range, FragmentA_2=";*}")
split = SplitTree(Data=partition, Masks=flatten(concat_2))  # -> Positive, Negative
line = Line(split.Positive)

# ---- group: calc_Calculate Orientation Points / in_Robot Reach
# Please replace values
# with the actual ones for
# your robots of choice!
panel_4 = Panel("850")
reach_robot_a = Data(panel_4)
reach_robot_b = Data("2350")

# ---- group: calc__RobotOrientationToStructure
# base lines
pline = PolyLine(Vertices=in_rigid_points, Closed=True)
explode = Explode(Curve=pline, Recursive=True)  # -> flatten(Segments), Vertices

# ---- group: other_RobotKinematics / ctrl_RobotKinematics / out_RobotNames
# Robot Kinematics
robotnamea_2 = RemoteReceiver(robotnamea)
robotnameb_2 = RemoteReceiver(robotnameb)

# ---- group: other_RobotKinematics / ctrl_RobotKinematics
# Big Interval.
# Press play.
trigger = Trigger(Interval=1000, TimerInterval=1000, Target=[ur5_setup, py3])  # disabled
ur5_setup = Python3Script(RobotName=robotnamea_2)  # -> out, TCPPlane, RobotPosition, X_Axis, Y_Axis, Z_Axis, JointPoints, JointLines, SuccessMessage
# ---------- ur5_setup: Python ----------
# Import necessary modules
import robolink as rl          # RoboDK API for communication with RoboDK software
import robodk as rdk           # RoboDK modeling and simulation library
import Rhino.Geometry as rg    # Rhino.Geometry for handling geometric entities in Rhino
import math                    # Math module for mathematical functions
import numpy as np             # NumPy for numerical computations

# === Inputs ===
# RobotName: Name of the robot in RoboDK (e.g., "UR5")

# Initialize output variables
RobotPosition = None   # Will store the position of the robot's Tool Center Point (TCP)
X_Axis = None          # Will store a line representing the robot's TCP X-axis
Y_Axis = None          # Will store a line representing the robot's TCP Y-axis
Z_Axis = None          # Will store a line representing the robot's TCP Z-axis
JointPoints = []       # List to store the positions of each joint
JointLines = []        # List to store lines connecting the joints
TCPPlane = None        # Plane representing the TCP's orientation
SuccessMessage = ""    # Message indicating success or error

# Initialize a connection to RoboDK
RDK = rl.Robolink()

# Retrieve the robot item from RoboDK by its name
robot = RDK.Item(RobotName, rl.ITEM_TYPE_ROBOT)

# Check if the robot item is valid
if not robot.Valid():
    # If the robot is not found, set an error message
    SuccessMessage = f"Error: Could not find {RobotName} in RoboDK."
else:
    # If the robot is found, set a success message
    SuccessMessage = f"Connected to {RobotName} in RoboDK."

    # Retrieve the robot's base item (parent item)
    robot_base = robot.Parent()
    if robot_base.Valid():
        # If the base is valid, get its pose (transformation matrix)
        base_pose = robot_base.Pose()
    else:
        # If not, use an identity matrix as the base pose
        base_pose = rdk.Mat()

    # Get the robot's current joint angles in degrees
    joints_deg = robot.Joints().list()
    # Convert joint angles from degrees to radians for computation
    joints_rad = [math.radians(angle) for angle in joints_deg]

    # Define the UR5 robot's standard Denavit-Hartenberg (DH) parameters in millimeters
    d1 = 89.159     # Offset along previous Z to the common normal
    a2 = -425.00    # Length of the common normal (negative due to robot configuration)
    a3 = -392.25    # Length of the common normal (negative due to robot configuration)
    d4 = 109.15     # Offset along previous Z to the common normal
    d5 = 94.65      # Offset along previous Z to the common normal
    d6 = 82.3       # Offset along previous Z to the end effector

    # DH parameters: alpha (twist angles), a (link lengths), d (link offsets), theta (joint angles)
    alpha = [math.pi/2, 0, 0, math.pi/2, -math.pi/2, 0]   # Twist angles between links
    a = [0, a2, a3, 0, 0, 0]                              # Link lengths
    d = [d1, 0, 0, d4, d5, d6]                            # Link offsets
    theta = joints_rad                                     # Joint angles from the robot

    # Convert the base pose to a NumPy array for matrix operations
    T_base = np.array(base_pose.rows)
    # Ensure that the base transformation matrix is 4x4
    if T_base.shape != (4, 4):
        # Append an error message if the matrix is not 4x4
        SuccessMessage += " Error: Base pose matrix is not 4x4."
    else:
        # Initialize the overall transformation matrix with the base pose
        T = T_base

        # Initialize a list to store the positions of each joint
        JointPoints = []

        # Initialize a list to store the transformation matrix of each joint
        T_matrices = []

        # Compute the transformation for each of the six joints using the DH parameters
        for i in range(6):
            # Extract DH parameters for the current joint
            ai = a[i]
            alphai = alpha[i]
            di = d[i]
            thetai = theta[i]

            # Compute trigonometric functions for efficiency
            cos_theta = math.cos(thetai)
            sin_theta = math.sin(thetai)
            cos_alpha = math.cos(alphai)
            sin_alpha = math.sin(alphai)

            # Create the transformation matrix from the previous joint to the current joint
            T_joint = np.array([
                [cos_theta, -sin_theta * cos_alpha,  sin_theta * sin_alpha, ai * cos_theta],
                [sin_theta,  cos_theta * cos_alpha, -cos_theta * sin_alpha, ai * sin_theta],
                [0,          sin_alpha,              cos_alpha,             di],
                [0,          0,                      0,                     1]
            ])

            # Update the overall transformation matrix by multiplying with the current joint's matrix
            T = np.dot(T, T_joint)

            # Save the transformation matrix for this joint
            T_matrices.append(T.copy())

            # Extract the position of the current joint from the transformation matrix
            position = T[:3, 3]  # Get the x, y, z coordinates

            # Create a Point3d object for the joint position
            joint_point = rg.Point3d(position[0], position[1], position[2])
            # Add the joint position to the list
            JointPoints.append(joint_point)

        # Create lines connecting the joints for visualization
        JointLines = []
        for i in range(1, len(JointPoints)):
            # Create a line from the previous joint to the current joint
            line = rg.Line(JointPoints[i - 1], JointPoints[i])
            # Add the line to the list
            JointLines.append(line)

        # Optionally, connect the robot base to the first joint
        if JointPoints:
            # Get the base position from the base transformation matrix
            base_position = T_base[:3, 3]
            base_point = rg.Point3d(base_position[0], base_position[1], base_position[2])
            # Create a line from the base to the first joint
            line = rg.Line(base_point, JointPoints[0])
            # Insert the line at the beginning of the JointLines list
            JointLines.insert(0, line)

        # Retrieve the robot's pose relative to its base (end-effector pose)
        robot_pose = robot.Pose()

        # Compute the absolute pose of the TCP (Tool Center Point) in the world coordinate system
        absolute_pose = base_pose * robot_pose

        # Extract the TCP position from the absolute pose
        position = absolute_pose.Pos()  # Get the x, y, z coordinates

        # Create a Point3d object for the TCP position
        RobotPosition = rg.Point3d(position[0], position[1], position[2])

        # Extract orientation vectors (axes) from the rotation matrix of the absolute pose
        x_vector = rg.Vector3d(absolute_pose[0, 0], absolute_pose[1, 0], absolute_pose[2, 0])  # X-axis
        y_vector = rg.Vector3d(absolute_pose[0, 1], absolute_pose[1, 1], absolute_pose[2, 1])  # Y-axis
        z_vector = rg.Vector3d(absolute_pose[0, 2], absolute_pose[1, 2], absolute_pose[2, 2])  # Z-axis

        # Create a plane at the TCP position with the extracted orientation vectors
        TCPPlane = rg.Plane(RobotPosition, x_vector, y_vector)

        # Scale the orientation vectors for visualization purposes
        scale_factor = 200  # Adjust this value as needed for your visualization
        x_vector *= scale_factor
        y_vector *= scale_factor
        z_vector *= scale_factor

        # Create lines representing the robot's TCP axes
        X_Axis = rg.Line(RobotPosition, rg.Point3d(RobotPosition + x_vector))
        Y_Axis = rg.Line(RobotPosition, rg.Point3d(RobotPosition + y_vector))
        Z_Axis = rg.Line(RobotPosition, rg.Point3d(RobotPosition + z_vector))

        # Optionally, connect the last joint to the TCP position
        if JointPoints and RobotPosition:
            # Create a line from the last joint to the TCP
            line = rg.Line(JointPoints[-1], RobotPosition)
            # Add the line to the list of joint lines
            JointLines.append(line)
# ---------- end ur5_setup ----------
py3 = Python3Script(RobotName=robotnameb_2)  # -> X_Axis, Y_Axis, Z_Axis, RobotPosition, JointPoints, JointLines, TCPPlane, SuccessMessage
# ---------- py3: Python ----------
# Import necessary modules
import robolink as rl          # RoboDK API for communication with RoboDK software
import robodk as rdk           # RoboDK modeling and simulation library
import Rhino.Geometry as rg    # Rhino.Geometry for handling geometric entities in Rhino
import math                    # Math module for mathematical functions
import numpy as np             # NumPy for numerical computations

# === Inputs ===
# RobotName: Name of the robot in RoboDK (e.g., "COMAU NJ 60-2.2")

# Initialize output variables
RobotPosition = None   # Will store the position of the robot's Tool Center Point (TCP)
X_Axis = None          # Will store a line representing the robot's TCP X-axis
Y_Axis = None          # Will store a line representing the robot's TCP Y-axis
Z_Axis = None          # Will store a line representing the robot's TCP Z-axis
JointPoints = []       # List to store the positions of each joint
JointLines = []        # List to store lines connecting the joints
TCPPlane = None        # Plane representing the TCP's orientation
SuccessMessage = ""    # Message indicating success or error

# Initialize a connection to RoboDK
RDK = rl.Robolink()

# Retrieve the robot item from RoboDK by its name
robot = RDK.Item(RobotName, rl.ITEM_TYPE_ROBOT)

# Check if the robot item is valid
if not robot.Valid():
    # If the robot is not found, set an error message
    SuccessMessage = f"Error: Could not find {RobotName} in RoboDK."
else:
    # If the robot is found, set a success message
    SuccessMessage = f"Connected to {RobotName} in RoboDK."

    # Retrieve the robot's base item (parent item)
    robot_base = robot.Parent()
    if robot_base.Valid():
        # If the base is valid, get its pose (transformation matrix)
        base_pose = robot_base.Pose()
    else:
        # If not, use an identity matrix as the base pose
        base_pose = rdk.Mat()

    # Get the robot's current joint angles in degrees
    joints_deg = robot.Joints().list()
    # Convert joint angles from degrees to radians for computation
    joints_rad = [math.radians(angle) for angle in joints_deg]

    # Define the COMAU NJ 60-2.2 robot's Denavit-Hartenberg (DH) parameters in millimeters and radians
    d1 = 740         # Offset along previous Z to the common normal
    a2 = 600         # Length of the common normal
    a3 = 1200        # Length of the common normal
    d4 = 1350        # Offset along previous Z to the common normal
    d6 = 260         # Offset along previous Z to the end effector

    # DH parameters: alpha (twist angles), a (link lengths), d (link offsets), theta (joint angles)
    alpha = [math.pi/2, 0, 0, math.pi/2, -math.pi/2, 0]   # Twist angles between links
    a = [0, a2, a3, 0, 0, 0]                              # Link lengths
    d = [d1, 0, 0, d4, 0, d6]                             # Link offsets
    theta = joints_rad                                     # Joint angles from the robot

    # Convert the base pose to a NumPy array for matrix operations
    T_base = np.array(base_pose.rows)
    # Ensure that the base transformation matrix is 4x4
    if T_base.shape != (4, 4):
        # Append an error message if the matrix is not 4x4
        SuccessMessage += " Error: Base pose matrix is not 4x4."
    else:
        # Initialize the overall transformation matrix with the base pose
        T = T_base

        # Initialize a list to store the positions of each joint
        JointPoints = []

        # Initialize a list to store the transformation matrix of each joint
        T_matrices = []

        # Compute the transformation for each of the six joints using the DH parameters
        for i in range(6):
            # Extract DH parameters for the current joint
            ai = a[i]
            alphai = alpha[i]
            di = d[i]
            thetai = theta[i]

            # Compute trigonometric functions for efficiency
            cos_theta = math.cos(thetai)
            sin_theta = math.sin(thetai)
            cos_alpha = math.cos(alphai)
            sin_alpha = math.sin(alphai)

            # Create the transformation matrix from the previous joint to the current joint
            T_joint = np.array([
                [cos_theta, -sin_theta * cos_alpha,  sin_theta * sin_alpha, ai * cos_theta],
                [sin_theta,  cos_theta * cos_alpha, -cos_theta * sin_alpha, ai * sin_theta],
                [0,          sin_alpha,              cos_alpha,             di],
                [0,          0,                      0,                     1]
            ])

            # Update the overall transformation matrix by multiplying with the current joint's matrix
            T = np.dot(T, T_joint)

            # Save the transformation matrix for this joint
            T_matrices.append(T.copy())

            # Extract the position of the current joint from the transformation matrix
            position = T[:3, 3]  # Get the x, y, z coordinates

            # Create a Point3d object for the joint position
            joint_point = rg.Point3d(position[0], position[1], position[2])
            # Add the joint position to the list
            JointPoints.append(joint_point)

        # Create lines connecting the joints for visualization
        JointLines = []
        for i in range(1, len(JointPoints)):
            # Create a line from the previous joint to the current joint
            line = rg.Line(JointPoints[i - 1], JointPoints[i])
            # Add the line to the list
            JointLines.append(line)

        # Optionally, connect the robot base to the first joint
        if JointPoints:
            # Get the base position from the base transformation matrix
            base_position = T_base[:3, 3]
            base_point = rg.Point3d(base_position[0], base_position[1], base_position[2])
            # Create a line from the base to the first joint
            line = rg.Line(base_point, JointPoints[0])
            # Insert the line at the beginning of the JointLines list
            JointLines.insert(0, line)

        # Retrieve the robot's pose relative to its base (end-effector pose)
        robot_pose = robot.Pose()

        # Compute the absolute pose of the TCP (Tool Center Point) in the world coordinate system
        absolute_pose = base_pose * robot_pose

        # Extract the TCP position from the absolute pose
        position = absolute_pose.Pos()  # Get the x, y, z coordinates

        # Create a Point3d object for the TCP position
        RobotPosition = rg.Point3d(position[0], position[1], position[2])

        # Extract orientation vectors (axes) from the rotation matrix of the absolute pose
        x_vector = rg.Vector3d(absolute_pose[0, 0], absolute_pose[1, 0], absolute_pose[2, 0])  # X-axis
        y_vector = rg.Vector3d(absolute_pose[0, 1], absolute_pose[1, 1], absolute_pose[2, 1])  # Y-axis
        z_vector = rg.Vector3d(absolute_pose[0, 2], absolute_pose[1, 2], absolute_pose[2, 2])  # Z-axis

        # Create a plane at the TCP position with the extracted orientation vectors
        TCPPlane = rg.Plane(RobotPosition, x_vector, y_vector)

        # Scale the orientation vectors for visualization purposes
        scale_factor = 200  # Adjust this value as needed for your visualization
        x_vector *= scale_factor
        y_vector *= scale_factor
        z_vector *= scale_factor

        # Create lines representing the robot's TCP axes
        X_Axis = rg.Line(RobotPosition, rg.Point3d(RobotPosition.X + x_vector.X, RobotPosition.Y + x_vector.Y, RobotPosition.Z + x_vector.Z))
        Y_Axis = rg.Line(RobotPosition, rg.Point3d(RobotPosition.X + y_vector.X, RobotPosition.Y + y_vector.Y, RobotPosition.Z + y_vector.Z))
        Z_Axis = rg.Line(RobotPosition, rg.Point3d(RobotPosition.X + z_vector.X, RobotPosition.Y + z_vector.Y, RobotPosition.Z + z_vector.Z))

        # Optionally, connect the last joint to the TCP position
        if JointPoints and RobotPosition:
            # Create a line from the last joint to the TCP
            line = rg.Line(JointPoints[-1], RobotPosition)
            # Add the line to the list of joint lines
            JointLines.append(line)
# ---------- end py3 ----------

# ---- group: other_RobotKinematics / out_UR5HOMEPLANE
rec = DataRecorder(ur5_setup.TCPPlane, DataLimit=1, RecordData=True)
panel_5 = Panel(rec)
ur5homeplane = RemoteSender(rec)

# ---- group: other_RobotKinematics / out_COMAUHOMEPLANE
rec_2 = DataRecorder(py3.TCPPlane, DataLimit=1, RecordData=True)
panel_6 = Panel(rec_2)
pln = Plane(rec_2)
comauhomeplane = RemoteSender(pln)

# ---- group: other_RobotKinematics / out_RobotData
panel_7 = Panel(py3.JointLines)
panel_8 = Panel(py3.JointPoints)
panel_9 = Panel(ur5_setup.Z_Axis)
panel_10 = Panel(ur5_setup.JointLines)
panel_11 = Panel(ur5_setup.SuccessMessage)
panel_12 = Panel(py3.RobotPosition)
panel_13 = Panel(py3.X_Axis)
panel_14 = Panel(py3.Y_Axis)
panel_15 = Panel(py3.SuccessMessage)
panel_16 = Panel(ur5_setup.RobotPosition)
panel_17 = Panel(ur5_setup.X_Axis)
panel_18 = Panel(ur5_setup.Y_Axis)
panel_20 = Panel(ur5_setup.JointPoints)

# ---- group: other_RobotKinematics / viz_RobotXYZ
item_2 = ListItem(List=[py3.X_Axis, ur5_setup.X_Axis], Index=0, Wrap=True)  # -> Item, Item1
item_3 = ListItem(List=[ur5_setup.Y_Axis, py3.Y_Axis], Index=0, Wrap=True)  # -> Item, Item1
item_4 = ListItem(List=[ur5_setup.Z_Axis, py3.Z_Axis], Index=0, Wrap=True)  # -> Item, Item1
entwine = Entwine(Branch00=item_2.Item, Branch01=item_2.Item1, FlattenInputs=True)
entwine_2 = Entwine(Branch00=item_3.Item, Branch01=item_3.Item1, FlattenInputs=True)
entwine_3 = Entwine(Branch00=item_4.Item, Branch01=item_4.Item1, FlattenInputs=True)
swatch = ColourSwatch(SwatchColor=RGB(255, 0, 0))
swatch_2 = ColourSwatch(SwatchColor=RGB(82, 255, 3))
swatch_3 = ColourSwatch(SwatchColor=RGB(17, 101, 145))
end = EndPoints(Curve=entwine)  # -> Start, End
end_2 = EndPoints(Curve=entwine_2)  # -> Start, End
end_3 = EndPoints(Curve=entwine_3)  # -> Start, End
entwine_4 = Entwine(
    Branch00=item_2.Item,
    Branch01=item_3.Item,
    Branch02=item_4.Item,
    Branch03=item_2.Item1,
    Branch04=item_3.Item1,
    Branch05=item_4.Item1,
    FlattenInputs=True)
entwine_5 = Entwine(
    Branch00=swatch,
    Branch01=swatch_2,
    Branch02=swatch_3,
    Branch03=swatch,
    Branch04=swatch_2,
    Branch05=swatch_3,
    FlattenInputs=True)
previewlw_2 = CustomPreviewLineweights(Geometry=entwine_4, Shader=entwine_5, Thickness=Slider(4, range=0..10), Absolute=False)
previewlw_3 = CustomPreviewLineweights(
    Geometry=ur5_setup.JointLines,
    Shader=ColourSwatch(SwatchColor=RGB(110, 110, 110)),
    Thickness=Slider(0.5, range=0..200),
    Absolute=False)
tag = TextTag(Location=end.End, Text="x")
tag_2 = TextTag(Location=end_2.End, Text="y")
tag_3 = TextTag(Location=end_3.End, Text="z")

# ---- group: b_Phase A / in_TablePoints
# Temporary height correction.
# Physical Calibration
panel_21 = Panel("2.TablePoints::POINTS_A")
dpipeline_5 = DynamicGeometryPipeline(
    LayerFilter=panel_21,
    TypeFilter="Point",
    NameFilter="*",
    GroupByLayer=False,
    GroupByType=False,
    IncludeHidden=True,
    IncludeLocked=True,
    enableFullPath=True,
    listenToAttributes=True)
dpipeline_6 = DynamicGeometryPipeline(
    LayerFilter="2.TablePoints::POINTS_B",
    TypeFilter="Point",
    NameFilter="*",
    GroupByLayer=False,
    GroupByType=False,
    IncludeHidden=True,
    IncludeLocked=True,
    enableFullPath=True,
    listenToAttributes=True)
Z = UnitZ(Factor="135")
tablepoints = Point(dpipeline_5)
pt = Point(dpipeline_6)
move = Move(Geometry=pt, Motion=Z)  # -> Geometry, Transform
tablepointsur5 = RemoteSender(tablepoints)
tablepointscomau = RemoteSender(move.Geometry)
Z_2 = UnitZ(Factor=Slider(20, range=0..100))
Z_3 = UnitZ(Factor="20")
move_2 = Move(Geometry=tablepointsur5, Motion=Z_2)  # -> Geometry, Transform
move_3 = Move(Geometry=tablepointscomau, Motion=Z_3)  # -> Geometry, Transform

# ---- group: b_Phase A / calc_RobotBaseSync / ctrl_
reset = BooleanToggle(False)
robotnamea_3 = RemoteReceiver(robotnamea)
robotnameb_3 = RemoteReceiver(robotnameb)
tablepointscomau_2 = RemoteReceiver(tablepointscomau)
reset_2 = BooleanToggle(False)
robotbaseindexa_2 = RemoteReceiver(robotbaseindexa)
robotbaseindexb_2 = RemoteReceiver(robotbaseindexb)
baserotationa_2 = RemoteReceiver(baserotationa)
# RoboDK Setup
baserotationb_2 = RemoteReceiver(baserotationb)
tablepointsur5_2 = RemoteReceiver(tablepointsur5)

# ---- group: b_Phase A / calc_RobotBaseSync
py3_2 = Python3Script(
    TablePoints=tablepointsur5_2,
    RobotName=robotnamea_3,
    PointIndex=robotbaseindexa_2,
    SetBase=reset_2,
    RotationAngles=baserotationa_2)  # -> out, BasePosition, SuccessMessage; inputs TablePoints: list of Point3d, PointIndex: Int32, RotationAngles: Double
# ---------- py3_2: Python ----------
# Import necessary modules for RoboDK communication and robot programming
import robolink as rl        # RoboLink module to interact with RoboDK software
import robodk as rdk         # RoboDK module for robot simulations and manipulations
from math import radians     # Function to convert degrees to radians

# Set this to True to enable debug outputs for troubleshooting
debug = True

# Check if the script is running inside Rhino/Grasshopper environment
try:
    # Try to import Rhino.Geometry module
    import Rhino.Geometry as rg
    inside_rhino = True
    if debug:
        print("Running inside Rhino/Grasshopper environment.")
except ImportError:
    # If import fails, assume script is running outside Rhino and use rhino3dm
    import rhino3dm as rg
    inside_rhino = False
    if debug:
        print("Running outside Rhino; using rhino3dm.")

# Initialize the RoboDK API (RoboLink) to communicate with RoboDK software
RDK = rl.Robolink()

# Define a custom exception class for robot-related errors
class RobotError(Exception):
    pass

def connect_to_robot(robot_name):
    """
    Connects to a robot in the RoboDK station by its name.

    Parameters:
    robot_name (str): The name of the robot to connect to.

    Returns:
    robot (Robolink.Item): The robot item in RoboDK.

    Raises:
    RobotError: If the robot is not found in the RoboDK station.
    """
    if debug:
        print(f"Attempting to connect to robot '{robot_name}'.")
    # Search for the robot in the RoboDK station
    robot = RDK.Item(robot_name, rl.ITEM_TYPE_ROBOT)
    if not robot.Valid():
        # If robot is not found, raise an error
        raise RobotError(f"Could not find robot '{robot_name}' in RoboDK.")
    if debug:
        print(f"Successfully connected to robot '{robot_name}'.")
    return robot

def set_robot_base(robot, rotation_angles, robot_name):
    """
    Sets the robot's base frame orientation to the specified rotation angles while keeping the current position.

    Parameters:
    robot (Robolink.Item): The robot item in RoboDK.
    rotation_angles (tuple): A tuple containing rotation angles (rx_deg, ry_deg, rz_deg) in degrees.
    robot_name (str): The name of the robot.

    Returns:
    str: A success message indicating the new base orientation.

    Raises:
    RobotError: If the robot base cannot be found or accessed.
    """
    if debug:
        print(f"Setting base orientation for robot '{robot_name}'.")
        print(f"Rotation angles (degrees): RX={rotation_angles[0]}, RY={rotation_angles[1]}, RZ={rotation_angles[2]}")

    # Get the robot's parent item, which should be its base frame
    robot_base = robot.Parent()
    if robot_base.Valid():
        # Retrieve the current pose (position and orientation) of the robot base
        current_base_pose = robot_base.Pose()
        # Extract the position component of the pose
        current_position = current_base_pose.Pos()

        # Unpack rotation angles
        rx_deg, ry_deg, rz_deg = rotation_angles
        # Create a rotation matrix from the specified rotation angles
        rotation_matrix = (
            rdk.rotx(radians(rx_deg)) *
            rdk.roty(radians(ry_deg)) *
            rdk.rotz(radians(rz_deg))
        )

        # Combine the current position with the new rotation to create the new base pose
        new_base_pose = rdk.transl(*current_position) * rotation_matrix

        # Update the robot's base frame with the new pose
        robot_base.setPose(new_base_pose)

        if debug:
            print("Robot base orientation has been set successfully.")
    else:
        # If the robot base is not valid, raise an error
        raise RobotError("Could not find or access the robot base.")

    return f"Robot '{robot_name}' base orientation set to RX={rx_deg}, RY={ry_deg}, RZ={rz_deg} degrees."

def get_current_base_position(robot):
    """
    Retrieves the current base position and the first joint rotation of the robot.

    Parameters:
    robot (Robolink.Item): The robot item in RoboDK.

    Returns:
    str: A message containing the current base position and the first joint rotation.

    Raises:
    RobotError: If the robot base cannot be retrieved.
    """
    if debug:
        print("Retrieving current base position of the robot.")
    # Get the robot's parent item, which should be its base frame
    robot_base = robot.Parent()
    if robot_base.Valid():
        # Retrieve the current pose (position and orientation) of the robot base
        current_base_pose = robot_base.Pose()
        # Extract the position component of the pose
        current_position = current_base_pose.Pos()
        # Get the robot's current joint angles
        joints = robot.Joints().list()
        # Get the rotation angle of the first joint (in degrees)
        first_joint_deg = joints[0]
        if debug:
            print(f"Current base position: X={current_position[0]}, Y={current_position[1]}, Z={current_position[2]}, First joint rotation: {first_joint_deg} degrees.")
        return f"Current base position: X={current_position[0]}, Y={current_position[1]}, Z={current_position[2]}, First joint rotation: {first_joint_deg} degrees"
    else:
        # If the robot base is not valid, raise an error
        raise RobotError("Could not retrieve base position.")

def validate_point_index(point_index, points_list):
    """
    Validates that the given point index is within the bounds of the points list.

    Parameters:
    point_index (int): The index of the point to validate.
    points_list (list): The list of points.

    Returns:
    bool: True if the index is valid, False otherwise.
    """
    if debug:
        print(f"Validating point index {point_index} (Total points: {len(points_list)}).")
    # Check if point_index is within the range of points_list
    return 0 <= point_index < len(points_list)

def rhino_to_robodk_coordinates(point):
    """
    Converts a point from Rhino coordinate system to RoboDK coordinate system.

    Parameters:
    point (rg.Point3d): The point to convert.

    Returns:
    tuple: A tuple containing the X, Y, Z coordinates.
    """
    if debug:
        print(f"Converting point ({point.X}, {point.Y}, {point.Z}) to RoboDK coordinates.")
    # Return the point's coordinates as a tuple
    return point.X, point.Y, point.Z

# Main script logic starts here
try:
    # If the script is running outside Rhino, set default input parameters
    if not inside_rhino:
        # Define the robot's name as it appears in RoboDK
        RobotName = 'YourRobotName'
        # Define a list of table points (positions) using Rhino geometry points
        TablePoints = [
            rg.Point3d(100, 200, 300),
            rg.Point3d(400, 500, 600),
        ]
        # Select the index of the point to use from TablePoints
        PointIndex = 0
        # Boolean flag to determine if the robot's base should be set
        SetBase = True
        # Define the rotation angles for setting the robot base orientation
        RotationAngles = (0, 0, 180)  # Rotation angles as a tuple (RX, RY, RZ) in degrees

    # Debug output of input parameters
    if debug:
        print("All input parameters have been validated.")
        print(f"RobotName: {RobotName}")
        print(f"PointIndex: {PointIndex}")
        print(f"SetBase: {SetBase}")
        if SetBase:
            print(f"RotationAngles: RX={RotationAngles[0]}, RY={RotationAngles[1]}, RZ={RotationAngles[2]}")

    # Connect to the robot specified by RobotName
    robot = connect_to_robot(RobotName)

    # Validate that the selected point index is within the range of TablePoints
    if not validate_point_index(PointIndex, TablePoints):
        raise IndexError(f"Point index {PointIndex} is out of bounds.")

    # Retrieve the selected point from TablePoints
    point = TablePoints[PointIndex]
    # Convert the Rhino point to RoboDK coordinates
    x, y, z = rhino_to_robodk_coordinates(point)

    # Debug output of the point coordinates
    if debug:
        print(f"Using point coordinates: X={x}, Y={y}, Z={z}")

    if SetBase:
        # Set the robot's base frame orientation to the specified rotation angles
        SuccessMessage = set_robot_base(robot, RotationAngles, RobotName)
        # Prepare a message with the new base orientation
        BasePosition = f"Base orientation set to: RX={RotationAngles[0]}, RY={RotationAngles[1]}, RZ={RotationAngles[2]} degrees"

        if debug:
            # Debug output of success messages
            print(SuccessMessage)
            print(BasePosition)
    else:
        # Retrieve the current base position and first joint rotation
        BasePosition = get_current_base_position(robot)
        SuccessMessage = f"Connected to robot '{RobotName}' and retrieved current base position and first joint rotation."

        if debug:
            # Debug output of success messages
            print(SuccessMessage)
            print(BasePosition)

except (RobotError, IndexError, NameError) as e:
    # Catch any custom RobotError, IndexError, or NameError exceptions
    SuccessMessage = f"Error: {e}"
    BasePosition = ""

    if debug:
        # Debug output of the error message
        print(SuccessMessage)

# If the script is running inside Rhino, assign outputs to variables
if inside_rhino:
    # Assign output variables for Rhino/Grasshopper components
    A = SuccessMessage
    B = BasePosition
else:
    # If running outside Rhino, print the outputs to the console
    print(SuccessMessage)
    print(BasePosition)
# ---------- end py3_2 ----------
py3_3 = Python3Script(
    TablePoints=tablepointscomau_2,
    RobotName=robotnameb_3,
    PointIndex=robotbaseindexb_2,
    SetBase=reset,
    RotationAngles=baserotationb_2)  # -> out, BasePosition, SuccessMessage; inputs TablePoints: list of Point3d, PointIndex: Int32, RotationAngles: Double; same code as py3_2

# Debug Info
panel_22 = Panel(py3_2.out)
panel_23 = Panel(py3_3.out)
panel_24 = Panel(py3_2.BasePosition)
panel_25 = Panel(py3_2.SuccessMessage)
panel_26 = Panel(py3_3.BasePosition)
panel_27 = Panel(py3_3.SuccessMessage)

# ---- group: b_Phase A / in_TablePoints / out_TablePoints
tablepointscomau_3 = RemoteReceiver(tablepointscomau)
tablepointsur5_3 = RemoteReceiver(tablepointsur5)

# ---- group: b_Phase A / in_TablePoints / viz_TablePoints
points = PointList(Points=move_2.Geometry, Size=Slider(2, range=1..10))
points_2 = PointList(Points=move_3.Geometry, Size=Slider(2, range=1..10))

# ---- group: b_Phase A / in_TablePoints / out_RobotBase
item_5 = ListItem(List=tablepointscomau_3, Index=robotbaseindexb, Wrap=True)
item_6 = ListItem(List=tablepointsur5_3, Index=robotbaseindexa_2, Wrap=True)
comaubase = RemoteSender(item_5)
ur5base = RemoteSender(item_6)

# ---- group: b_Phase A / in_TablePoints (continued)
pdecon = Deconstruct(Point=tablepointscomau_3)  # -> XComponent, YComponent, ZComponent
pdecon_2 = Deconstruct(Point=tablepointsur5_3)  # -> XComponent, YComponent, ZComponent
concat_3 = Concatenate(
    FragmentA="{",
    FragmentB=pdecon.XComponent,
    FragmentA_2=",",
    FragmentB_2=pdecon.YComponent,
    FragmentA_3=",",
    FragmentA_4=pdecon.ZComponent,
    FragmentA_5="}")  # -> flatten(Result)
concat_4 = Concatenate(
    FragmentA="{",
    FragmentB=pdecon_2.XComponent,
    FragmentA_2=",",
    FragmentB_2=pdecon_2.YComponent,
    FragmentA_3=",",
    FragmentA_4=pdecon_2.ZComponent,
    FragmentA_5="}")  # -> flatten(Result)

# ---- group: calc_Calculate Orientation Points / out_RobotBase
comaubase_2 = RemoteReceiver(comaubase)
ur5base_2 = RemoteReceiver(ur5base)

# ---- group: calc_Calculate Orientation Points
# Robot Orientation Point
panel_28 = Panel("2")
division = Division(A=reach_robot_a, B="2")
division_2 = Division(A=reach_robot_b, B=panel_28)
Z_4 = UnitZ(Factor=division_2)
pt_2 = Point(ur5base_2)
Z_5 = UnitZ(Factor=division)
pt_3 = Point(comaubase_2)
move_4 = Move(Geometry=pt_2, Motion=Z_5)  # -> Geometry, Transform
move_5 = Move(Geometry=pt_3, Motion=Z_4)  # -> Geometry, Transform

# ---- group: calc_Calculate Orientation Points / out_
orientation_point_b = RemoteSender(move_5.Geometry)
orientation_point_a = RemoteSender(move_4.Geometry)

# ---- group: calc_TaskDistribution
# Task Distribution Robots
# Here the structure edges are being distributed
# to the most appropriate robot according to the reach of each one.
orientation_point_a_2 = RemoteReceiver(orientation_point_a)
orientation_point_b_2 = RemoteReceiver(orientation_point_b)
py3_4 = Python3Script(EdgesTree=line, RobotPointA=orientation_point_a_2, RobotPointB=orientation_point_b_2)  # -> out, assembly_order, task_allocation; inputs EdgesTree: tree of Line, RobotPointA: Point3d, RobotPointB: Point3d
# ---------- py3_4: Python ----------
# Import necessary modules from Rhino and Grasshopper
import Rhino.Geometry as rg                       # Provides geometric types and operations for Rhino
from Grasshopper import DataTree                  # Allows creation and manipulation of DataTrees in Grasshopper
from Grasshopper.Kernel.Data import GH_Path       # Represents a path in a DataTree

# Inputs:
# EdgesTree: DataTree of Line objects representing truss edges
# RobotPointA: Point3d representing Robot A's base location
# RobotPointB: Point3d representing Robot B's base location

# Initialize output DataTrees for assembly order and task allocation
assembly_order = DataTree[object]()               # Will store the edges in the order they should be assembled
task_allocation = DataTree[str]()                 # Will store the robot assignment for each edge

# Initialize lists to collect all distances from edge midpoints to each robot
distances_A = []                                  # Distances from edges to Robot A
distances_B = []                                  # Distances from edges to Robot B

# First pass: Calculate distances from each edge's midpoint to both robots to determine maximum distances
for path in EdgesTree.Paths:
    edges = EdgesTree.Branch(path)                # Get all edges in the current branch
    for edge in edges:
        mid_point = edge.PointAt(0.5)             # Calculate the midpoint of the edge
        dist_to_A = mid_point.DistanceTo(RobotPointA)  # Distance to Robot A
        dist_to_B = mid_point.DistanceTo(RobotPointB)  # Distance to Robot B
        distances_A.append(dist_to_A)             # Collect distances for Robot A
        distances_B.append(dist_to_B)             # Collect distances for Robot B

# Determine the maximum distances to each robot for normalization purposes
max_dist_A = max(distances_A) if distances_A else 1.0  # Avoid division by zero
max_dist_B = max(distances_B) if distances_B else 1.0

# Second pass: Process each branch to assign edges to robots based on proximity
for path in EdgesTree.Paths:
    edges = EdgesTree.Branch(path)                # Get edges in the current branch
    num_edges = len(edges)                        # Number of edges in this branch
    assembly_branch = []                          # Will hold the assembly order for this branch
    allocation_branch = []                        # Will hold the task allocation for this branch

    # Collect detailed data about each edge
    edge_data = []
    for idx, edge in enumerate(edges):
        mid_point = edge.PointAt(0.5)             # Midpoint of the edge
        dist_to_A = mid_point.DistanceTo(RobotPointA)  # Absolute distance to Robot A
        dist_to_B = mid_point.DistanceTo(RobotPointB)  # Absolute distance to Robot B
        rel_dist_to_A = dist_to_A / max_dist_A    # Normalized distance to Robot A
        rel_dist_to_B = dist_to_B / max_dist_B    # Normalized distance to Robot B
        edge_data.append({
            'index': idx,                         # Original index of the edge
            'edge': edge,                         # The edge geometry
            'dist_to_A': dist_to_A,               # Absolute distance to Robot A
            'dist_to_B': dist_to_B,               # Absolute distance to Robot B
            'rel_dist_to_A': rel_dist_to_A,       # Relative distance to Robot A
            'rel_dist_to_B': rel_dist_to_B        # Relative distance to Robot B
        })

    # Special handling for the first branch
    if path.Indices[-1] == 0:
        # Determine which robot is closer overall to the edges in this branch
        total_rel_dist_A = sum(e['rel_dist_to_A'] for e in edge_data)
        total_rel_dist_B = sum(e['rel_dist_to_B'] for e in edge_data)
        if total_rel_dist_A <= total_rel_dist_B:
            closer_robot = '0'                    # Robot A is closer
            farther_robot = '1'                   # Robot B is farther
        else:
            closer_robot = '1'                    # Robot B is closer
            farther_robot = '0'                   # Robot A is farther

        # Assign edges to robots
        # Closer robot gets two edges farthest from its base
        # Farther robot gets one edge closest to its base
        if closer_robot == '0':
            edge_data.sort(key=lambda e: e['dist_to_A'], reverse=True)
            closer_edges = edge_data[:2]          # Two edges for Robot A
            farther_edges = [e for e in edge_data if e not in closer_edges]
            farther_edge = min(farther_edges, key=lambda e: e['dist_to_B'])  # Edge for Robot B
        else:
            edge_data.sort(key=lambda e: e['dist_to_B'], reverse=True)
            closer_edges = edge_data[:2]          # Two edges for Robot B
            farther_edges = [e for e in edge_data if e not in closer_edges]
            farther_edge = min(farther_edges, key=lambda e: e['dist_to_A'])  # Edge for Robot A

        # Prepare the list of assigned edges with their corresponding robot
        assigned_edges = []
        for e in closer_edges:
            assigned_edges.append((e['index'], closer_robot, e['edge']))
        assigned_edges.append((farther_edge['index'], farther_robot, farther_edge['edge']))

        # Arrange edges to alternate robots for the first two edges if necessary
        assigned_edges.sort(key=lambda x: x[0])   # Sort by original index to maintain order
        if assigned_edges[0][1] == assigned_edges[1][1]:
            # Swap second and third edges if first two are assigned to the same robot
            assigned_edges[1], assigned_edges[2] = assigned_edges[2], assigned_edges[1]

        # Add assigned edges to the output branches
        for idx, robot, edge in assigned_edges:
            assembly_branch.append(edge)
            allocation_branch.append(robot)
    else:
        # For other branches, assign each edge to the closest robot
        for e in edge_data:
            idx = e['index']
            edge = e['edge']
            if e['rel_dist_to_A'] <= e['rel_dist_to_B']:
                robot = '0'                        # Assign to Robot A
            else:
                robot = '1'                        # Assign to Robot B
            assembly_branch.append(edge)
            allocation_branch.append(robot)

        # Note: Edges are kept in their original order to maintain assembly sequence

    # Add the assembly order and task allocation for this branch to the output DataTrees
    assembly_order.AddRange(assembly_branch, path)
    task_allocation.AddRange(allocation_branch, path)

# Outputs:
# assembly_order: DataTree of edges in the determined assembly order
# task_allocation: DataTree of strings indicating which robot ('0' or '1') is assigned to each edge
# ---------- end py3_4 ----------

# ---- group: out_
assembly_order = RemoteSender(py3_4.assembly_order)
task_allocation = RemoteSender(py3_4.task_allocation)

# ---- group: viz_3D MODEL
# Display_TaskDis
assembly_order_2 = RemoteReceiver(assembly_order)
number_slider_4 = Slider(32, range=0..32)
task_allocation_2 = RemoteReceiver(task_allocation)
split_2 = SplitList(List=flatten(assembly_order_2), Index=number_slider_4)  # -> ListA, ListB
split_3 = SplitList(List=flatten(task_allocation_2), Index=number_slider_4)  # -> ListA, ListB
dispatch = Dispatch(List=split_2.ListA, DispatchPattern=split_3.ListA)  # -> ListA, ListB
pipe = Pipe(Curve=dispatch.ListA, Radius=5, Caps=0)
pipe_2 = Pipe(Curve=dispatch.ListB, Radius=5, Caps=0)
entwine_6 = Entwine(Branch00=pipe, Branch01=pipe_2, FlattenInputs=True)
robotcurve = RemoteSender(entwine_6)

# ---- group: calc_ / out_
assembly_order_3 = RemoteReceiver(assembly_order)
task_allocation_3 = RemoteReceiver(task_allocation)
orientation_point_b_3 = RemoteReceiver(orientation_point_b)

task_allocation_4 = RemoteReceiver(task_allocation)
assembly_order_4 = RemoteReceiver(assembly_order)
orientation_point_a_3 = RemoteReceiver(orientation_point_a)

# ---- group: calc__RobotOrientationToStructure
# Robot Orientation To Structure
# This part of the script will calculate the approach and target angles for each robot.
# average point of the 5 closest lines in the current state of assembly
flatten = FlattenTree(Tree=py3_4.assembly_order, Path="{0}")
listdexs = ListIndices(List=flatten)
split_4 = SplitList(List=flatten, Index=graft(listdexs))  # -> simplify(ListA), ListB
number_slider_5 = Slider(5, range=0..10)
ins = InsertItems(List=split_4.ListA, Item=explode.Segments, Indices=0, Wrap=False)
midpt = CurveMiddle(Curve=ins)
item_7 = ListItem(List=midpt, Index="-1", Wrap=True)
dist = Distance(PointA=midpt, PointB=item_7)
dom_2 = ConstructDomain(DomainStart=0, DomainEnd=number_slider_5)
sort = SortList(Keys=dist, ValuesA=midpt)  # -> Keys, ValuesA
line_2 = Line(flatten)
range_2 = Range(Domain=dom_2, Steps=number_slider_5)
midpt_2 = CurveMiddle(Curve=line_2)
end_4 = EndPoints(Curve=line_2)  # -> Start, End
item_8 = ListItem(List=sort.ValuesA, Index=range_2, Wrap=True)
avr = Average(Input=item_8)  # -> flatten(ArithmeticMean)
pl_3pt = Plane3Pt(PointA=midpt_2, PointB=end_4.Start, PointC=avr)
rotate_plane_by_axis = RotatePlaneByAxis(Plane=pl_3pt, Axis="x", Angle=270)
assembly_order_5 = RemoteReceiver(assembly_order)
task_allocation_5 = RemoteReceiver(task_allocation)
pflip = FlipPlane(Plane=rotate_plane_by_axis, ReverseX=False, ReverseY=False, SwapAxes=False)
unflatten = UnflattenTree(Tree=pflip, Guide=assembly_order_5)
dispatch_2 = Dispatch(List=unflatten, DispatchPattern=task_allocation_5)  # -> ListA, ListB

# ---- group: calc_
# target angle tuning
# Orientation Frames Robot B
dispatch_3 = Dispatch(List=assembly_order_3, DispatchPattern=task_allocation_3)  # -> ListA, ListB
pt_4 = Point(orientation_point_b_3)
line_3 = Line(dispatch_3.ListB)
midpt_3 = CurveMiddle(Curve=line_3)
end_5 = EndPoints(Curve=line_3)  # -> Start, End
pl_3pt_2 = Plane3Pt(PointA=midpt_3, PointB=end_5.Start, PointC=pt_4)
rotate_plane_by_axis_2 = RotatePlaneByAxis(Plane=pl_3pt_2, Axis="x", Angle=90)
pflip_2 = FlipPlane(Plane=rotate_plane_by_axis_2, ReverseX=False, ReverseY=False, SwapAxes=False)
pln_2 = Plane(pflip_2)

# Orientation Frames Robot A
dispatch_4 = Dispatch(List=assembly_order_4, DispatchPattern=task_allocation_4)  # -> ListA, ListB
line_4 = Line(dispatch_4.ListA)
midpt_4 = CurveMiddle(Curve=line_4)
end_6 = EndPoints(Curve=line_4)  # -> Start, End
pt_5 = Point(orientation_point_a_3)
pl_3pt_3 = Plane3Pt(PointA=midpt_4, PointB=end_6.Start, PointC=pt_5)
rotate_plane_by_axis_3 = RotatePlaneByAxis(Plane=pl_3pt_3, Axis="x", Angle=90)
pflip_3 = FlipPlane(Plane=rotate_plane_by_axis_3, ReverseX=False, ReverseY=False, SwapAxes=False)
pln_3 = Plane(pflip_3)

# ---- group: calc_Planes
# Pick Up Planes A
ur5base_3 = RemoteReceiver(ur5base)
xy = XYPlane(Origin=ur5base_3)
rotate_plane_by_axis_4 = RotatePlaneByAxis(Plane=xy, Axis="z", Angle=90)
move_6 = Move(Geometry=rotate_plane_by_axis_4, Motion=Vector(600, 0, -110))  # -> Geometry, Transform
arrlinear = LinearArray(Geometry=move_6.Geometry, Direction=Vector(120, 0, 0), Count=2)  # -> Geometry, Transform
flip_plane = FlipPlane(Plane=arrlinear.Geometry)

# ---- group: calc_Planes / ctrl_planerotation
py3_5 = Python3Script(
    plane=flip_plane,
    x_rot=Slider(0, range=0..180),
    y_rot=Slider(0, range=0..180),
    z_rot=Slider(0, range=-180..180),
    swap_xy=False)  # -> out, a; inputs plane: Plane, swap_xy: Boolean
# ---------- py3_5: Python ----------
import Rhino.Geometry as rg
import math

def rotate_plane(plane, x_rot, y_rot, z_rot, swap_xy=False):
    """
    Rotates a plane around its X, Y, and Z axes and optionally swaps the X and Y axes while maintaining the Z-axis direction.

    :param plane: The input plane to rotate. Should be of type rg.Plane or list containing rg.Plane.
    :param x_rot: Rotation in degrees around the X-axis.
    :param y_rot: Rotation in degrees around the Y-axis.
    :param z_rot: Rotation in degrees around the Z-axis.
    :param swap_xy: Boolean to indicate if the X and Y axes should be swapped. Default is False.
    :return: The rotated (and possibly swapped) plane.
    """
    # Check if the input plane is a list and extract it if necessary
    if isinstance(plane, list):
        plane = plane[0]  # Assuming it's a single item list containing the plane

    if not isinstance(plane, rg.Plane):
        raise TypeError("Input must be of type Rhino.Geometry.Plane")

    # Create a copy of the original plane to work with
    rotated_plane = plane.Clone()

    # Store the original plane's origin to lock its position
    locked_origin = rotated_plane.Origin

    # Rotate around the plane's X-axis first (if needed)
    if x_rot != 0:
        rotation_x = rg.Transform.Rotation(math.radians(x_rot), rotated_plane.XAxis, locked_origin)
        rotated_plane.Transform(rotation_x)

    # Rotate around the Y-axis of the updated plane (if needed)
    if y_rot != 0:
        rotation_y = rg.Transform.Rotation(math.radians(y_rot), rotated_plane.YAxis, locked_origin)
        rotated_plane.Transform(rotation_y)

    # Rotate around the Z-axis of the updated plane (if needed)
    if z_rot != 0:
        rotation_z = rg.Transform.Rotation(math.radians(z_rot), rotated_plane.ZAxis, locked_origin)
        rotated_plane.Transform(rotation_z)

    # Set the origin of the rotated plane back to the locked origin to ensure no movement
    rotated_plane.Origin = locked_origin

    # Swap the X and Y axes if the swap_xy parameter is True
    if swap_xy:
        # Directly swap the X and Y axes
        new_x_axis = rotated_plane.YAxis
        new_y_axis = rotated_plane.XAxis

        # Calculate the resulting Z-axis using the cross-product of the swapped axes
        resulting_z_axis = rg.Vector3d.CrossProduct(new_x_axis, new_y_axis)

        # Check if the resulting Z-axis is aligned with the original Z-axis
        if resulting_z_axis.IsParallelTo(rotated_plane.ZAxis, 0.0001) == -1:
            # If it's the opposite direction, flip one of the swapped axes to correct it
            new_x_axis.Reverse()  # You can also reverse new_y_axis instead if needed

        # Create a new plane with swapped X and Y axes and the corrected Z direction
        rotated_plane = rg.Plane(locked_origin, new_x_axis, new_y_axis)

    return rotated_plane

# Inputs
# plane: Plane input from Grasshopper (type: rg.Plane or list containing rg.Plane)
# x_rot: Rotation in degrees around the X-axis (input 0 here)
# y_rot: Rotation in degrees around the Y-axis (input 0 here)
# z_rot: Rotation in degrees around the Z-axis (input 180 here)
# swap_xy: Boolean indicating whether to swap the X and Y axes

rotated_plane = rotate_plane(plane, x_rot, y_rot, z_rot, swap_xy)

# Output
a = rotated_plane
# ---------- end py3_5 ----------

# ---- group: calc_Planes / viz_
pln_4 = Plane(py3_5.a)
deplane = DeconstructPlane(Plane=pln_4)  # -> Origin, XAxis, YAxis, ZAxis
amp = Amplitude(Vector=deplane.ZAxis, Amplitude=100)
vdis = VectorDisplay(Anchor=deplane.Origin, Vector=amp)

# ---- group: viz_3D MODEL
assembly_order_6 = RemoteReceiver(assembly_order)
base_edges_2 = RemoteReceiver(base_edges)
explode_2 = Explode(Curve=base_edges_2, Recursive=True)  # -> Segments, Vertices
line_5 = Line(explode_2.Segments)
midpt_5 = CurveMiddle(Curve=line_5)
end_7 = EndPoints(Curve=line_5)  # -> Start, End
move_7 = Move(Geometry=midpt_5, Motion=Vector(0, 0, 10))  # -> Geometry, Transform
pl_3pt_4 = Plane3Pt(PointA=midpt_5, PointB=end_7.Start, PointC=move_7.Geometry)
rotate_plane_by_axis_5 = RotatePlaneByAxis(Plane=pl_3pt_4, Axis="x", Angle=270)
merge_7 = Merge(Data1=explode_2.Segments, Data2=assembly_order_6)

addition = Addition(A=node_size, B=gap_material)
subtraction = Subtraction(A=node_size, B=overlap_node)
neg = Negative(Value=subtraction)
ext = ExtendCurve(Curve=merge_7, Type=0, Start=neg, End=neg)

line_6 = Line(ext)
depth_hole = Slider(25, range=0..100)
diameter_hole = Slider(2.5, range=0..10)
flip = FlipCurve(Curve=line_6)  # -> Curve, Flag
end_8 = EndPoints(Curve=line_6)  # -> Start, End
end_9 = EndPoints(Curve=flip.Curve)  # -> Start, End
vec2pt = Vector2Pt(PointA=end_8.Start, PointB=end_8.End, Unitize=False)  # -> Vector, Length
vec2pt_2 = Vector2Pt(PointA=end_9.Start, PointB=end_9.End, Unitize=False)  # -> Vector, Length
line_7 = LineSDL(Start=end_8.Start, Direction=expr("-x", vec2pt.Vector), Length=depth_hole)  # -> flatten(Line)
line_8 = LineSDL(Start=end_9.Start, Direction=expr("-x", vec2pt_2.Vector), Length=depth_hole)  # -> flatten(Line)
pipe_3 = Pipe(Curve=line_7, Radius=expr("x/2", diameter_hole), Caps=0)
pipe_4 = Pipe(Curve=line_8, Radius=expr("x/2", diameter_hole), Caps=0)

subtraction_2 = Subtraction(A=addition, B=overlap_node)
crv = Curve(flatten(merge_7))
explode_3 = Explode(Curve=crv, Recursive=True)  # -> Segments, Vertices
neg_2 = Negative(Value=subtraction_2)
cullpt = CullDuplicates(Points=flatten(explode_3.Vertices), Tolerance=1, CullMode=3)  # -> Points, Indices, Valence
ext_2 = ExtendCurve(Curve=merge_7, Type=0, Start=neg_2, End=neg_2)
sph = Sphere(Base=cullpt.Points, Radius=node_size)
trim = TrimWithBreps(Curve=crv, Brep=sph)  # -> flatten(Inside), Outside
mp = MultiPipe(Curves=trim.Inside, NodeSize=hub_size, EndOffset=1, StrutSize=1, Segment=0, KinkAngle=0.6, CubeFit=0, Caps=2)  # -> graft(Pipe)
debrep = DeconstructBrep(Brep=mp)  # -> Faces, Edges, Vertices
join = BrepJoin(Breps=debrep.Faces)  # -> Breps, Closed

line_9 = Line(ext)
number_slider_6 = Slider(55, range=0..100)
flip_2 = FlipCurve(Curve=line_9)  # -> Curve, Flag
end_10 = EndPoints(Curve=line_9)  # -> Start, End
end_11 = EndPoints(Curve=flip_2.Curve)  # -> Start, End
vec2pt_3 = Vector2Pt(PointA=end_10.Start, PointB=end_10.End, Unitize=False)  # -> Vector, Length
vec2pt_4 = Vector2Pt(PointA=end_11.Start, PointB=end_11.End, Unitize=False)  # -> Vector, Length
line_10 = LineSDL(Start=end_10.Start, Direction=vec2pt_3.Vector, Length=number_slider_6)  # -> flatten(Line)
line_11 = LineSDL(Start=end_11.Start, Direction=vec2pt_4.Vector, Length=number_slider_6)  # -> flatten(Line)

# ---- group: viz_3D MODEL / ctrl_3DPreview
robotcurve_2 = RemoteReceiver(robotcurve)
list_2 = ValueList({"TASK ALLOCATION": 0, "3D PREVIEW": 1}, selected="TASK ALLOCATION")
data = Data(robotcurve_2)
number_slider_7 = Slider(0.56, range=0..1)
entwine_7 = Entwine(
    Branch00=ColourSwatch(SwatchColor=RGB(255, 0, 0)),
    Branch01=ColourSwatch(SwatchColor=RGB(0, 208, 250)),
    FlattenInputs=True)
entwine_8 = Entwine(
    Branch00=ColourSwatch(SwatchColor=RGB(209, 186, 128)),
    Branch01=ColourSwatch(SwatchColor=RGB(0, 0, 0)),
    Branch02=ColourSwatch(SwatchColor=RGB(150, 150, 150)),
    FlattenInputs=True)
createatts = CreateAttributes(LayerName="8.Viz", enableFullPath=False)

# ---- group: calc_
# Guide planes Robot A
number_slider_8 = Slider(312, range=-1000..1000)
ur5homeplane_2 = RemoteReceiver(ur5homeplane)
input_lines_2 = RemoteReceiver(input_lines)
ur5base_4 = RemoteReceiver(ur5base)
explode_4 = Explode(Curve=input_lines_2, Recursive=True)  # -> Segments, flatten(Vertices)
py3_6 = Python3Script(
    plane=ur5homeplane_2,
    center_pt=ur5base_4,
    angle_x=Slider(0, range=-180..180),
    angle_y=Slider(90, range=-180..180),
    angle_z=Slider(0, range=-180..180))  # -> out, rotated_plane; inputs plane: Plane, center_pt: Point3d
# ---------- py3_6: Python ----------
import Rhino.Geometry as rg
import math

# Inputs
# plane: input plane to rotate
# center_pt: center point for rotation
# angle_x, angle_y, angle_z: rotation angles in degrees for each axis

def rotate_plane(plane, center_pt, angle_x, angle_y, angle_z):
    # Convert degrees to radians for Rhino rotation transformations
    angle_x = math.radians(angle_x)
    angle_y = math.radians(angle_y)
    angle_z = math.radians(angle_z)
    
    # Create transformation matrices for each rotation axis around the center point
    rotation_x = rg.Transform.Rotation(angle_x, plane.XAxis, center_pt)
    rotation_y = rg.Transform.Rotation(angle_y, plane.YAxis, center_pt)
    rotation_z = rg.Transform.Rotation(angle_z, plane.ZAxis, center_pt)

    # Apply each rotation sequentially
    rotated_plane = plane.Clone()
    rotated_plane.Transform(rotation_x)
    rotated_plane.Transform(rotation_y)
    rotated_plane.Transform(rotation_z)

    return rotated_plane

# Output
rotated_plane = rotate_plane(plane, center_pt, angle_x, angle_y, angle_z)
# ---------- end py3_6 ----------
Y = UnitY(Factor=number_slider_8)
avr_2 = Average(Input=explode_4.Vertices)
move_8 = Move(Geometry=py3_6.rotated_plane, Motion=Y)  # -> Geometry, Transform
deplane_2 = DeconstructPlane(Plane=move_8.Geometry)  # -> Origin, XAxis, YAxis, ZAxis
Z_6 = UnitZ(Factor=Slider(0, range=-100..100))
move_9 = Move(Geometry=deplane_2.Origin, Motion=Z_6)  # -> Geometry, Transform
task_allocation_6 = RemoteReceiver(task_allocation)
pt_6 = Point(move_9.Geometry)
vec2pt_5 = Vector2Pt(PointA=pt_6, PointB=avr_2, Unitize=False)  # -> Vector, Length

# Guide planes Robot B
input_lines_3 = RemoteReceiver(input_lines)
explode_5 = Explode(Curve=input_lines_3, Recursive=True)  # -> Segments, flatten(Vertices)
avr_3 = Average(Input=explode_5.Vertices)
dist_2 = Distance(PointA=avr_3, PointB=explode_5.Vertices)
sort_2 = SortList(Keys=dist_2)  # -> reverse(Keys), ValuesA
item_9 = ListItem(List=sort_2.Keys, Index=0, Wrap=True)
task_allocation_7 = RemoteReceiver(task_allocation)
vec = VectorXYZ(XComponent=0, YComponent=expr("-x", item_9), ZComponent=item_9)  # -> Vector, Length
move_10 = Move(Geometry=avr_3, Motion=vec.Vector)  # -> Geometry, Transform
vec2pt_6 = Vector2Pt(PointA=move_10.Geometry, PointB=avr_3, Unitize=False)  # -> Vector, Length

# ---- group: calc_Planes
# Target Planes
number_slider_9 = Slider(0.5, range=0..1)
task_allocation_8 = RemoteReceiver(flatten(task_allocation))
twn2plns = TweenTwoPlanes(PlaneA=flatten(pln_2), PlaneB=flatten(dispatch_2.ListB), Factor=number_slider_9, Quaternion=True)  # -> flatten(Tween)
assembly_order_7 = RemoteReceiver(assembly_order)
twn2plns_2 = TweenTwoPlanes(PlaneA=flatten(pln_3), PlaneB=flatten(dispatch_2.ListA), Factor=number_slider_9, Quaternion=True)  # -> flatten(Tween)
weave = Weave(Pattern=task_allocation_8, Stream0=twn2plns, Stream1=twn2plns_2, NullGaps=False)
unflatten_2 = UnflattenTree(Tree=weave, Guide=assembly_order_7)
target_planes = RemoteSender(unflatten_2)

# ---- group: viz_3D MODEL (continued)
target_planes_2 = RemoteReceiver(target_planes)
merge_8 = Merge(Data1=rotate_plane_by_axis_5, Data2=target_planes_2)

rotate_plane_by_axis_6 = RotatePlaneByAxis(Plane=merge_8, Axis="x", Angle=90)
offcrv = OffsetCurve(
    Curve=flatten(ext),
    Plane=flatten(rotate_plane_by_axis_6),
    Distance=expr("x/2", thickness_montageband),
    BothSides=expr("-x/2", thickness_montageband),
    Kinks=0,
    CapType=1)

amp_2 = Amplitude(Vector=rotate_plane_by_axis_6, Amplitude=expr("x*2.5", hub_size))  # -> flatten(Vector)
amp_3 = Amplitude(Vector=merge_8, Amplitude=element_thickness_width)  # -> flatten(Vector)
offcrv_2 = OffsetCurve(
    Curve=flatten(ext_2),
    Plane=flatten(merge_8),
    Distance=expr("x/2", element_thickness_width),
    BothSides=expr("-x/2", element_thickness_width),
    Kinks=0,
    CapType=1)
offcrv_3 = OffsetCurve(
    Curve=flatten(ext),
    Plane=flatten(merge_8),
    Distance=expr("x/2", element_thickness_width),
    BothSides=expr("-x/2", element_thickness_width),
    Kinks=0,
    CapType=1)
extr = Extrude(Base=flatten(offcrv_2), Direction=flatten(amp_3))
extr_2 = Extrude(Base=flatten(offcrv_3), Direction=flatten(amp_3))
extr_3 = Extrude(Base=flatten(offcrv), Direction=flatten(amp_2))
cap = CapHoles(Brep=extr)
cap_2 = CapHoles(Brep=extr_2)
cap_3 = CapHoles(Brep=extr_3)
move_11 = Move(Geometry=cap, Motion=expr("-x/2", amp_3))  # -> Geometry, Transform
move_12 = Move(Geometry=cap_2, Motion=expr("-x/2", amp_3))  # -> Geometry, Transform
move_13 = Move(Geometry=cap_3, Motion=expr("-x/2", amp_2))  # -> Geometry, Transform
sdiff = SolidDifference(BrepsA=graft(join.Breps), BrepsB=flatten([move_13.Geometry, pipe_3, pipe_4]))

deplane_3 = DeconstructPlane(Plane=merge_8)  # -> Origin, XAxis, YAxis, ZAxis
amp_4 = Amplitude(Vector=deplane_3.YAxis, Amplitude=50)  # -> flatten(Vector)
neg_3 = Negative(Value=amp_4)
merge_9 = Merge(Data1=graft(amp_4), Data2=graft(neg_3))  # -> simplify(Result)
extr_4 = Extrude(Base=graft(line_10), Direction=merge_9)
extr_5 = Extrude(Base=graft(line_11), Direction=merge_9)
join_2 = BrepJoin(Breps=extr_4)  # -> flatten(Breps), Closed
join_3 = BrepJoin(Breps=extr_5)  # -> flatten(Breps), Closed
merge_10 = Merge(Data1=graft(join_2.Breps), Data2=graft(join_3.Breps))
bbx = BrepBrep(BrepA=graft(move_12.Geometry), BrepB=merge_10)  # -> Curves, Points
flatten_2 = FlattenTree(Tree=merge_8, Path="{0}")
trim_2 = TrimTree(Tree=bbx.Curves, Depth=1)  # -> simplify(Tree)
graft_3 = GraftTree(Tree=flatten_2, IncludeEmptyLists=True, IncludeNullItems=True)  # -> simplify(Tree)
amp_5 = Amplitude(Vector=deplane_3.ZAxis, Amplitude=6)  # -> flatten(Vector)
offcrv_4 = OffsetCurve(Curve=trim_2, Plane=graft_3, Distance=-0.7, BothSides=0.5, Kinks=0, CapType=1)
trim_3 = TrimTree(Tree=offcrv_4, Depth=1)  # -> simplify(Tree)
neg_4 = Negative(Value=amp_5)
extr_6 = Extrude(Base=trim_3, Direction=graft(amp_5))  # -> graft(Extrusion)
extr_7 = Extrude(Base=trim_3, Direction=graft(neg_4))  # -> graft(Extrusion)
join_4 = BrepJoin(Breps=[extr_6, extr_7])  # -> flatten(Breps), Closed
cap_4 = CapHoles(Brep=join_4.Breps)

# ---- group: viz_3D MODEL / ctrl_3DPreview (continued)
entwine_9 = Entwine(Branch00=move_11.Geometry, Branch01=sdiff, Branch02=cap_4, FlattenInputs=True)
data_2 = Data(entwine_9)
brep = Brep(entwine_9)
filter_2 = StreamFilter(Gate=list_2, Stream0=data, Stream1=data_2)
previewmat = CustomPreviewMaterials(Geometry=filter_2, DiffuseColor=entwine_7, Transparency=number_slider_7)
previewmat_2 = CustomPreviewMaterials(Geometry=filter_2, DiffuseColor=entwine_8, Transparency=number_slider_7)
bake = BakeGeometry(Bake=Toggle(False), Geometry=brep, Attributes=createatts, DeleteOldBakes=False, PreserveTrees=False)

# ---- group: calc_Planes / ctrl_planerotation
py3_7 = Python3Script(
    plane=unflatten_2,
    x_rot=Slider(0, range=0..180),
    y_rot=Slider(0, range=0..180),
    z_rot=Slider(-90, range=-180..180),
    swap_xy=False)  # -> out, a; inputs plane: Plane, swap_xy: Boolean; same code as py3_5

# ---- group: calc_Planes (continued)
pln_5 = Plane(py3_7.a)
deplane_4 = DeconstructPlane(Plane=pln_5)  # -> Origin, XAxis, YAxis, ZAxis
amp_6 = Amplitude(Vector=deplane_4.ZAxis, Amplitude=50)
vdis_2 = VectorDisplay(Anchor=deplane_4.Origin, Vector=amp_6)

# ---- group: calc_Planes / ctrl_approachdistance
deplane_5 = DeconstructPlane(Plane=pln_5)  # -> Origin, XAxis, YAxis, ZAxis
amp_7 = Amplitude(Vector=deplane_5.ZAxis, Amplitude=Slider(250, range=-1000..1000))
move_14 = Move(Geometry=pln_5, Motion=expr("-x", amp_7))  # -> Geometry, Transform

# ---- group: calc_Planes
# Approach planes
pln_6 = Plane(move_14.Geometry)

# Pick Up Planes B
comaubase_3 = RemoteReceiver(comaubase)
xy_2 = XYPlane(Origin=comaubase_3)
move_15 = Move(Geometry=xy_2, Motion=Vector(1000, 0, 0))  # -> Geometry, Transform
arrlinear_2 = LinearArray(Geometry=move_15.Geometry, Direction=Vector(120, 0, 0), Count=2)  # -> Geometry, Transform

# ---- group: calc_Planes / ctrl_planerotation
py3_8 = Python3Script(
    plane=arrlinear_2.Geometry,
    x_rot=Slider(0, range=0..180),
    y_rot=Slider(0, range=0..180),
    z_rot=Slider(90, range=-180..180),
    swap_xy=False)  # -> out, a; inputs plane: Plane, swap_xy: Boolean; same code as py3_5

# ---- group: calc_Planes (continued)
flip_plane_2 = FlipPlane(Plane=py3_8.a)

# ---- group: calc_Planes / viz_
pln_7 = Plane(flip_plane_2)
deplane_6 = DeconstructPlane(Plane=pln_7)  # -> Origin, XAxis, YAxis, ZAxis
amp_8 = Amplitude(Vector=deplane_6.ZAxis, Amplitude=100)
vdis_3 = VectorDisplay(Anchor=deplane_6.Origin, Vector=amp_8)

# ---- group: out_Planes
pick_up_planes_a = RemoteSender(pln_4)
pick_up_planes_b = RemoteSender(pln_7)
approach_planes = RemoteSender(pln_6)
targetplanes = RemoteSender(pln_5)

# ---- group: calc_ (continued)
approach_planes_2 = RemoteReceiver(approach_planes)
dispatch_5 = Dispatch(List=approach_planes_2, DispatchPattern=task_allocation_7)  # -> ListA, ListB
pl_origin = PlaneOrigin(Base=dispatch_5.ListB, Origin=move_10.Geometry)
padjust = AdjustPlane(Plane=pl_origin, Normal=vec2pt_6.Vector)  # -> flatten(Plane)
guide_planes_b = RemoteSender(padjust)
deplane_7 = DeconstructPlane(Plane=guide_planes_b)  # -> Origin, XAxis, YAxis, ZAxis
amp_9 = Amplitude(Vector=deplane_7.ZAxis, Amplitude=100)
vdis_4 = VectorDisplay(Anchor=deplane_7.Origin, Vector=amp_9)

approach_planes_3 = RemoteReceiver(approach_planes)
dispatch_6 = Dispatch(List=approach_planes_3, DispatchPattern=task_allocation_6)  # -> ListA, ListB
pl_origin_2 = PlaneOrigin(Base=dispatch_6.ListA, Origin=pt_6)
padjust_2 = AdjustPlane(Plane=pl_origin_2, Normal=vec2pt_5.Vector)  # -> flatten(Plane)
guide_planes_1 = RemoteSender(padjust_2)
deplane_8 = DeconstructPlane(Plane=guide_planes_1)  # -> Origin, XAxis, YAxis, ZAxis
amp_10 = Amplitude(Vector=deplane_8.ZAxis, Amplitude=100)
vdis_5 = VectorDisplay(Anchor=deplane_8.Origin, Vector=amp_10)

# ---- group: calc_PlaneOrder
pick_up_planes_a_2 = RemoteReceiver(pick_up_planes_a)
pick_up_planes_b_2 = RemoteReceiver(pick_up_planes_b)
task_allocation_9 = RemoteReceiver(task_allocation)
panel_29 = Panel("Pause")
panel_30 = Panel("gripper = 0")
panel_31 = Panel("gripper = 1")
targetplanes_2 = RemoteReceiver(targetplanes)
panel_32 = Panel("waiting")
pln_8 = Plane(ur5homeplane)
pln_9 = Plane(comauhomeplane)
bool = Boolean(invert(task_allocation_9))
int = Integer(bool)
py3_9 = Python3Script(
    target_planes=targetplanes_2,
    task_allocation=int,
    approach_planes=pln_6,
    pick_up_planes_A=pick_up_planes_a_2,
    pick_up_planes_B=pick_up_planes_b_2,
    home_plane_A=pln_8,
    home_plane_B=pln_9,
    guide_planes_A=guide_planes_1,
    guide_planes_B=guide_planes_b)  # -> out, robotA_commands, robotB_commands, flatten(robotA_status), flatten(robotB_status), Planes_RobotA, Planes_RobotB; inputs target_planes: tree, task_allocation: tree of Int32, approach_planes: tree of Plane, pick_up_planes_A: list of Plane, pick_up_planes_B: list of Plane, guide_planes_A: list of Plane, guide_planes_B: list
# ---------- py3_9: Python ----------
import Rhino.Geometry as rg 
import Grasshopper
from Grasshopper.Kernel.Data import GH_Path

# Inputs:
# target_planes - DataTree of Planes in assembly order
# approach_planes - DataTree of Planes corresponding to target_planes (optional)
# task_allocation - DataTree of integers (0 or 1) indicating robot assignment (0 for A, 1 for B)
# pick_up_planes_A - List of Planes for Robot A's pick-up points
# pick_up_planes_B - List of Planes for Robot B's pick-up points
# pause_command - Command to pause the robot (optional)
# waiting_command - Command for waiting state (optional)
# home_plane_A - Plane for Robot A's home position (constant for each set)
# home_plane_B - Plane for Robot B's home position (constant for each set)
# guide_planes_A - List of optional guide planes for Robot A (constant for each set)
# guide_planes_B - List of optional guide planes for Robot B (constant for each set)

# Initialize output data trees
robotA_commands = Grasshopper.DataTree[object]()
robotB_commands = Grasshopper.DataTree[object]()
robotA_status = Grasshopper.DataTree[str]()
robotB_status = Grasshopper.DataTree[str]()

# Initialize planes data trees for the outputs (changed to DataTree[object])
planes_robotA = Grasshopper.DataTree[object]()
planes_robotB = Grasshopper.DataTree[object]()

# Initialize gripper states and last edge counters for both robots
gripper_state = {'A': 0, 'B': 0}
last_edge_counter = {'A': None, 'B': None}

# Initialize edge counter and pickup plane indices
edge_counter = 0
pickup_index = {'A': 0, 'B': 0}

# Get the total number of pickup planes for each robot
num_pickup_planes_A = len(pick_up_planes_A) if pick_up_planes_A else 1
num_pickup_planes_B = len(pick_up_planes_B) if pick_up_planes_B else 1

# Process each branch of the target_planes DataTree
for path in target_planes.Paths:
    # Extract planes, approaches, and allocations from the current branch
    planes = target_planes.Branch(path)
    approaches = approach_planes.Branch(path) if approach_planes and approach_planes.PathExists(path) else [None] * len(planes)
    allocations = task_allocation.Branch(path)
    num_edges = len(planes)
    
    # Prepare lists to store actions and planes per robot for the current branch
    actions_A = []
    actions_B = []
    planes_A = []
    planes_B = []

    # Process each edge (target plane) in the current branch
    for idx in range(num_edges):
        edge_counter += 1
        plane = planes[idx]
        approach = approaches[idx] if idx < len(approaches) else None
        robot = allocations[idx]
        assigned_robot = 'A' if robot == 0 else 'B'
        other_robot = 'B' if assigned_robot == 'A' else 'A'
        last_edge_counter[assigned_robot] = edge_counter

        # Determine pickup plane and home plane based on assigned robot
        if assigned_robot == 'A':
            pickup_plane = pick_up_planes_A[pickup_index['A'] % num_pickup_planes_A] if pick_up_planes_A else None
            home_plane = home_plane_A
            guide_plane = guide_planes_A[0] if guide_planes_A else None
            pickup_index['A'] += 1
        else:
            pickup_plane = pick_up_planes_B[pickup_index['B'] % num_pickup_planes_B] if pick_up_planes_B else None
            home_plane = home_plane_B
            guide_plane = guide_planes_B[0] if guide_planes_B else None
            pickup_index['B'] += 1

        # Define the sequence of steps for the assigned robot in the required order
        steps_robot = []
        planes_robot = []

        # Step: Move to home plane
        if home_plane:
            steps_robot.append(("Move to home plane", home_plane))
            planes_robot.append(home_plane)
        else:
            steps_robot.append(("No home plane provided", pause_command))
            planes_robot.append(None)

        # Step: Move to pick up
        if pickup_plane:
            steps_robot.append(("Move to pick up", pickup_plane))
            planes_robot.append(pickup_plane)
        else:
            steps_robot.append(("No pickup plane provided", pause_command))
            planes_robot.append(None)

        # Step: Return to home plane
        if home_plane:
            steps_robot.append(("Return to home plane", home_plane))
            planes_robot.append(home_plane)
        else:
            steps_robot.append(("No home plane provided", pause_command))
            planes_robot.append(None)

        # Step: Move to guide plane
        if guide_plane:
            steps_robot.append(("Move to guide plane", guide_plane))
            planes_robot.append(guide_plane)
        else:
            steps_robot.append(("No guide plane provided", pause_command))
            planes_robot.append(None)

        # Step: Move to approach plane (if exists)
        if approach:
            steps_robot.append((f"Move to approach plane {edge_counter}", approach))
            planes_robot.append(approach)

        # Step: Move to target plane
        steps_robot.append((f"Move to target {edge_counter}", plane))
        planes_robot.append(plane)

        # Step: Return to approach plane (if exists)
        if approach:
            steps_robot.append((f"Return to approach plane {edge_counter}", approach))
            planes_robot.append(approach)

        # Step: Return to guide plane
        if guide_plane:
            steps_robot.append(("Return to guide plane", guide_plane))
            planes_robot.append(guide_plane)
        else:
            steps_robot.append(("No guide plane provided", pause_command))
            planes_robot.append(None)

        # Step: Return to home plane
        if home_plane:
            steps_robot.append(("Return to home plane", home_plane))
            planes_robot.append(home_plane)
        else:
            steps_robot.append(("No home plane provided", pause_command))
            planes_robot.append(None)

        # Add steps to the corresponding robot's action and plane lists
        if assigned_robot == 'A':
            actions_A.extend(steps_robot)
            planes_A.extend(planes_robot)
        else:
            actions_B.extend(steps_robot)
            planes_B.extend(planes_robot)

        # Create synchronized waiting steps for the other robot
        waiting_status = f"Holding edge {last_edge_counter[other_robot]}" if gripper_state[other_robot] == 1 else "Waiting for other robot"
        waiting_steps = [(waiting_status, waiting_command)] * len(steps_robot)
        waiting_planes = [None] * len(steps_robot)

        if other_robot == 'A':
            actions_A.extend(waiting_steps)
            planes_A.extend(waiting_planes)
        else:
            actions_B.extend(waiting_steps)
            planes_B.extend(waiting_planes)

    # Synchronize actions and planes between robots and add them to the output data trees
    total_steps = max(len(actions_A), len(actions_B))
    for i in range(total_steps):
        sub_path = GH_Path(path).AppendElement(i)
        # Add Robot A actions, statuses, and planes
        if i < len(actions_A):
            status_A, command_A = actions_A[i]
            plane_A = planes_A[i]
        else:
            status_A, command_A = "Waiting for other robot", waiting_command
            plane_A = None
        robotA_status.Add(status_A, sub_path)
        robotA_commands.Add(command_A, sub_path)
        planes_robotA.Add(plane_A, sub_path)

        # Add Robot B actions, statuses, and planes
        if i < len(actions_B):
            status_B, command_B = actions_B[i]
            plane_B = planes_B[i]
        else:
            status_B, command_B = "Waiting for other robot", waiting_command
            plane_B = None
        robotB_status.Add(status_B, sub_path)
        robotB_commands.Add(command_B, sub_path)
        planes_robotB.Add(plane_B, sub_path)

# Outputs
RobotA_Command = robotA_commands
RobotB_Command = robotB_commands
RobotA_Status = robotA_status
RobotB_Status = robotB_status
Planes_RobotA = planes_robotA
Planes_RobotB = planes_robotB
# ---------- end py3_9 ----------
path_mapper = PathMapper(py3_9.robotA_commands, source=["{A;B;C}", "{A;B;C;D}"], target=["{A}", "{A}"])
path_mapper_2 = PathMapper(py3_9.robotB_commands, source=["{A;B;C}", "{A;B;C;D}"], target=["{A}", "{A}"])
status_a = RemoteSender(py3_9.robotA_status)
path_mapper_3 = PathMapper(py3_9.Planes_RobotA, source=["{A;B;C}", "{A;B;C;D}"], target=["{A}", "{A}"])
path_mapper_4 = PathMapper(py3_9.Planes_RobotB, source=["{A;B;C}", "{A;B;C;D}"], target=["{A}", "{A}"])
status_b = RemoteSender(py3_9.robotB_status)
null = NullItem(Item=path_mapper_2)  # -> NullFlags, InvalidFlags, Description
null_2 = NullItem(Item=path_mapper_4)  # -> NullFlags, InvalidFlags, Description
null_3 = NullItem(Item=path_mapper)  # -> NullFlags, InvalidFlags, Description
null_4 = NullItem(Item=path_mapper_3)  # -> NullFlags, InvalidFlags, Description
cull_3 = CullPattern(List=path_mapper, CullPattern=invert(null_3.NullFlags))
cull_4 = CullPattern(List=path_mapper_2, CullPattern=invert(null.NullFlags))
cull_5 = CullPattern(List=path_mapper_3, CullPattern=invert(null_4.NullFlags))  # -> flatten(List)
cull_6 = CullPattern(List=path_mapper_4, CullPattern=invert(null_2.NullFlags))  # -> flatten(List)
commands_a = RemoteSender(flatten(cull_3))
commands_b = RemoteSender(flatten(cull_4))

# ----
# approach pickup planes A
pick_up_planes_a_3 = RemoteReceiver(pick_up_planes_a)
deconstruct_plane = DeconstructPlane(Plane=pick_up_planes_a_3)  # -> Origin, XAxis, YAxis, ZAxis
amplitude = Amplitude(Vector=deconstruct_plane.ZAxis, Amplitude=Slider(60, range=0..100))
move_16 = Move(Geometry=pick_up_planes_a_3, Motion=expr("-x", amplitude))  # -> Geometry, Transform
approach_pickup_planes_a = RemoteSender(move_16.Geometry)

# ----
# approach pickup planes B
pick_up_planes_b_3 = RemoteReceiver(pick_up_planes_b)
deconstruct_plane_2 = DeconstructPlane(Plane=pick_up_planes_b_3)  # -> Origin, XAxis, YAxis, ZAxis
amplitude_2 = Amplitude(Vector=deconstruct_plane_2.ZAxis, Amplitude=Slider(60, range=0..100))
move_17 = Move(Geometry=pick_up_planes_b_3, Motion=expr("-x", amplitude_2))  # -> Geometry, Transform
approach_pickup_planes_b = RemoteSender(move_17.Geometry)

# ----
# ALTERNATE PYTHON SCRIPT VERSION
# FOR FUTURE EXPERIMENTATION WITH ROBOT SYNCHRONISATION
# Script for synchronized robots
approach_pickup_planes_a_2 = RemoteReceiver(approach_pickup_planes_a)
approach_pickup_planes_b_2 = RemoteReceiver(approach_pickup_planes_b)
pick_up_planes_a_4 = RemoteReceiver(pick_up_planes_a)
pick_up_planes_b_4 = RemoteReceiver(pick_up_planes_b)
task_allocation_10 = RemoteReceiver(task_allocation)
targetplanes_3 = RemoteReceiver(targetplanes)
pln_10 = Plane(ur5homeplane)
pln_11 = Plane(comauhomeplane)
bool_2 = Boolean(invert(task_allocation_10))
int_2 = Integer(bool_2)
python_3_script = Python3Script(
    target_planes=targetplanes_3,
    task_allocation=int_2,
    pick_up_planes_A=pick_up_planes_a_4,
    pick_up_planes_B=pick_up_planes_b_4,
    pickup_approach_planes_A=approach_pickup_planes_a_2,
    pickup_approach_planes_B=approach_pickup_planes_b_2,
    home_plane_A=pln_10,
    home_plane_B=pln_11,
    waiting_command="waiting",
    pause_command="pause",
    gripper_open_command="gripper = 0",
    gripper_close_command="gripper = 1")  # -> out, robotA_commands, robotB_commands, robotA_status, robotB_status; inputs target_planes: tree, task_allocation: tree of Int32, approach_planes: tree of Plane, pick_up_planes_A: list of Plane, pick_up_planes_B: list of Plane
# ---------- python_3_script: Python ----------
import Rhino.Geometry as rg
import Grasshopper
from Grasshopper.Kernel.Data import GH_Path

# Inputs:
# target_planes - DataTree of Planes in assembly order
# approach_planes - DataTree of Planes corresponding to target_planes (optional)
# task_allocation - DataTree of integers (0 or 1) indicating robot assignment (0 for A, 1 for B)
# pick_up_planes_A - List of Planes for Robot A's pick-up points
# pick_up_planes_B - List of Planes for Robot B's pick-up points
# pickup_approach_planes_A - List of Planes for Robot A's pickup approach points (optional)
# pickup_approach_planes_B - List of Planes for Robot B's pickup approach points (optional)
# pause_command - Command to pause the robot (optional)
# waiting_command - Command for waiting state (optional)
# home_plane_A - Plane for Robot A's home position (optional)
# home_plane_B - Plane for Robot B's home position (optional)

# Ensure inputs are set to the correct access and type hints in the Grasshopper Python component

# Initialize output data trees
robotA_commands = Grasshopper.DataTree[object]()
robotB_commands = Grasshopper.DataTree[object]()
robotA_status = Grasshopper.DataTree[str]()
robotB_status = Grasshopper.DataTree[str]()

# Initialize gripper states and last edge counters
gripper_state = {'A': 0, 'B': 0}
last_edge_counter = {'A': None, 'B': None}

# Initialize edge counter
edge_counter = 0

# Initialize pickup plane indices for each robot
pickup_index = {'A': 0, 'B': 0}

# Get the total number of pickup planes for each robot
num_pickup_planes_A = len(pick_up_planes_A) if pick_up_planes_A else 1
num_pickup_planes_B = len(pick_up_planes_B) if pick_up_planes_B else 1

# Get the total number of pickup approach planes for each robot
num_pickup_approach_planes_A = len(pickup_approach_planes_A) if pickup_approach_planes_A else 0
num_pickup_approach_planes_B = len(pickup_approach_planes_B) if pickup_approach_planes_B else 0

# Process each branch
for path in target_planes.Paths:
    planes = target_planes.Branch(path)
    approaches = approach_planes.Branch(path) if approach_planes and approach_planes.PathExists(path) else [None]*len(planes)
    allocations = task_allocation.Branch(path)
    num_edges = len(planes)
    
    # Check if the branch is {*;0}
    if path.Indices[-1] == 0:
        # Special handling for branch {*;0}
        
        # Collect indices of edges placed by each robot
        indices_by_robot = {'A': [], 'B': []}
        for idx, alloc in enumerate(allocations):
            robot_name = 'A' if alloc == 0 else 'B'
            indices_by_robot[robot_name].append(idx)
        
        # Prepare variables to keep track of steps
        max_steps = 0  # To synchronize steps between robots
        # Lists to store actions per robot
        actions_A = []
        actions_B = []
        
        # Process the first two edges
        for idx in range(2):
            edge_counter += 1
            plane = planes[idx]
            approach = approaches[idx] if idx < len(approaches) else None
            robot = allocations[idx]
            assigned_robot = 'A' if robot == 0 else 'B'
            other_robot = 'B' if assigned_robot == 'A' else 'A'
            last_edge_counter[assigned_robot] = edge_counter
            
            # Select the pickup plane for the assigned robot
            if assigned_robot == 'A':
                pickup_plane_list = pick_up_planes_A
                pickup_approach_list = pickup_approach_planes_A
                num_pickup_planes = num_pickup_planes_A
                num_pickup_approach_planes = num_pickup_approach_planes_A
                if num_pickup_planes > 0:
                    pickup_plane = pickup_plane_list[pickup_index['A'] % num_pickup_planes]
                else:
                    pickup_plane = None  # Handle empty list case
                if num_pickup_approach_planes > 0:
                    pickup_approach_plane = pickup_approach_list[pickup_index['A'] % num_pickup_approach_planes]
                else:
                    pickup_approach_plane = None
                pickup_index['A'] += 1
            else:
                pickup_plane_list = pick_up_planes_B
                pickup_approach_list = pickup_approach_planes_B
                num_pickup_planes = num_pickup_planes_B
                num_pickup_approach_planes = num_pickup_approach_planes_B
                if num_pickup_planes > 0:
                    pickup_plane = pickup_plane_list[pickup_index['B'] % num_pickup_planes]
                else:
                    pickup_plane = None  # Handle empty list case
                if num_pickup_approach_planes > 0:
                    pickup_approach_plane = pickup_approach_list[pickup_index['B'] % num_pickup_approach_planes]
                else:
                    pickup_approach_plane = None
                pickup_index['B'] += 1
            
            # Steps for the assigned robot
            steps_robot = []
            # Step 1: Move to pickup approach plane (if provided)
            if pickup_approach_plane is not None:
                steps_robot.append(("Move to pickup approach", pickup_approach_plane))
            # Step 2: Move to pick up
            if pickup_plane is not None:
                steps_robot.append(("Move to pick up", pickup_plane))
            else:
                steps_robot.append(("Move to pick up", "No pickup plane provided"))
            # Step 3: Close gripper
            steps_robot.append(("Close gripper", gripper_close_command))
            gripper_state[assigned_robot] = 1
            # Step 4: Move to approach plane (if provided)
            if approach is not None:
                steps_robot.append((f"Move to approach plane {edge_counter}", approach))
            # Step 5: Move to target plane
            steps_robot.append((f"Move to target {edge_counter}", plane))
            # Step 6 onwards: Holding edge
            steps_robot.append((f"Holding edge {edge_counter}", waiting_command))
            # Add steps to robot's action list
            if assigned_robot == 'A':
                actions_A.extend(steps_robot)
            else:
                actions_B.extend(steps_robot)
            
            # For the other robot, add waiting steps to synchronize
            num_steps = len(steps_robot)
            waiting_status = f"Holding edge {last_edge_counter[other_robot]}" if gripper_state[other_robot] == 1 else "Waiting for other robot"
            waiting_steps = [(waiting_status, waiting_command)] * num_steps
            if other_robot == 'A':
                actions_A.extend(waiting_steps)
            else:
                actions_B.extend(waiting_steps)
            
            max_steps = max(max_steps, len(actions_A), len(actions_B))
        
        # After first two edges, both robots pause for connection
        if pause_command is not None:
            pause_step = ("Pause for connection", pause_command)
            actions_A.append(pause_step)
            actions_B.append(pause_step)
            max_steps += 1
        
        # Process the third edge if it exists
        if num_edges > 2:
            idx = 2  # Index of the third edge
            edge_counter += 1
            plane = planes[idx]
            approach = approaches[idx] if idx < len(approaches) else None
            robot = allocations[idx]
            assigned_robot = 'A' if robot == 0 else 'B'
            other_robot = 'B' if assigned_robot == 'A' else 'A'
            last_edge_counter[assigned_robot] = edge_counter
            
            # Select the pickup plane for the assigned robot
            if assigned_robot == 'A':
                pickup_plane_list = pick_up_planes_A
                pickup_approach_list = pickup_approach_planes_A
                num_pickup_planes = num_pickup_planes_A
                num_pickup_approach_planes = num_pickup_approach_planes_A
                if num_pickup_planes > 0:
                    pickup_plane = pickup_plane_list[pickup_index['A'] % num_pickup_planes]
                else:
                    pickup_plane = None
                if num_pickup_approach_planes > 0:
                    pickup_approach_plane = pickup_approach_list[pickup_index['A'] % num_pickup_approach_planes]
                else:
                    pickup_approach_plane = None
                pickup_index['A'] += 1
            else:
                pickup_plane_list = pick_up_planes_B
                pickup_approach_list = pickup_approach_planes_B
                num_pickup_planes = num_pickup_planes_B
                num_pickup_approach_planes = num_pickup_approach_planes_B
                if num_pickup_planes > 0:
                    pickup_plane = pickup_plane_list[pickup_index['B'] % num_pickup_planes]
                else:
                    pickup_plane = None
                if num_pickup_approach_planes > 0:
                    pickup_approach_plane = pickup_approach_list[pickup_index['B'] % num_pickup_approach_planes]
                else:
                    pickup_approach_plane = None
                pickup_index['B'] += 1
            
            # Steps for the assigned robot
            steps_robot = []
            # Step 1: Move to pickup approach plane (if provided)
            if pickup_approach_plane is not None:
                steps_robot.append(("Move to pickup approach", pickup_approach_plane))
            # Step 2: Move to pick up
            if pickup_plane is not None:
                steps_robot.append(("Move to pick up", pickup_plane))
            else:
                steps_robot.append(("Move to pick up", "No pickup plane provided"))
            # Step 3: Close gripper
            steps_robot.append(("Close gripper", gripper_close_command))
            gripper_state[assigned_robot] = 1
            # Step 4: Move to approach plane (if provided)
            if approach is not None:
                steps_robot.append((f"Move to approach plane {edge_counter}", approach))
            # Step 5: Move to target plane
            steps_robot.append((f"Move to target {edge_counter}", plane))
            # Step 6: Pause for connection
            if pause_command is not None:
                steps_robot.append(("Pause for connection", pause_command))
            # Step 7: Open gripper
            steps_robot.append(("Open gripper", gripper_open_command))
            gripper_state[assigned_robot] = 0
            # Step 8: Move back to approach plane (if provided)
            if approach is not None:
                steps_robot.append((f"Move to approach plane {edge_counter}", approach))
            # Step 9: Move to home plane (if provided)
            home_plane = home_plane_A if assigned_robot == 'A' else home_plane_B
            if home_plane is not None:
                steps_robot.append(("Moving to home plane", home_plane))
            # Add steps to robot's action list
            if assigned_robot == 'A':
                actions_A.extend(steps_robot)
            else:
                actions_B.extend(steps_robot)
            
            # For the other robot, continue holding edge until pause for connection
            other_steps = []
            for i, (step, cmd) in enumerate(steps_robot):
                if step == "Pause for connection" and pause_command is not None:
                    other_steps.append(("Pause for connection", pause_command))
                else:
                    if gripper_state[other_robot] == 1:
                        other_steps.append((f"Holding edge {last_edge_counter[other_robot]}", waiting_command))
                    else:
                        other_steps.append(("Waiting for other robot", waiting_command))
            if other_robot == 'A':
                actions_A.extend(other_steps)
            else:
                actions_B.extend(other_steps)
            
            max_steps = max(max_steps, len(actions_A), len(actions_B))
        
        # After the third edge and pause, both robots can open grippers and move home
        # Open gripper for the robot that was holding edge
        for robot in ['A', 'B']:
            if gripper_state[robot] == 1:
                gripper_state[robot] = 0
                steps = []
                # Open gripper
                steps.append(("Open gripper", gripper_open_command))
                # Move back to approach plane (if provided)
                if indices_by_robot[robot]:
                    last_edge_idx = indices_by_robot[robot][-1]
                    approach = approaches[last_edge_idx] if last_edge_idx < len(approaches) else None
                    if approach is not None:
                        steps.append((f"Move to approach plane {last_edge_counter[robot]}", approach))
                else:
                    approach = None
                # Move to home plane (if provided)
                home_plane = home_plane_A if robot == 'A' else home_plane_B
                if home_plane is not None:
                    steps.append(("Moving to home plane", home_plane))
                # Add steps to robot's action list
                if robot == 'A':
                    actions_A.extend(steps)
                else:
                    actions_B.extend(steps)
                max_steps = max(max_steps, len(actions_A), len(actions_B))
        
        # Synchronize steps between robots
        total_steps = max(len(actions_A), len(actions_B))
        for i in range(total_steps):
            sub_path = GH_Path(path)
            sub_path = sub_path.AppendElement(i)
            # Robot A actions
            if i < len(actions_A):
                status_A, command_A = actions_A[i]
            else:
                status_A = "Waiting for other robot"
                command_A = waiting_command
            robotA_status.Add(status_A, sub_path)
            robotA_commands.Add(command_A, sub_path)
            # Robot B actions
            if i < len(actions_B):
                status_B, command_B = actions_B[i]
            else:
                status_B = "Waiting for other robot"
                command_B = waiting_command
            robotB_status.Add(status_B, sub_path)
            robotB_commands.Add(command_B, sub_path)
    else:
        # Handle other branches as before
        for idx in range(num_edges):
            plane = planes[idx]
            approach = approaches[idx] if idx < len(approaches) else None
            robot = allocations[idx]
            assigned_robot = 'A' if robot == 0 else 'B'
            other_robot = 'B' if assigned_robot == 'A' else 'A'
            edge_counter += 1
            last_edge_counter[assigned_robot] = edge_counter
            
            # Select the pickup plane for the assigned robot
            if assigned_robot == 'A':
                pickup_plane_list = pick_up_planes_A
                pickup_approach_list = pickup_approach_planes_A
                num_pickup_planes = num_pickup_planes_A
                num_pickup_approach_planes = num_pickup_approach_planes_A
                if num_pickup_planes > 0:
                    pickup_plane = pickup_plane_list[pickup_index['A'] % num_pickup_planes]
                else:
                    pickup_plane = None
                if num_pickup_approach_planes > 0:
                    pickup_approach_plane = pickup_approach_list[pickup_index['A'] % num_pickup_approach_planes]
                else:
                    pickup_approach_plane = None
                pickup_index['A'] += 1
            else:
                pickup_plane_list = pick_up_planes_B
                pickup_approach_list = pickup_approach_planes_B
                num_pickup_planes = num_pickup_planes_B
                num_pickup_approach_planes = num_pickup_approach_planes_B
                if num_pickup_planes > 0:
                    pickup_plane = pickup_plane_list[pickup_index['B'] % num_pickup_planes]
                else:
                    pickup_plane = None
                if num_pickup_approach_planes > 0:
                    pickup_approach_plane = pickup_approach_list[pickup_index['B'] % num_pickup_approach_planes]
                else:
                    pickup_approach_plane = None
                pickup_index['B'] += 1
            
            # Steps for the assigned robot
            steps_robot = []
            # Step 1: Move to pickup approach plane (if provided)
            if pickup_approach_plane is not None:
                steps_robot.append(("Move to pickup approach", pickup_approach_plane))
            # Step 2: Move to pick up
            if pickup_plane is not None:
                steps_robot.append(("Move to pick up", pickup_plane))
            else:
                steps_robot.append(("Move to pick up", "No pickup plane provided"))
            # Step 3: Close gripper
            steps_robot.append(("Close gripper", gripper_close_command))
            gripper_state[assigned_robot] = 1
            # Step 4: Move to approach plane (if provided)
            if approach is not None:
                steps_robot.append((f"Move to approach plane {edge_counter}", approach))
            # Step 5: Move to target plane
            steps_robot.append((f"Move to target {edge_counter}", plane))
            # Step 6: Pause for connection (if provided)
            if pause_command is not None:
                steps_robot.append(("Pause for connection", pause_command))
            # Step 7: Open gripper
            steps_robot.append(("Open gripper", gripper_open_command))
            gripper_state[assigned_robot] = 0
            # Step 8: Move back to approach plane (if provided)
            if approach is not None:
                steps_robot.append((f"Move to approach plane {edge_counter}", approach))
            # Step 9: Move to home plane (if provided)
            home_plane = home_plane_A if assigned_robot == 'A' else home_plane_B
            if home_plane is not None:
                steps_robot.append(("Moving to home plane", home_plane))
            
            # Steps for the other robot
            other_steps = []
            for step, cmd in steps_robot:
                if step == "Pause for connection" and pause_command is not None:
                    other_steps.append(("Pause for connection", pause_command))
                else:
                    if gripper_state[other_robot] == 1:
                        other_steps.append((f"Holding edge {last_edge_counter[other_robot]}", waiting_command))
                    else:
                        other_steps.append(("Waiting for other robot", waiting_command))
            
            # Add steps to data trees
            for i in range(len(steps_robot)):
                sub_path = GH_Path(path)
                sub_path = sub_path.AppendElement(idx)
                sub_path = sub_path.AppendElement(i)
                # Assigned robot
                if assigned_robot == 'A':
                    robotA_status.Add(steps_robot[i][0], sub_path)
                    robotA_commands.Add(steps_robot[i][1], sub_path)
                    robotB_status.Add(other_steps[i][0], sub_path)
                    robotB_commands.Add(other_steps[i][1], sub_path)
                else:
                    robotB_status.Add(steps_robot[i][0], sub_path)
                    robotB_commands.Add(steps_robot[i][1], sub_path)
                    robotA_status.Add(other_steps[i][0], sub_path)
                    robotA_commands.Add(other_steps[i][1], sub_path)

# Outputs:
RobotA_Command = robotA_commands
RobotB_Command = robotB_commands
RobotA_Status = robotA_status
RobotB_Status = robotB_status
# ---------- end python_3_script ----------
path_mapper_5 = PathMapper(python_3_script.robotA_commands, source=["{A;B;C}", "{A;B;C;D}"], target=["{A}", "{A}"])
path_mapper_6 = PathMapper(python_3_script.robotB_commands, source=["{A;B;C}", "{A;B;C;D}"], target=["{A}", "{A}"])
path_mapper_7 = PathMapper(python_3_script.robotA_status, source=["{A;B;C}", "{A;B;C;D}"], target=["{A}", "{A}"])
path_mapper_8 = PathMapper(python_3_script.robotB_status, source=["{A;B;C}", "{A;B;C;D}"], target=["{A}", "{A}"])
null_item = NullItem(Item=path_mapper_5)  # -> NullFlags, InvalidFlags, Description
null_item_2 = NullItem(Item=path_mapper_6)  # -> NullFlags, InvalidFlags, Description
cull_pattern = CullPattern(List=path_mapper_5, CullPattern=invert(null_item.NullFlags))
cull_pattern_2 = CullPattern(List=path_mapper_6, CullPattern=invert(null_item_2.NullFlags))

panel_33 = Panel(cull_pattern)
panel_34 = Panel(cull_pattern_2)
panel_35 = Panel(path_mapper_7)
panel_36 = Panel(path_mapper_8)
assembly_order_8 = RemoteReceiver(assembly_order)
task_allocation_11 = RemoteReceiver(task_allocation)
panel_37 = Panel(task_allocation_11)
panel_38 = Panel(assembly_order_8)

panel_39 = Panel(commands_a)
panel_40 = Panel(commands_b)
status_a_2 = RemoteReceiver(status_a)
status_b_2 = RemoteReceiver(status_b)
panel_41 = Panel(status_a_2)
panel_42 = Panel(status_b_2)
assembly_order_9 = RemoteReceiver(assembly_order)
task_allocation_12 = RemoteReceiver(task_allocation)
panel_43 = Panel(task_allocation_12)
panel_44 = Panel(assembly_order_9)

pln_12 = Plane(commands_a)
ur5planes = RemoteSender(flatten(pln_12))
py3_10 = Python3Script(Planes=ur5planes)  # -> out, FilteredPlanes; inputs Planes: list of Plane, IndicesToRemove: list of Int32
# ---------- py3_10: Python ----------
"""
Inputs:
    Planes (list of Rhino.Geometry.Plane): The list of Rhino planes.
    IndicesToRemove (list of int): The list of integers specifying the indices to be removed.

Output:
    FilteredPlanes (list of Rhino.Geometry.Plane): The filtered list of planes.
"""

# Check if the inputs are valid
if Planes and IndicesToRemove:
    # Convert indices list to a set for faster membership checking
    indices_to_remove_set = set(IndicesToRemove)
    
    # Create a new list of planes, excluding those at specified indices
    FilteredPlanes = [plane for i, plane in enumerate(Planes) if i not in indices_to_remove_set]
else:
    # If inputs are invalid or empty, output an empty list
    FilteredPlanes = []
# ---------- end py3_10 ----------
panel_45 = Panel(py3_10.FilteredPlanes)

comauplanes = RemoteSender(flatten(commands_b))
py3_11 = Python3Script(Planes=comauplanes)  # -> out, FilteredPlanes; inputs Planes: list of Plane, IndicesToRemove: list of Int32; same code as py3_10
panel_46 = Panel(py3_11.FilteredPlanes)

# ---- group: other_RobotKinematics / viz_RobotBase
ur5base_5 = RemoteReceiver(ur5base)
comaubase_4 = RemoteReceiver(comaubase)
move_18 = Move(Geometry=ur5base_5, Motion=Vector(0, 0, -912))  # -> Geometry, Transform
dpipeline_7 = DynamicGeometryPipeline(
    LayerFilter="5.Floor",
    TypeFilter="Surface",
    NameFilter="*",
    GroupByLayer=False,
    GroupByType=False,
    IncludeHidden=True,
    IncludeLocked=True,
    enableFullPath=True,
    listenToAttributes=True)
box = CenterBox(Base=comaubase_4, X=300, Y=300, Z=30)
sph_2 = Sphere(Base=comaubase_4, Radius=100)
previewmat_3 = CustomPreviewMaterials(
    Geometry=[box, sph_2],
    DiffuseColor=[ColourSwatch(SwatchColor=RGB(143, 143, 143)), ColourSwatch(SwatchColor=RGB(171, 72, 72))],
    Transparency=Slider(0.22, range=0..1))
dist_3 = Distance(PointA=move_18.Geometry, PointB=move_18.Transform)
rotate_plane_by_axis_7 = RotatePlaneByAxis(Plane=comaubase_4, Axis="x", Angle=90)
move_19 = Move(Geometry=rotate_plane_by_axis_7, Motion=Vector(0, 0, 200))  # -> Geometry, Transform
rotate_plane_by_axis_8 = RotatePlaneByAxis(Plane=ur5base_5, Axis="x", Angle=90)
move_20 = Move(Geometry=rotate_plane_by_axis_8, Motion=Vector(0, 0, 0))  # -> Geometry, Transform
tag_4 = TextTag3D(Location=move_19.Geometry, Text="COMAU NJ 60-2.2", Size=80, Colour=RGB(0, 0, 0), Justification=8)
tag_5 = TextTag3D(Location=move_20.Geometry, Text="UR5", Size=80, Colour=RGB(0, 0, 0), Justification=8)

# ----
project = ProjectPoint(Point=comaubase_4, Direction=Vector(0, 0, -1), Geometry=dpipeline_7)  # -> Point, Index

# ---- group: other_RobotKinematics / viz_RobotBase (continued)
ln = Line(StartPoint=move_18.Geometry, EndPoint=project.Point)
linear_dimension = LinearDimension(BaseLine=ln, PointA=move_18.Geometry, PointB=project.Point)  # -> LinearDimension, BaseLine, PointA, PointB
move_21 = Move(Geometry=linear_dimension.LinearDimension, Motion=Vector(-1000, 0, 0))  # -> Geometry, Transform
robotbasedistance = Data(move_21.Geometry)

# ---- group: other_RobotKinematics / viz_RobotJoints&TCP
item_10 = ListItem(List=[py3.RobotPosition, ur5_setup.RobotPosition], Index=0, Wrap=True)  # -> Item, Item1
relay = Relay([item_10.Item, item_10.Item1])
rotate_plane_by_axis_9 = RotatePlaneByAxis(Plane=reverse(relay), Axis="x", Angle=90)
sph_3 = Sphere(Base=ur5_setup.JointPoints, Radius=Slider(20, range=0..100))
data_3 = Data(sph_3)
panel_47 = Panel("""J0
J1
J2
J3
J4
J5""")
area = Area(Geometry=data_3)  # -> Area, Centroid
rotate_plane_by_axis_10 = RotatePlaneByAxis(Plane=area.Centroid, Axis="x", Angle=90)
# Its really useful to have this part run perpetually with
# a big interval, cause then you can see where the robots
# are facing, and you can correct misalignments of the
# transformation matrixes (directions of xyz vectors).
swatch_4 = ColourSwatch(SwatchColor=RGB(34, 223, 240))
panel_48 = Panel("""UR
CM""")
tag_6 = TextTag3D(Location=rotate_plane_by_axis_10, Text=panel_47, Size=20, Colour=ColourSwatch(SwatchColor=RGB(0, 0, 0)), Justification=5)
previewmat_4 = CustomPreviewMaterials(Geometry=sph_3, DiffuseColor=swatch_4, Transparency=Slider(0.39, range=0..1))
item_11 = ListItem(List=[py3.RobotPosition, ur5_setup.RobotPosition], Index=0, Wrap=True)  # -> Item, Item1
pt_7 = Point([item_11.Item, item_11.Item1])
sph_4 = Sphere(Base=pt_7, Radius=Slider(20, range=0..100))
preview = CustomPreview(Geometry=sph_4, Material=ColourSwatch(SwatchColor=RGB(0, 0, 0)))

# ----
rotate_plane_by_axis_11 = RotatePlaneByAxis(Plane=rotate_plane_by_axis_9, Axis="y", Angle=180)

# ---- group: other_RobotKinematics / viz_RobotJoints&TCP (continued)
move_22 = Move(Geometry=rotate_plane_by_axis_11, Motion=Vector(0, 0, 50))  # -> Geometry, Transform
tag_7 = TextTag3D(Location=move_22.Geometry, Text=graft(panel_48), Size=70, Justification=8)

# ---- group: ctrl_ProgramRobotA
py3_12 = Python3Script(Planes=flatten(py3_10.FilteredPlanes), BranchSize="9")  # -> out, BranchedPlanes; inputs Planes: list of Plane, BranchSize: Int32
# ---------- py3_12: Python ----------
import Rhino
import Grasshopper as gh
from Grasshopper import DataTree
from Grasshopper.Kernel.Data import GH_Path

"""
Inputs:
    Planes (list of Rhino.Geometry.Plane): The list of Rhino planes.
    BranchSize (int): The number of planes per branch.

Output:
    BranchedPlanes (DataTree[object]): The resulting tree of branches with planes.
"""

# Create an empty DataTree to store branches of planes
BranchedPlanes = DataTree[object]()

# Check if the inputs are valid
if Planes and BranchSize > 0:
    # Iterate and create branches
    for i in range(0, len(Planes), BranchSize):
        # Create a path for each branch using the index divided by BranchSize
        path = GH_Path(i // BranchSize)
        # Add planes to the tree under this path
        for j in range(BranchSize):
            index = i + j
            if index < len(Planes):
                BranchedPlanes.Add(Planes[index], path)
# ---------- end py3_12 ----------
bang_2 = ExplodeTree(Data=py3_12.BranchedPlanes)  # -> Branch0, flatten(Branch1), flatten(Branch2), flatten(Branch3), flatten(Branch4), flatten(Branch5), flatten(Branch6)
robotnamea_4 = RemoteReceiver(robotnamea)
element1 = RemoteSender(bang_2.Branch0)
element3 = RemoteSender(bang_2.Branch2)
element4 = RemoteSender(bang_2.Branch3)
element5 = RemoteSender(bang_2.Branch4)
element6 = RemoteSender(bang_2.Branch5)
element2 = RemoteSender(bang_2.Branch1)
panel_49 = Panel("""1
3""")
panel_50 = Panel("""80.00
10.00""")

# ----
ur5planes_2 = Data(flatten(py3_12.BranchedPlanes))
element7 = RemoteSender(bang_2.Branch6)

# ---- group: ctrl_ProgramRobotA (continued)
py3_13 = Python3Script(
    RobotName=robotnamea_4,
    UpdateRoboDK=Toggle(False),
    PlanesList=ur5planes_2,
    SetSpeedOrder=panel_49,
    SetSpeedValue=panel_50,
    StopOrder="6")  # -> out, SuccessMessage, TargetPoses, Program, TCPOrientations, PlaneExtra; inputs PlanesList: list of Plane, SetSpeedOrder: list of Int32, SetSpeedValue: list of Double, StopOrder: list of Int32
# ---------- py3_13: Python ----------
# Import necessary modules
import robolink as rl          # RoboDK API for communication with RoboDK software
import robodk as rdk           # RoboDK modeling and simulation library
import robodk.robodialogs as dialogs  # RoboDK module for dialog boxes
import Rhino.Geometry as rg    # Rhino.Geometry for geometric types and operations
import math                    # Math module for mathematical functions

# -------------------- Configuration Parameters --------------------
# Define the length of a cycle, i.e., the number of planes per cycle
cycle_length = 9  # You can modify this value as needed

# Global variables for robot motion parameters
speed_ms = 0.3          # Default speed in meters per second
accel_mss = 3.0         # Default acceleration in meters per second squared
blend_radius_m = 0.001  # Default blend radius in meters (for smooth motion between points)

# Initialize variables to store results and outputs
SuccessMessage = ""                   # String to accumulate success and error messages
TargetPoses = []                      # List to store target poses
Program = ""                          # Name of the RoboDK program created
TCPOrientations = []                  # List to store TCP orientations for each plane
TargetPointCoordinates = []           # List to store coordinates of target points
PlaneExtra = []                       # List to store planes that could not be reached

def plane_to_pose(plane):
    """
    Converts a Rhino plane object to a RoboDK pose matrix.

    Parameters:
    plane (rg.Plane): The Rhino plane to convert.

    Returns:
    rdk.Mat: A 4x4 transformation matrix representing the pose in RoboDK.
    """
    # Create a RoboDK matrix using the plane's axes and origin
    pose = rdk.Mat([
        [plane.XAxis.X, plane.YAxis.X, plane.ZAxis.X, plane.OriginX],
        [plane.XAxis.Y, plane.YAxis.Y, plane.ZAxis.Y, plane.OriginY],
        [plane.XAxis.Z, plane.YAxis.Z, plane.ZAxis.Z, plane.OriginZ],
        [0, 0, 0, 1]
    ])
    return pose

def format_tcp_orientation(plane, milestone):
    """
    Formats the TCP (Tool Center Point) orientation for logging purposes.

    Parameters:
    plane (rg.Plane): The plane representing the TCP orientation.
    milestone (str): A string indicating the current milestone or step.

    Returns:
    str: A formatted string with the TCP orientation.
    """
    x_axis = plane.XAxis
    y_axis = plane.YAxis
    z_axis = plane.ZAxis
    return f"TCP orientation at {milestone}:\n  X-axis: {x_axis}\n  Y-axis: {y_axis}\n  Z-axis: {z_axis}"

def format_target_coordinates(plane, milestone):
    """
    Formats the target point coordinates for logging purposes.

    Parameters:
    plane (rg.Plane): The plane representing the target point.
    milestone (str): A string indicating the current milestone or step.

    Returns:
    str: A formatted string with the target coordinates.
    """
    return f"{plane.OriginX}, {plane.OriginY}, {plane.OriginZ}"

# -------------------- Input Parameters --------------------
# Define the input parameters required for the script.
# Replace the following example inputs with your actual data before running the script.

# Example Inputs (Uncomment and replace with actual values)
# RobotName = "YourRobotName"  # Name of the robot in RoboDK
# PlanesList = [rg.Plane(...) for _ in range(63)]  # List of Rhino planes representing target positions
# UpdateRoboDK = True          # Boolean flag to update the RoboDK program
# StopOrder = [1, 3]           # List of step positions within the cycle where the program should pause (0-based index)
# SetSpeedOrder = [1, 3]       # List of step positions within the cycle where speed changes occur
# SetSpeedValue = [0.5, 0.7]   # Corresponding list of speed values in meters per second for the speed changes

# -------------------- Input Validation --------------------
# Function to validate that all necessary inputs are provided and correct

def validate_inputs():
    """
    Validates the input parameters required for the script to run.

    Returns:
    bool: True if all inputs are valid, False otherwise.
    """
    global SuccessMessage
    # List of required variables
    required_vars = ['RobotName', 'PlanesList', 'UpdateRoboDK']
    for var in required_vars:
        if var not in globals() or not globals()[var]:
            SuccessMessage = f"Error: {var} is required."
            return False
    
    # Validate that PlanesList is a non-empty list of Rhino Plane objects
    if not isinstance(PlanesList, list) or not PlanesList:
        SuccessMessage = "Error: PlanesList must be a non-empty list of Rhino Plane objects."
        return False
    if any(not isinstance(plane, rg.Plane) for plane in PlanesList):
        SuccessMessage = "Error: All elements in PlanesList must be Rhino Plane objects."
        return False
    
    # Validate StopOrder if it is provided
    if 'StopOrder' in globals() and StopOrder is not None:
        if not isinstance(StopOrder, list) or not all(isinstance(so, int) and 0 <= so < cycle_length for so in StopOrder):
            SuccessMessage = f"Error: StopOrder must be a list of non-negative integers within the cycle index range (0 to {cycle_length -1})."
            return False
    
    # Validate SetSpeedOrder and SetSpeedValue if they are provided
    if 'SetSpeedOrder' in globals() and SetSpeedOrder is not None:
        if not isinstance(SetSpeedOrder, list) or not all(isinstance(sso, int) and 0 <= sso < cycle_length for sso in SetSpeedOrder):
            SuccessMessage = f"Error: SetSpeedOrder must be a list of non-negative integers within the cycle index range (0 to {cycle_length -1})."
            return False
        if 'SetSpeedValue' not in globals() or not isinstance(SetSpeedValue, list) or not all(isinstance(sv, (int, float)) for sv in SetSpeedValue):
            SuccessMessage = "Error: SetSpeedValue must be a list of numerical values."
            return False
        if len(SetSpeedValue) < len(SetSpeedOrder):
            SuccessMessage = "Error: SetSpeedValue must have at least as many elements as SetSpeedOrder."
            return False
    
    return True

# -------------------- Main Execution --------------------
# Proceed only if the input validation passes
if validate_inputs():
    # Initialize a connection to RoboDK
    RDK = rl.Robolink()
    SuccessMessage = "Connected to RoboDK."
    
    # Retrieve the robot item from RoboDK by its name
    robot = RDK.Item(RobotName, rl.ITEM_TYPE_ROBOT)
    # Check if the robot item is valid
    if not robot.Valid():
        # If the robot is not found, append an error message
        SuccessMessage += f"\nError: Could not find '{RobotName}' in RoboDK."
    else:
        # If the robot is found, append a success message
        SuccessMessage += f"\nFound robot '{robot.Name()}' in RoboDK."
        # Get the robot's base (parent item)
        robot_base = robot.Parent()
        # Get the tool attached to the robot
        tool = robot.getLink(rl.ITEM_TYPE_TOOL)
        # Check if both base and tool are valid
        if not robot_base.Valid() or not tool.Valid():
            SuccessMessage += "\nCannot proceed without a valid base and tool."
        else:
            # Check if a program with the given name already exists in RoboDK
            existing_program = RDK.Item("MoveThroughPlanesProgram", rl.ITEM_TYPE_PROGRAM)
            if existing_program.Valid():
                # If it exists, delete it to replace with a new one
                existing_program.Delete()
            # Define the program name
            program_name = "MoveThroughPlanesProgram"
            # Create a new program in RoboDK associated with the robot
            program = RDK.AddProgram(program_name, robot)
            # Set the reference frame and tool for the program
            program.setFrame(robot_base)
            program.setTool(tool)
            # Set default speed and acceleration for the program
            program.setSpeed(speed_ms)          # Default speed
            program.setAcceleration(accel_mss)  # Default acceleration
            SuccessMessage += f"\nProgram '{program_name}' created."

            # Create a dictionary to map specific steps in the cycle to speed values
            speed_order_to_value = {}
            if 'SetSpeedOrder' in globals() and SetSpeedOrder is not None:
                for idx, step in enumerate(SetSpeedOrder):
                    if idx < len(SetSpeedValue):
                        # Map the step index to the corresponding speed value
                        speed_order_to_value[step] = SetSpeedValue[idx]
                    else:
                        # This case should not occur due to earlier validation
                        speed_order_to_value[step] = speed_ms  # Use default speed

            # Loop through each plane in the PlanesList
            for idx, plane in enumerate(PlanesList):
                plane_number = idx  # Current plane index (0-based)
                # Determine the current step within the cycle
                step_in_cycle = plane_number % cycle_length

                # Check if the current step requires a stop
                if 'StopOrder' in globals() and StopOrder is not None:
                    if step_in_cycle in StopOrder:
                        # Display a dialog to the user to confirm continuation
                        user_choice = dialogs.ShowMessageOkCancel(
                            f"Process stopped at Plane {plane_number + 1}. Click OK to continue.", "User Confirmation")
                        if not user_choice:
                            # If user cancels, append message and break the loop
                            SuccessMessage += f"\nProcess cancelled by the user at Plane {plane_number + 1}."
                            break  # Exit the loop
                        # Optionally, display a popup in RoboDK
                        program.RunInstruction("popup('Stopped','Press Ok to move on to the next step',True,False,blocking=True)", True)
                        SuccessMessage += f"\nProcess stopped at Plane {plane_number + 1}."

                # Check if the current step requires a speed change
                if 'SetSpeedOrder' in globals() and SetSpeedOrder is not None:
                    if step_in_cycle in SetSpeedOrder:
                        # Retrieve the new speed value for this step
                        speed_value = speed_order_to_value.get(step_in_cycle, speed_ms)
                        # Set the new speed in the program
                        program.setSpeed(speed_value)
                        SuccessMessage += f"\nSpeed set to {speed_value} m/s at Plane {plane_number + 1} (Step {step_in_cycle})."

                # Convert the Rhino plane to a RoboDK pose matrix in the robot's coordinate system
                target_pose_robot = plane_to_pose(plane)
                # Get the pose of the robot's reference frame
                ref_frame_pose = robot_base.Pose()
                # Calculate the target pose relative to the reference frame
                target_pose_relative = ref_frame_pose.inv() * target_pose_robot

                # Create a new target in RoboDK for the current plane
                target_name = f"Plane_{plane_number + 1}"
                # Add the target under the robot base with the robot as the associated item
                target = RDK.AddTarget(target_name, robot_base, robot)
                # Set the target as a Cartesian target (as opposed to joint target)
                target.setAsCartesianTarget()
                # Set the pose of the target relative to the reference frame
                target.setPose(target_pose_relative)

                try:
                    # Attempt to move the robot linearly (MoveL) to the target pose
                    robot.MoveL(target_pose_relative, False)
                    # Add a linear movement instruction to the program
                    program.MoveL(target)
                    SuccessMessage += f"\nPlane {plane_number + 1} reachable with linear movement relative to reference frame."
                except Exception as e:
                    # If linear movement fails, try joint movement (MoveJ)
                    try:
                        robot.MoveJ(target_pose_relative, False)
                        program.MoveJ(target)
                        SuccessMessage += f"\nPlane {plane_number + 1} reachable with joint movement after linear movement failed."
                    except Exception as e_joint:
                        # If both movements fail, log the error and add the plane to PlaneExtra
                        SuccessMessage += f"\nPlane {plane_number + 1} unreachable with both linear and joint movements. Error: {str(e_joint)}"
                        PlaneExtra.append(plane)

                # Log the TCP orientation and target coordinates for the current plane
                TCPOrientations.append(format_tcp_orientation(plane, f"Plane {plane_number + 1}"))
                TargetPointCoordinates.append(format_target_coordinates(plane, f"Plane {plane_number + 1}"))

            # Store the program name and append a success message
            Program = program_name
            SuccessMessage += f"\nProgram '{program_name}' updated successfully."

# -------------------- Output Results --------------------
# At the end of the script, print the accumulated success and error messages
print(SuccessMessage)
# Optionally, print or log other results if required
# For example:
# print("TCP Orientations:", TCPOrientations)
# print("Target Coordinates:", TargetPointCoordinates)
# print("Unreachable Planes:", PlaneExtra)
# ---------- end py3_13 ----------
panel_51 = Panel(py3_13.SuccessMessage)
pln_13 = Plane(py3_13.PlaneExtra)
deplane_9 = DeconstructPlane(Plane=pln_13)  # -> Origin, XAxis, YAxis, ZAxis
panel_52 = Panel(py3_13.Program)
amp_11 = Amplitude(Vector=deplane_9.ZAxis, Amplitude=50)
vdis_6 = VectorDisplay(Anchor=deplane_9.Origin, Vector=amp_11)

# ---- group: ctrl_ProgramRobotB
comauplanes_2 = RemoteReceiver(comauplanes)
py3_14 = Python3Script(Planes=comauplanes_2, BranchSize="9")  # -> out, simplify(BranchedPlanes); inputs Planes: list of Plane, BranchSize: Int32; same code as py3_12
bang_3 = ExplodeTree(Data=py3_14.BranchedPlanes)  # -> Branch0, flatten(Branch1), flatten(Branch2), flatten(Branch3), flatten(Branch4), flatten(Branch5)
robotnameb_4 = RemoteReceiver(robotnameb)
element1_2 = RemoteSender(bang_3.Branch0)
element2_2 = RemoteSender(bang_3.Branch1)
element3_2 = RemoteSender(bang_3.Branch2)
element4_2 = RemoteSender(bang_3.Branch3)
element5_2 = RemoteSender(bang_3.Branch4)
element6_2 = RemoteSender(bang_3.Branch5)
panel_53 = Panel("""1
4""")
panel_54 = Panel("""20.00
10.00""")

# ----
comauplanes_3 = Data(flatten(py3_14.BranchedPlanes))

# ---- group: ctrl_ProgramRobotB (continued)
py3_15 = Python3Script(
    RobotName=robotnameb_4,
    UpdateRoboDK=Toggle(False),
    PlanesList=comauplanes_3,
    SetSpeedOrder=panel_53,
    SetSpeedValue=panel_54,
    StopOrder="6")  # -> out, SuccessMessage, TargetPoses, Program, TCPOrientations, PlaneExtra; inputs PlanesList: list of Plane, SetSpeedOrder: list of Int32, SetSpeedValue: list of Double, StopOrder: list of Int32; same code as py3_13
panel_55 = Panel(py3_15.SuccessMessage)
panel_56 = Panel(py3_15.Program)
