# Grasshopper definition assembly_sequence_and_cutting_stock.gh (Grasshopper 1.0.8)
# plug-ins: RhinoCodePluginGH, Pufferfish, Human, GHLinearCutting, MetaHopper, Telepathy, Flexibility

# ---- group: other_ / add this prefix to group for colouring
other = ColourSwatch(SwatchColor=RGB(255, 255, 255))
in = ColourSwatch(SwatchColor=RGB(121, 219, 112))
out = ColourSwatch(SwatchColor=RGB(110, 245, 234))
ctrl = ColourSwatch(SwatchColor=RGB(209, 237, 85))
b = ColourSwatch(SwatchColor=RGB(196, 196, 196))
calc = ColourSwatch(SwatchColor=RGB(196, 98, 98))
viz = ColourSwatch(SwatchColor=RGB(184, 115, 240))

# ---- group: other_ / press this to update group colours
groups = GetGroups()  # -> Groups, GroupStyles, Nickname, Color

# ---- group: other_
connected = GetConnectedObjects(Objects=[in, b, out, ctrl, calc, viz, other])
object_info = ObjectInfo(Objects=connected)  # -> Name, NickName, Type, Pivot, Bounds, Value, Enabled, Preview
concat = Concatenate(FragmentA=object_info.NickName, FragmentB="*")
graft = GraftTree(Tree=concat, IncludeEmptyLists=True, IncludeNullItems=True)
tmatch = MatchText(Text=groups.Nickname, Pattern=graft, Case=True)
cull = CullPattern(List=groups.Groups, CullPattern=tmatch)
tstat = TreeStatistics(Tree=cull)  # -> Paths, Length, Count
equals = Equality(FirstNumber=tstat.Length, SecondNumber=0)  # -> Equality, Inequality
cull_2 = CullPattern(List=object_info.Value, CullPattern=equals.Inequality)
graft_2 = GraftTree(Tree=cull_2, IncludeEmptyLists=True, IncludeNullItems=True)
prune = PruneTree(Tree=cull, Minimum="1", Maximum=0)
setgroup = SetGroupProperties(Group=simplify(prune), Color=simplify(graft_2))

# ----
lblgrp = LabelGroups(Run=Toggle(True))

# ---- group: in_Choose Assembly Step
choose_assembly_steps = Slider(1337, range=1..2181)

# ---- group: in_Cutting_Pattern_params / CUTTING STOCK INPUT VARS
sel_section = ValueList({"CHS 139.7x5.0": 6, "CHS 114.3x5.0": 0, "CHS 101.6x5.0": 1, "CHS 88.9x5.0": 4, "CHS 76.1x5.0": 5, "CHS 60.3x5.0": 3, "CHS 48.3x5.0": 2}, selected="CHS 139.7x5.0")
stock_length_mm = Slider(12000, range=0..100000)
cut_width_mm = Slider(3, range=3..10)

# ---- group: in_Cutting_Pattern_params
save_cutting_patterns = BooleanToggle(False)
cutting_stock_algo = ValueList({"optimised": 0, "naive": 1}, selected="optimised")
viz_position = Slider(31, range=10..200)
viz_rectangle_width = Slider(2.5, range=0.5..10)
viz_rectangle_pos = Slider(12.9, range=2..50)
viz_tubes_title_height = Slider(2.5, range=0.5..10)
viz_rectangles_id = Slider(2, range=2..5)
viz_rectangle_extent_x = Slider(43, range=10..100)
steel_density_kg_m3 = Panel("7850")
save_screen_cap = BooleanToggle(False)
save_screen_cap_2 = Data(save_screen_cap)
save_cutting_patterns_2 = Data(save_cutting_patterns)
steel_density = Data(steel_density_kg_m3)
viz_rectangle_extent_x_2 = RemoteSender(viz_rectangle_extent_x)
viz_tubes_title_height_2 = RemoteSender(viz_tubes_title_height)
viz_rectangle_width_2 = RemoteSender(viz_rectangle_width)
save_cutting_patterns_3 = RemoteSender(save_cutting_patterns_2)
cutting_stock_algo_2 = RemoteSender(cutting_stock_algo)
save_screen_cap_3 = RemoteSender(save_screen_cap_2)
stock_length_mm_2 = RemoteSender(stock_length_mm)
viz_rectangle_pos_2 = RemoteSender(viz_rectangle_pos)
viz_rectangles_id_2 = RemoteSender(viz_rectangles_id)
cut_width_mm_2 = RemoteSender(cut_width_mm)
steel_density_2 = RemoteSender(steel_density)
viz_position_2 = RemoteSender(viz_position)
sel_section_2 = RemoteSender(sel_section)

# ----
start_point = Point(<point referenced from the Rhino model>)

# ---- group: in_british_court
british_court = Brep([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])
wires = BrepWireframe(Brep=british_court, Density=-1)
bbox = BoundingBox(Content=british_court, Plane=PlaneXY(0, 0, 0), UnionBox=True)  # -> Box, Box_2
debox = DeconstructBox(Box=bbox.Box)  # -> Plane, X, Y, Z
previewlw = CustomPreviewLineweights(Geometry=wires, Shader=ColourSwatch(SwatchColor=RGB(94, 94, 94)), Absolute=False)
dedomain = DeconstructDomain(Domain=debox.Y)  # -> Start, End
dedomain_2 = DeconstructDomain(Domain=debox.Z)  # -> Start, End
dedomain_3 = DeconstructDomain(Domain=debox.X)  # -> Start, End
start_point_2 = RemoteSender(start_point)
pt = ConstructPoint(XCoordinate=dedomain_3.Start, YCoordinate=dedomain.Start, ZCoordinate=dedomain_2.End)

# ---- group: in_british_court / in_Truss Geometry
# in_Truss Geometry
in_section_types = Data(["CHS 114.3x5.0", "CHS 101.6x5.0", "CHS 48.3x5.0", "CHS 60.3x5.0", "CHS 48.3x5.0", "CHS 60.3x5.0"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])
lines_all = Data([Line((31.98621636, 73.03261346, 1.000223942), (34.98762121, 73.44859683, 1.000226306)), Line((31.98621636, 73.03261346, 1.000223942), (29.03815113, 72.19656026, 1.000223508)), Line((23.33492077, 96.99870194, 0.0004575252846), (19.57543654, 96.99913401, 0.00029953803)), Line((23.33492077, 96.99870194, 0.0004575252846), (26.71935695, 96.99969776, 0.0001075823365)), Line((30.05474527, 96.99897763, 0.0003697248549), (26.71935695, 96.99969776, 0.0001075823365)), Line((30.05474527, 96.99897763, 0.0003697248549), (33.28410699, 96.99973309, 9.757897824e-05))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])
bbox_2 = BoundingBox(Content=lines_all, Plane=PlaneXY(0, 0, 0), UnionBox=True)  # -> Box, Box_2
debox_2 = DeconstructBox(Box=bbox_2.Box)  # -> Plane, X, Y, Z
pt_2 = Point(debox_2.Plane)
rigid_points = Data([Point(31.98633385, 73.03201294, 0.999996841), Point(23.33449745, 96.99990845, 3.090967766e-06), Point(30.05458641, 96.99992371, 2.754405841e-06), Point(34.98765945, 73.44797516, 0.999996841), Point(36.5, 96.99993134, 2.695957846e-06), Point(38.01234055, 73.44797516, 0.999996841)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])
move2pt = MoveToPoint(Geometry=lines_all, PointA=pt_2, PointB=pt)  # -> Moved, Vector, Transform
move2pt_2 = MoveToPoint(Geometry=rigid_points, PointA=pt_2, PointB=pt)  # -> Moved, Vector, Transform
in_section_types_2 = RemoteSender(in_section_types)
in_beams_all = RemoteSender(move2pt.Moved)
rigid_points_2 = RemoteSender(move2pt_2.Moved)

# ---- group: out_output_cutting_patterns_to_excel
stock_length_mm_3 = RemoteReceiver(stock_length_mm_2)
concat_2 = Concatenate(FragmentA="stock_length: ", FragmentB=stock_length_mm_3, FragmentC=" mm")

# ---- group: b_Assembly Sequence
in_beams_all_2 = RemoteReceiver(in_beams_all)
start_point_3 = RemoteReceiver(start_point_2)

# ----
in_beams_all_3 = RemoteReceiver(in_beams_all)
rigid_points_3 = RemoteReceiver(rigid_points_2)

# ---- group: b_Assembly Sequence / viz_all_beams
# viz_all_beams
Z = UnitZ(Factor=expr("-0.01", -0.1))
move = Move(Geometry=in_beams_all_2, Motion=Z)  # -> Geometry, Transform
previewlw_2 = CustomPreviewLineweights(Geometry=move.Geometry, Shader=ColourSwatch(SwatchColor=RGB(10, 10, 10)), Absolute=False)

# ---- group: b_Assembly Sequence / b_Trussemble Class
# b_Trussemble Class
py3_trussemble = Python3Script(in_lines=in_beams_all_2, in_rigid_points=rigid_points_3, in_start_point=start_point_3)  # -> out, assembly_steps, ordered_nodes, line_indices; inputs in_lines: list of Line, in_rigid_points: list of Point3d, in_start_point: Point3d
# ---------- py3_trussemble: Python ----------
## Dependecies used for type hinting (not available by default in Python 3.9.10)
from __future__ import annotations
from typing import List, Tuple

## McNeel-related dependencies
import rhinoscriptsyntax as rs 
import Grasshopper as gh
import Grasshopper.Kernel as ghk
from Grasshopper.Kernel.Data import GH_Path
import Rhino.Geometry as rg

## General utilities
import networkx as nx
from collections import Counter
import math
import numpy as np
import itertools
from itertools import combinations

class Trussemble:
    """
    A class to produce an assembly sequence of an input structural latice of beams (lines). The assembly sequence is made 
    such that it can be built with two robots (co-bots) and employs clever strategies to shorten the assembly path, but 
    also maintain structural rigidity along every step of the way. 

    Requirements: Every node has to connect to at least three other nodes, unless it is a 'rigid' node, (a.k.a a support node)

    Inputs ---------------------------------------------------------------------------------------------------------------->

    in_lines (required): the set of beams that are the lattice frame, given as Rhino.Geometry.Curve or Rhino.Geometry.Line

    in_rigid_points (required): the set of points that define the support points of the structure, script will still work 
        if the points are not part of the endpoints of the beams (closest endpoint will be assigned as rigid point),
        this is done to avoid tolerence issues between the two inputs.



    in_start_point (not required): the start point from which the script will find the starting rigid points. This point
        does not need to be part of the rigid points or any nodes in the lattice, it can be anywhere in space. The script
        will chose the closest three rigid points which share a neighbour and will start assembling from there.


    Returns -------------------------------------------------------------------------------------------------------------->

    assembly_steps: a gh.DataTree of type rhino.Line, with every branch being a list of lines, representing one step of the assembly sequence

    processed_nodes: a list of rg.Point3d of equal length to assembly_steps. Each point in the list corresponds to each branch in assembly_steps
        and is also the connecting node for all lines in that branch. 

    lines_indices: a gh.DataTree of type int which has is identical to assembly_steps, but instead of each item being a curve, each item is the 
        index of the curve in the input in_lines list. This is useful to reference each assembly_step to the input lines



    """
    def __init__(self, lines: List(rg.Curve), rigid_points: List(rg.Point3d), start_point: rg.Point3d) -> None:
        ##validate inputs
        if not all(isinstance(line, rg.Line) for line in in_lines) or not in_lines:
            raise ValueError('Input Lines are not Lines')
        if not all(isinstance(point, rg.Point3d) for point in in_rigid_points) or not in_rigid_points:
            raise ValueError('Input Rigid Points are not Points')
        if not isinstance(in_start_point, rg.Point3d) or not in_start_point:
            raise ValueError('Input start point is not a point')

        ## inputs
        self.lines = lines
        self.points, self.edges_list, self.graph = self.__get_line_connectivity()
        self.rigid_points = rigid_points
        self.rigid_indices = self.__get_rigid_point_indices()
        self.start_point = start_point
        ## outputs
        self.assembly_steps = gh.DataTree[object]()
        self.assembly_step_line_indices = gh.DataTree[object]()
        self.processed_nodes = []
    
    def __average_point(self, pt1: rg.Point3d, pt2: rg.Point3d, pt3: rg.Point3d) -> rg.Point3d:
        """
        Returns the average point as a rg.Point3d, given three input points
        """ 
        # Calculate the average of the x, y, and z coordinates
        avg_x = (pt1.X + pt2.X + pt3.X) / 3
        avg_y = (pt1.Y + pt2.Y + pt3.Y) / 3
        avg_z = (pt1.Z + pt2.Z + pt3.Z) / 3
        
        # Return the average point as a Point3d
        average_point = rg.Point3d(avg_x, avg_y, avg_z)
        return average_point

    def __distance(self, p1: rg.Point3d, p2: rg.Point3d) -> float:
        """
        returns distance between two points, calculated using numpy which prevents errors due to tolerance or too large numbers
        """
        np_p1 = np.array((p1.X, p1.Y, p1.Z))
        np_p2 = np.array((p2.X, p2.Y, p2.Z))

        distance = np.linalg.norm(np_p1 - np_p2)

        return distance

    def __get_rigid_point_indices(self) -> List(int):
        """
        Returns the indices of the input rigid points as they map onto self.points, which are indexed in self.graph
        """
        rigid_indices = [] ## init rigid point indices list
        points_array = np.array([[round(pt.X,3), round(pt.Y,3), round(pt.Z,3)] for pt in self.points]) ## make rigid points into np array, allows easier and more reliable distance calculation regardless of document units

        for rigid_point in self.rigid_points:
            if rigid_point in self.points: ## if rigid point is in self.points (i.e if distance between the corresponding point is 0)
                rigid_indices.append(self.points.index(rigid_point))

            else: ## if distance between them is not 0
                rigid_point_array = np.array([rigid_point.X, rigid_point.Y, rigid_point.Z]) ## rigid point as np array
                distances = np.linalg.norm(points_array - rigid_point_array, axis=1) ## distance between rigid point and all self.points
                rigid_idx = np.argmin(distances) ## min distance between rigid point and one point in self.points
                rigid_indices.append(rigid_idx) ## add index of closest rigid point to rigid_indices
        return rigid_indices

    def __get_line_connectivity(self) -> Tuple( List(rg.Point3d), List(Tuple(int,int), nx.Graph())):
        """
        Create a list of nodes, a list of connections between nodes and a graph of those connections

        this is a private method and uses self.lines as input

        Returns a Tuple of a list of rg.Point3d (the nodes), a list of tuples (the graph edges) and a netwroxk graph
        """
        lines = self.lines
        edges_list = [] # use a list to store the edges (G.edges() is not used as its edges are sorted and so the indices do not map directly to input in_lines)
        unique_points = {}  # use a dictionary to map points to their indices


        for line_index, line in enumerate(lines):
            # get the start and end points of the line
            start_point = line.From
            end_point = line.To
            
            # CRUCIAL: convert to rg.Point3d and ROUND COORDINATES (prevents issue of not being able to find matching point because of document tolerance)
            start_point3d = rg.Point3d(round(start_point.X, 3), round(start_point.Y, 3), round(start_point.Z, 3))
            end_point3d = rg.Point3d(round(end_point.X, 3), round(end_point.Y, 3), round(end_point.Z, 3))


            if start_point3d not in unique_points: # add points to the unique points dictionary if they don't already exist
                unique_points[start_point3d] = len(unique_points) ## assign point to its index
            if end_point3d not in unique_points:
                unique_points[end_point3d] = len(unique_points)
            
            # get the indices of the start and end points
            start_index = unique_points[start_point3d]
            end_index = unique_points[end_point3d]

            # append the indices to the edges list
            edges_list.append((start_index, end_index))

        # convert unique points to a list of Point3d
        unique_points_list = list(unique_points.keys()) ## get point keys from dictionary
        G = nx.Graph() ## init networkx graph
        G.add_edges_from(edges_list) ## add edges to graph

        return unique_points_list, edges_list, G

    def __can_node_be_rigid(self, node: int) -> bool:
        """
        This is used to test if a candidate meets the minimum requirements to be considered rigid

        if these minimum requirements are met, the candidate is tested for hinge-behaviour
        """
        if node in self.rigid_indices: ## node can be rigid if it is already rigid
            return True
        else: ## node can be rigid if it is not already rigid and has AT LEAST 3 neighbours in processed_nodes
            graph = self.graph
            neighbours = list(graph.neighbors(node)) ## neighbours of node
            count_existing_neighbours = sum(1 for neighbour in neighbours if neighbour in self.processed_nodes) ## list of 1s, length of list = neighbours of node that are already processed
            return count_existing_neighbours >= 3

    def __get_first_move(self) -> Tuple( List(int), int ):
        """
        Function to find first move given a start point
        """ 

        ## define inputs
        start_point = self.start_point
        rigid_ids = self.rigid_indices
        points = self.points
        graph = self.graph

        ## intialise utility variables and outputs
        min_avg_distance_to_start = float('inf') ## min avg distance of 3 rigid points to start point
        neighbours_to_connect_to = [] ## neighbours that the 3 rigid points chosen can all connect to (shared neighbours)
        first_supports = None ## first three rigid points, supports, that are connected by the neighbours_to_connect_to

        def find_common_neighbour_combinations(graph: nx.Graph(), rigid_points_indices: List(int)) -> Tuple( List(set(int,int,int)), List(int)):
            """
            Finds combinations of 3 rigid points which share at least one neighbour
            """
            valid_combinations = [] ## initialse list to store sets of 3 neighbours
            common_neighbors = [] ## common neighbour of each set of neighbours for the sets in valid_combinations
            
            # generate all combinations of three nodes from rigid_points
            for comb in combinations(rigid_points_indices, 3):
                # get neighbors for each node in the combination
                neighbors_1 = set(graph.neighbors(comb[0]))
                neighbors_2 = set(graph.neighbors(comb[1]))
                neighbors_3 = set(graph.neighbors(comb[2]))
                
                # find common neighbors
                common_neighbor = neighbors_1 & neighbors_2 & neighbors_3
                
                # if there is at least one common neighbor, add the combination to the result
                if common_neighbor:
                    valid_combinations.append(comb)
                    common_neighbors.append(list(common_neighbor)[0])

            return valid_combinations, common_neighbors
                
        ## get all candidates of sets of 3 rigid point nodes where all 3 share at least one neighbour
        starting_three_candidates, common_neighbours = find_common_neighbour_combinations(graph, rigid_ids)

        ## iterate through all sets of three rigid point nodes that share at least one neighbour
        for i, starting_three in enumerate(starting_three_candidates):

            ## get 3 sepparate points from each set of rigid point nodes
            p1 = points[starting_three[0]]
            p2 = points[starting_three[1]]
            p3 = points[starting_three[2]]

            centre = self.__average_point(p1, p2, p3) ## get average location of the three points

            avg_distance = self.__distance(start_point, centre) ## compute distance between average location of set of rigid points to start point

            ## if the average distance of the set of neighbours is less than the one before it, update the distance and store the combination of the first three supports and also the neighbour_to_connect_to
            if avg_distance < min_avg_distance_to_start:
                min_avg_distance_to_start = avg_distance
                first_supports = starting_three
                neighbours_to_connect_to.append(list([common_neighbours[i]]))

        ## return last added neighbourt_to_connect_to, [-1][0] is used because it is the last item added that should be considered, but the first neighbour (assuming some rigid points might share more than one neighbour) 
        neighbour_to_connect_to = neighbours_to_connect_to[-1][0]

        self.processed_nodes.extend(first_supports) ## add first three supports to processed nodes
        self.processed_nodes.append(neighbour_to_connect_to) ## add shared neighbour to processed nodes
        return list(first_supports), neighbour_to_connect_to ## returns the first three supports and their common neighbour

    def __check_edges(self, sub_graph_nodes: List(np.int64)):
        """
        Function that returns all edges in a graph that exist between sub_graph_nodes
        """
        graph = self.graph
        edges_to_add = [] ## init list of edges

        ## add edge to list if edge exists in graph (works only for un-directed graph, as the roof lattice is modelled as an un-directed graph)
        for node1, node2 in combinations(sub_graph_nodes, 2):
            if graph.has_edge(node1, node2):
                edges_to_add.append((node1, node2))

        return edges_to_add

    def __find_unprocessed_neighbors_subgraphs(self) -> List(int):
        """
        A function that returns the connected component in un-processed nodes which includes the node that is closest to the last added node

        Explanation points:

            1) The processed nodes form a subgraph of un-processed nodes, i.e all the nodes still remaining to be assembled
            2) The nodes in the un-processed nodes which are 'candidates', i.e have more than 3 connections to processed nodes are considered as the subgraph
            3) the subgraph can be conceptualised as the 'front' of the processed nodes, i.e the nodes which are not yet processed but are 1 connection away from being processed
            4) this 'front' can be broken down into connected components
            5) a connected component is a set of nodes which form a subgraph where no node is disconnected from that subgraph
            6) The front can then be thought of as sepparate subgraphs, if those subgraphs do not share connections with eachother
            7) effectively this reduces the number of candidates in each step to the ones that are connected with eachother and limits the 'jumping' of the robot from one area of the lattice to another

        """

        ## get inputs needed for the subgraphs to be found
        graph = self.graph
        processed_nodes = self.processed_nodes
        processed_nodes_set = set(processed_nodes)
        points = self.points
        
        # step 1a: find neighbours of processed nodes that arent yet processed (i.e the 'front')
        unprocessed_neighbors = set()

        # step 1b: get the neigbours of the last processed nodes
        last_node = processed_nodes[-1]
        neighbors_last_node = set(graph.neighbors(last_node))
        unprocessed_neighbors_last_node = neighbors_last_node - processed_nodes_set

        # step 1c: find unprocessed neighbors of all other processed nodes
        for node in processed_nodes_set:
            if node == last_node:
                continue  # Skip the last node as we already processed it
            neighbors = set(graph.neighbors(node))
            unprocessed_neighbors.update(neighbors - processed_nodes_set)

        # step 1d: add unprocessed neighbors of the last node to the main unprocessed set
        unprocessed_neighbors.update(unprocessed_neighbors_last_node)

        # step 2a: initialise list of subgraphs
        subgraphs = []
        
        # step 2b: get subgraph that includes only unprocessed neighbors
        unprocessed_subgraph = graph.subgraph(unprocessed_neighbors)
        
        # step 2c: find connected components in the unprocessed subgraph
        for component in nx.connected_components(unprocessed_subgraph):
            subgraphs.append(list(component))
        
        # step 3: initialise sorted subgraphs, to sort subgraphs based on their connection to last added node
        subgraphs_sorted = []
        
        # step 3a: subgraph connected to the last processed node
        subgraph_last_node = [comp for comp in subgraphs if any(node in unprocessed_neighbors_last_node for node in comp)]
        
        # step 3b: remaining subgraphs (not connected to the last node)
        other_subgraphs = [comp for comp in subgraphs if comp not in subgraph_last_node]
        
        # step 4: sort subgraphs so that the first subgraph is connected to the last added node
        if subgraph_last_node:
            subgraphs_sorted.extend(subgraph_last_node)
            subgraphs_sorted.extend(other_subgraphs)
            return subgraphs_sorted[0]

        else: ## if the last added node is not connected to any of the subgraphs (occurs at corners when last added node is corner node)
            closest_distance = float('inf')
            first_comp = None
            for comp in subgraphs:
                for node in comp:
                    distance = self.__distance(points[last_node], points[node]) ## pick subgraph which incldues node with shortest distance from last added node.
                    if distance < closest_distance:
                        first_comp = comp
                        closest_distance = distance
            return first_comp

    def __get_possible_connections(self, node: int) -> List(int):
        """
        returns neighbours of node that are not in processed nodes
        """
        graph = self.graph
        can_connect_to = [neighbour for neighbour in graph.neighbors(node) if neighbour in self.processed_nodes]
        return can_connect_to

    def __sort_rigid_candidates(self, candidates: List[int]) -> List[int]:
        """
        Sorts candidates that can be rigid by their distance to the last added point.
        """
        origin = self.processed_nodes[-1]  # Get the last connected node
        points = self.points

        # Sort candidates by their distance to the origin point, using a lambda function
        sorted_candidates = sorted(candidates, key=lambda c: self.__distance(points[origin], points[c]))
        return sorted_candidates

    def __get_sorted_supports(self, supports: List(rg.Point3d)):
        """
        Sorts the supports of a candidate node by considering the distance of all supports from eachother and their triangle area. The points should have a small area but a large distance from eachother
        """
        support_combinations = list(itertools.combinations([x for x in range(len(supports))], 3)) ## combinations of 3 elements in the supports, given as indices
        score_per_combination = {} ## each combination has a score by how rigid it is
        result_supports = [] ## init list to store the order of supports that is optimal

        def get_combined_distance_of_supports(supports: List(rg.Point3d)) -> float:
            """
            Gets a combined distance metric between all points in the supports list, i.e a high combined distance means the points are far away from each other
            Calculation approach might seem long-winded but rs.Distance() couldnt be used because of constraints with too large/small numbers and doing this with matrices is less verbose than calculating multiple distances consequently and averaging
            """
            support_coords = np.array([[pt.X, pt.Y, pt.Z] for pt in supports])
            num_supports = len(support_coords)
            diff = support_coords[:, np.newaxis, :] - support_coords[np.newaxis, :, :] ## calculates the difference ( as a vector (x,y,z)) in each X, Y and Z for each pair of points (results in 3d matrix) i.e pairwise difference of points
            distances = np.linalg.norm(diff, axis=2) ## get euclidian distance between all pairs of points 
            distances += np.eye(num_supports) * 1e-8 ## identity matrix, I,  gives the distance between any two points, multiply by small number to prevent 0s, as I(x,x) = 0, i.e distance of any point to itself is 0
            combined_distance = np.prod(distances) ## get product of all pairwise distances between any two points
            return combined_distance

        def triangle_area(rs_pointA: rg.Point3d, rs_pointB: rg.Point3d, rs_pointC: rg.Point3d) -> float:
            """
            Returns area of triangle formed by two points
            """
            A = np.array([rs_pointA.X, rs_pointA.Y, rs_pointA.Z])
            B = np.array([rs_pointB.X, rs_pointB.Y, rs_pointB.Z])
            C = np.array([rs_pointC.X, rs_pointC.Y, rs_pointC.Z])
            area = 0.5 * np.linalg.norm(np.cross(B - A, C - A)) ## triangle area = 0.5 x (b x h)
            return area

        ## iterate through all support combinations and add score to each combinations
        for c in support_combinations:
            supports_list = [supports[c[0]], supports[c[1]], supports[c[2]]]

            combined_distance = float(get_combined_distance_of_supports(supports_list))
            area = float(triangle_area(supports_list[0], supports_list[1], supports_list[2]))
            if area == 0.0:
                score = combined_distance ## score is higher if combined distance is higher
            else:
                score = combined_distance / area ## score is lower if area is higher
            score_per_combination[c] = score
        
        score_per_combination = dict(sorted(score_per_combination.items(), key=lambda item: item[1])) ## sort support combinations by score

        support_combinations = list(score_per_combination.keys())

        ## add sorted supports to result support
        for support_combination in support_combinations:
            result_support = list(support_combination)
            for i, support in enumerate(supports):

                if i not in support_combination:
                    result_support.append(i)

                result_supports.append(result_support)

        return result_supports[0]

    def __check_if_door(self, support_nodes: List(int), load_node: int) -> bool or List(int):
        """
        Check if a composition of supports nodes and a load node produce hinge-behavour
        """
        ## get inputs
        support_points = [self.points[x] for x in support_nodes]
        load_point = self.points[load_node]
        combination = []

        def point_plane_distance(plane_pts: List(rg.Point3d), test_pt: rg.Point3d) -> float:
            """
            gets distance of a point to a plane (couldnt be done with rhinoscriptsyntax because of crashing with too large or small numbers)
            """
            A, B, C = plane_pts ## input plane pts are always 3 because 2 supports and 1 load point used to make plane
            ## get plane vectors
            AB = B - A
            AC = C - A
            normal_vector = rg.Vector3d.CrossProduct(AB, AC) ## get normal of vector by using cross product of two co-planar vectors
            if normal_vector.IsZero:
                return 0.0
            normal_vector.Unitize()
            D = - (normal_vector.X * A.X + normal_vector.Y * A.Y + normal_vector.Z * A.Z)
            numerator = abs(normal_vector.X * test_pt.X + normal_vector.Y * test_pt.Y + normal_vector.Z * test_pt.Z + D) ## eq. to find distance from one point to a plane (assuming normal vec is unitised)
            distance = numerator  # since normal_vector is unitised, denominator is 1
            return distance

        def distance_to_centroid(pts: List(rg.Point3d), test_pt: rg.Point3d) -> float:
            """
            Distance calc wrapped in function to make in-line code more readable
            """
            centroid = rg.Point3d((pts[0].X + pts[1].X + pts[2].X) / 3,
                                  (pts[0].Y + pts[1].Y + pts[2].Y) / 3,
                                  (pts[0].Z + pts[1].Z + pts[2].Z) / 3)
            distance = self.__distance(test_pt, centroid)
            return distance

        def is_door(three_supports: List(rg.Point3d), load_point: rg.Point3d, span_height_ratio=0.25) -> bool:
            distance = point_plane_distance(three_supports, load_point) ## get distance to plane formed by two supports and load point
            effective_span = distance_to_centroid(three_supports, load_point) ## effective span is average distance of each support to the load point
            if effective_span == 0:
                return False
            ratio = distance / effective_span ## if distance between third point and the plane is smaller than 25% of the span then there can be hinge-like behaviour (which is further validated by Karamba FEA)
            return ratio <= span_height_ratio

        first_three = support_points[:3]

        ## if first three supports do not behave like a hinge return the supports
        if not is_door(first_three, load_point):
            return support_nodes
        else: ## if first three supports do behave like a hinge, try to find another combination that doesnt behave like a hinge
            for comb in combinations(support_nodes, 3):
                comb_points = [self.points[x] for x in list(comb)]

                if not is_door(list(comb_points), load_point):
                    combination.extend(list(comb))
                    missing = [x for x in support_nodes if x not in list(comb)]
                    if missing:
                        combination.extend(missing)
                    return combination
            ## if not combination is found, then return True (True = behaves like a hinge, and can't be fixed)
            return True

    def __find_edge_index(self, edge: Tuple(int,int)) -> int:
        """
        Gets index of an edge in a graph, used to create lines_indices output
        """
        # get a list of all edges in the graph
        edges_list = self.edges_list
        
        # check if the edge exists in the edge list
        if edge in edges_list or (edge[1], edge[0]) in edges_list:
            return edges_list.index(edge) if edge in edges_list else edges_list.index((edge[1], edge[0]))
        
        return -1  # edge doesn't exist

    def assemble(self) -> gh.DataTree(List(rg.Curve)):
        """
        Main funcion of class that creates assembly step sequence
        """

        ## get inputs 
        graph = self.graph
        points = self.points
        assembly_steps = self.assembly_steps
        assembly_lines_indices = self.assembly_step_line_indices

        ## start while loop that runs until all edges are processed
        while True:
            ## assembly process first step
            if len(self.processed_nodes) == 0:
                first_supports, first_neighbour = self.__get_first_move() ## get first move
                ## initialise lines to add to move and line indices to add
                lines_to_add = []
                lines_indices = []
                
                ## create line for each edge
                for support in first_supports:
                    p1 = points[support]
                    p2 = points[first_neighbour]

                    line = rs.AddLine(p1, p2)
                    lines_to_add.append(line)
                    lines_indices.append(self.__find_edge_index((int(support), int(first_neighbour))))
                
                ## check if missing edges exist (edges between supporting nodes)
                missing_edges = self.__check_edges(first_supports)
                for missing_edge in missing_edges:
                    p1 = points[missing_edge[0]]
                    p2 = points[missing_edge[1]]

                    line = rs.AddLine(p1,p2)
                    lines_to_add.append(line)
                    lines_indices.append(self.__find_edge_index((int(missing_edge[0]), int(missing_edge[1]))))

                ## add lines to assembly steps
                path = GH_Path(0)
                assembly_steps.AddRange(lines_to_add, path)
                assembly_lines_indices.AddRange(lines_indices, path)

            ## assembly process middle steps
            elif len(self.processed_nodes) < len(points):
                non_rigid_candidates = self.__find_unprocessed_neighbors_subgraphs() ## get connected component of unprocessed nodes
                rigid_candidates = [candidate for candidate in non_rigid_candidates if self.__can_node_be_rigid(candidate)] ## check if nodes in connected component can be rigid
                sorted_rigid_candidates = self.__sort_rigid_candidates(rigid_candidates) ## sort rigid candidates based on their distance to last added node


                for candidate in sorted_rigid_candidates:
                    lines_to_add = []
                    lines_indices = []
                    nodes_to_connect_to = self.__get_possible_connections(candidate) ## connections to processed nodes

                    ## edge case: next point to connect to is rigid and it only has one connection (i.e last added node is rigid)
                    ## this makes the simulation only follow the rigid points and doesnt complete and steps of the spanning nodes
                    if len(nodes_to_connect_to) == 1 and nodes_to_connect_to[0] in self.rigid_indices:
                        continue

                    ## if candidate is rigid point (no need for hinge-behaviour)
                    if candidate in self.rigid_indices:
                        for node in nodes_to_connect_to:
                            line = rs.AddLine(points[candidate], points[node])
                            lines_indices.append(self.__find_edge_index((int(candidate), int(node))))
                            lines_to_add.append(line)

                        ## add node to processed nodes and add step to assembly steps
                        self.processed_nodes.append(candidate)
                        path = GH_Path(assembly_steps.BranchCount)
                        assembly_steps.AddRange(lines_to_add, path)
                        assembly_lines_indices.AddRange(lines_indices, path)

                            
                    ## if candidate is not a rigid point
                    else:
                        nodes_sorted_indices = self.__get_sorted_supports([points[x] for x in nodes_to_connect_to]) ## sort supports based on combined distance and triangle area, returns sorting order 
                        sorted_support_nodes = [nodes_to_connect_to[x] for x in nodes_sorted_indices] ## get nodes of supports based on sorting order

                        ## check if there is hinge-behaviour, if there is and it cant be resolved, stop considering candidate and move to next candidate
                        if self.__check_if_door(sorted_support_nodes, candidate) == True:
                            continue

                        ## if there is hinge-behaviour but can be solved, return the reordered supports so that there isnt hinge-behaviour
                        else: 
                            sorted_support_indices = self.__check_if_door(sorted_support_nodes, candidate)

                        ## make lines from supports and candidate
                        for point_index in sorted_support_indices:
                            line = rs.AddLine(points[candidate], points[point_index])
                            lines_indices.append(self.__find_edge_index((int(candidate), int(point_index))))
                            lines_to_add.append(line)
                            
                        ## add candidate to processed nodes and step to assembly steps
                        self.processed_nodes.append(candidate)
                        path = GH_Path(assembly_steps.BranchCount)
                        assembly_steps.AddRange(lines_to_add, path)
                        assembly_lines_indices.AddRange(lines_indices, path)
            else:
                return assembly_steps


## init Trussemble class
my_truss = Trussemble(in_lines, in_rigid_points, in_start_point)

## specify outputs
assembly_steps = my_truss.assemble()
processed_nodes = my_truss.processed_nodes
line_indices = my_truss.assembly_step_line_indices
# ---------- end py3_trussemble ----------

# ---- group: b_Make Steel Tube Geometry / b_
in_beams_all_4 = RemoteReceiver(in_beams_all)
viz_position_3 = RemoteReceiver(viz_position_2)
brec = BoundingRectangle(Geometry=in_beams_all_4, Plane=PlaneXY(0, 0, 0), Axis=0, Slide=0, Union=True)  # -> Bounding, DimensionX, DimensionY
pt_3 = ConstructPoint(XCoordinate=brec.DimensionX, YCoordinate=brec.DimensionY, ZCoordinate=0)
X = UnitX(Factor=viz_position_3)
move_2 = Move(Geometry=pt_3, Motion=X)  # -> Geometry, Transform

# ---- group: b_Viz_Rectangles_Grid / b_viz_rectangles_grid_x
stock_length_mm_4 = RemoteReceiver(stock_length_mm_2)
viz_rectangle_pos_3 = RemoteReceiver(viz_rectangle_pos_2)
x_1000 = Number(expr("x/1000", stock_length_mm_4))
addition = Addition(A=x_1000, B=viz_rectangle_pos_3)
Y = UnitY(Factor=expr("-x", addition))
move_3 = Move(Geometry=move_2.Geometry, Motion=Y)  # -> Geometry, Transform

# ---- group: b_Cutting Stock Algorithms / b_Optimised Cutting Stock Algorithm
stock_length_mm_5 = RemoteReceiver(stock_length_mm_2)
cut_width_mm_3 = RemoteReceiver(cut_width_mm_2)

# ---- group: b_Make Steel Tube Geometry / b_
stock_length_mm_6 = RemoteReceiver(stock_length_mm_2)
division = Division(A=stock_length_mm_6, B="1000")
Y_2 = UnitY(Factor=division)

# ---- group: viz_Main_Label / viz_pos
# viz_pos
viz_tubes_title_height_3 = RemoteReceiver(viz_tubes_title_height_2)
Y_3 = UnitY(Factor=expr("-x", viz_tubes_title_height_3))
move_4 = Move(Geometry=move_2.Geometry, Motion=Y_3)  # -> Geometry, Transform

# ---- group: viz_Main_Label / viz_waste
# viz_waste
panel = Panel(" %")
panel_2 = Panel("Waste: ")
new_line = Panel("")

# ---- group: out_Input_beam_save_to_Excel
in_beams_all_5 = RemoteReceiver(in_beams_all)
panel_3 = Panel("C:\Users\Anton\OneDrive\Desktop\CORE\on site assembly\on_site_assembly.xlsx")
in_section_types_3 = RemoteReceiver(in_section_types_2)
merge = Merge(Data1="beam_id", Data2="beam_length", Data3="section_name")  # -> flatten(Result)
panel_4 = Panel(merge)
txt = Text(in_section_types_3)

len = Length(Curve=in_beams_all_5)
lng = ListLength(List=len)
roundd = RoundToDecimalPlace(NumberX=len, DecimalPlace=3, RoundType=0)  # -> Rounded, Difference
series = Series(Start=0, Step=1, Count=lng)

entwine = Entwine(Branch00=series, Branch01=roundd.Rounded, Branch02=txt, FlattenInputs=True)
save_beam_ids_to_excel = Python3Script(file_path=panel_3, sheet_name="Beam_Lengths", headers=panel_4, values_tree=entwine, save=Toggle(False))  # inputs headers: list, values_tree: tree, save: Boolean
# ---------- save_beam_ids_to_excel: Python ----------
from openpyxl import load_workbook, Workbook

def save_data_to_excel(file_path, sheet_name, headers, values):
    # Ensure the number of headers matches the number of value lists
    if len(headers) != len(values):
        raise ValueError("The number of headers must match the number of value lists.")
    
    # Try to load an existing workbook, otherwise create a new one
    try:
        workbook = load_workbook(file_path)
    except FileNotFoundError:
        workbook = Workbook()

    # If the sheet exists, remove it (to replace with new data)
    if sheet_name in workbook.sheetnames:
        del workbook[sheet_name]
    
    # Create a new sheet with the specified name
    sheet = workbook.create_sheet(title=sheet_name)
    
    # Write headers to the first row
    for col_num, header in enumerate(headers, start=1):
        sheet.cell(row=1, column=col_num, value=header)
    
    # Write values to subsequent rows for each column
    for col_num, value_list in enumerate(values, start=1):
        for row_num, value in enumerate(value_list, start=2):
            sheet.cell(row=row_num, column=col_num, value=value)
    
    # Save the workbook
    workbook.save(file_path)
values = []
for i in range(values_tree.BranchCount):
    values.append(values_tree.Branch(i))

if save:
    save_data_to_excel(file_path, sheet_name, headers, values)
# ---------- end save_beam_ids_to_excel ----------

# ---- group: out_Cutting Pattern Screen Cap
panel_5 = Panel("""optimised
naive""")
cutting_stock_algo_3 = RemoteReceiver(cutting_stock_algo_2)
sel_section_3 = RemoteReceiver(sel_section_2)
stock_length_mm_7 = RemoteReceiver(stock_length_mm_2)
item = ListItem(List=panel_5, Index=cutting_stock_algo_3, Wrap=True)
panel_6 = Panel("C:\Users\Anton\OneDrive\Desktop\CORE\final assembly\cutting_pattern_images")
save_screen_cap_4 = RemoteReceiver(save_screen_cap_3)

# ---- group: out_output_cutting_patterns_to_excel
sel_section_4 = RemoteReceiver(sel_section_2)

panel_7 = Panel(panel_3)
panel_8 = Panel("waste_length_mm")
save_cutting_patterns_4 = RemoteReceiver(save_cutting_patterns_3)

merge_2 = Merge(Data1="cut_piece_id", Data2="beam_ids", Data3=panel_8)  # -> flatten(Result)
panel_9 = Panel(merge_2)

stock_length_mm_8 = RemoteReceiver(stock_length_mm_2)

# ---- group: ctrl_get_beams_with_specific_section
in_section_types_4 = RemoteReceiver(in_section_types_2)
sel_section_5 = RemoteReceiver(sel_section_2)
sel_section_6 = RemoteReceiver(sel_section_2)

cset = CreateSet(List=in_section_types_4)  # -> Set, Map
panel_10 = Panel(cset.Set)

section_names = Data(cset.Set)
section_names_2 = RemoteSender(section_names)
split = TextSplit(Text=panel_10, Separators=" ")
item_2 = ListItem(List=split, Index="1", Wrap=True)
split_2 = TextSplit(Text=item_2, Separators="x")
num = Number(split_2)
item_3 = ListItem(List=num, Index=0, Wrap=True)  # -> flatten(Item), flatten(Item1)
all_sections_diameter = Data(item_3.Item)
equals_2 = Equality(FirstNumber=cset.Map, SecondNumber=sel_section_5)  # -> Equality, Inequality
cull_3 = CullPattern(List=in_beams_all_3, CullPattern=equals_2.Equality)
item_4 = ListItem(List=item_3.Item1, Index=sel_section_6, Wrap=True)
item_5 = ListItem(List=item_3.Item, Index=sel_section_6, Wrap=True)
all_sections_diameter_2 = RemoteSender(all_sections_diameter)
cross_section_thickness_mm = Data(item_4)
cross_section_diameter_mm = Data(item_5)
crv_with_cross_section = Curve(cull_3)

# ---- group: out_output_cutting_patterns_to_excel (continued)
section_names_3 = RemoteReceiver(section_names_2)
item_6 = ListItem(List=section_names_3, Index=sel_section_4, Wrap=True)
concat_3 = Concatenate(FragmentA="Cutting_Patterns_", FragmentB=item_6)
panel_11 = Panel(concat_3)

# ---- group: out_Cutting Pattern Screen Cap (continued)
section_names_4 = RemoteReceiver(section_names_2)
item_7 = ListItem(List=section_names_4, Index=sel_section_3, Wrap=True)
concat_4 = Concatenate(FragmentA=item_7, FragmentB="_", FragmentC=item, FragmentD="_", FragmentE=stock_length_mm_7)
panel_12 = Panel(concat_4)
capture = Capture(
    ViewNames="Top",
    FolderPath=panel_6,
    FileNameWithoutExtension=panel_12,
    Format=1,
    Width="3141",
    Height="1861",
    TransparentBackground=False,
    AllViewport=False,
    Run=save_screen_cap_4,
    Scale=1)

# ---- group: calc_radius of cross section
item_8 = ListItem(List=cross_section_thickness_mm, Index=0, Wrap=True)
x_2000 = Number(expr("x/2000", item_8))
thickness_m = Data(x_2000)

item_9 = ListItem(List=cross_section_diameter_mm, Index=0, Wrap=True)
x_2000_2 = Number(expr("x/2000", item_9))
radius_m = Data(x_2000_2)

# ---- group: b_Cutting Stock Algorithms / b_Optimised Cutting Stock Algorithm
len_2 = Length(Curve=crv_with_cross_section)
x_1000_2 = Number(expr("x*1000", len_2))
int = Integer(x_1000_2)

# ---- group: b_Cutting Stock Algorithms / b_Naive Cutting Stock Algorithm
# b_Naive Cutting Stock Algorithm
stock_length_mm_9 = RemoteReceiver(stock_length_mm_2)
py3 = Python3Script(lengths=int, stock_length=stock_length_mm_9)  # -> out, cutting_pattern; inputs lengths: list of Int32, stock_length: Int32
# ---------- py3: Python ----------
import Grasshopper as gh
from Grasshopper.Kernel.Data import GH_Path

def most_naive_1d_cutting_stock(lengths, stock_length):
    cutting_pattern = gh.DataTree[object]()
    cutting_pattern_dict = {}
    cutting_pattern_dict[0] = [lengths[0]]

    for length in lengths[1:]:
        last_key = list(cutting_pattern_dict.keys())[-1]
        if (stock_length - sum(list(cutting_pattern_dict[last_key]))) > length:
            cutting_pattern_dict[last_key].append(length)
        else:
            cutting_pattern_dict[last_key + 1] = [length]


    for key in list(cutting_pattern_dict.keys()):
        path = GH_Path(cutting_pattern.BranchCount)
        cutting_pattern.AddRange(list(cutting_pattern_dict[key]), path)



    return cutting_pattern


cutting_pattern = most_naive_1d_cutting_stock(lengths, stock_length)
# ---------- end py3 ----------
ma = MassAddition(Input=py3.cutting_pattern)  # -> flatten(Result), PartialResults
out_length_used_mm = Data(ma.Result)
out_cutting_pattern = Data(py3.cutting_pattern)

# ---- group: b_Cutting Stock Algorithms / b_Optimised Cutting Stock Algorithm
lng_2 = ListLength(List=len_2)
dup = DuplicateData(Data="1", Number=lng_2, Order=True)

# ---- group: b_Cutting Stock Algorithms / This can take a long time to compute
_1dlincut = _1DLinerCutting(DesiredCuts=int, AmountStock=dup, WhipLength=stock_length_mm_5, EndCut=0, ToolWidth=cut_width_mm_3, HeadlessRetreat=0)  # -> StoLen, AmountWhips, Waste, UsingLen; disabled
toggle = GroupToggle(ToggleActive=True, ToggleVisible=False)  # disabled

# ---- group: b_Make Steel Tube Geometry / b_
xz = XZPlane(Origin=move_2.Geometry)
cir = Circle(Plane=xz, Radius=radius_m)
offset = OffsetCurve(Curve=cir, Distance=thickness_m, Corners=1)
merge_3 = Merge(Data1=cir, Data2=offset)  # -> flatten(Result)
loft = Loft(Curves=merge_3, Options={Adjust=False, Closed=False, LoftEnds=0, LoftSimp=0, LoftType=0, Rebuild=10, Refit=0.01})
extr = Extrude(Base=loft, Direction=Y_2)

# ---- group: b_Cutting Stock Algorithms / b_Optimised Cutting Stock Algorithm
# b_Optimised Cutting Stock Algorithm
out_length_used_mm_2 = Data(_1dlincut.UsingLen)
out_cutting_pattern_2 = Data(_1dlincut.StoLen)

# ---- group: viz_Main_Label / viz_steel_used
cross_section_shape = Data(loft)
area = Area(Geometry=cross_section_shape)  # -> Area, Centroid

# ---- group: ctrl_pick_cutting_stock_algorithm
cutting_stock_algo_4 = RemoteReceiver(cutting_stock_algo_2)
filter = StreamFilter(Gate=cutting_stock_algo_4, Stream0=out_length_used_mm_2, Stream1=out_length_used_mm)  # -> simplify(Stream)
filter_2 = StreamFilter(Gate=cutting_stock_algo_4, Stream0=out_cutting_pattern_2, Stream1=out_cutting_pattern)  # -> simplify(Stream)
out_length_used_mm_3 = RemoteSender(filter)
out_cutting_pattern_3 = RemoteSender(filter_2)

# ---- group: out_output_cutting_patterns_to_excel (continued)
out_length_used_mm_4 = RemoteReceiver(out_length_used_mm_3)
subtraction = Subtraction(A=stock_length_mm_8, B=out_length_used_mm_4)

# ---- group: viz_tubes_geometry / b_tubes_needed_output
# b_tubes_needed_output
out_cutting_pattern_4 = RemoteReceiver(out_cutting_pattern_3)
tstat_2 = TreeStatistics(Tree=out_cutting_pattern_4)  # -> Paths, Length, Count
radius_m_4 = Number(expr("x*4", radius_m))
out_num_pieces_needed = Data(tstat_2.Count)
series_2 = Series(Start=0, Step=radius_m_4, Count=tstat_2.Count)
X_2 = UnitX(Factor=series_2)
out_num_pieces_needed_2 = RemoteSender(out_num_pieces_needed)
move_5 = Move(Geometry=extr, Motion=X_2)  # -> Geometry, Transform
all_tubes_geo = Data(move_5.Geometry)
all_tubes_geo_2 = RemoteSender(all_tubes_geo)

# ---- group: b_Viz_Rectangles_Grid / b_viz_rectangles_grid_x
# b_viz_rectangles_grid_x
out_num_pieces_needed_3 = RemoteReceiver(out_num_pieces_needed_2)
viz_rectangle_width_3 = RemoteReceiver(viz_rectangle_width_2)
viz_rectangle_extent_x_3 = RemoteReceiver(viz_rectangle_extent_x_2)
x_0_5_x = Number(expr("x + (0.5 * x)", viz_rectangle_width_3))
series_3 = Series(Start=0, Step=x_0_5_x, Count=viz_rectangle_extent_x_3)
integer_division = IntegerDivision(A=out_num_pieces_needed_3, B=viz_rectangle_extent_x_3)
X_3 = UnitX(Factor=series_3)
num_2 = Number(expr("x+1", integer_division))
stock_length_mm_10 = RemoteReceiver(stock_length_mm_2)
move_6 = Move(Geometry=move_3.Geometry, Motion=X_3)  # -> Geometry, Transform
series_4 = Series(Start=0, Step=1, Count=num_2)
num_3 = Number(expr("x/1000 + 5.0", stock_length_mm_10))
multiplication = Multiplication(A=series_4, B=num_3)
Y_4 = UnitY(Factor=expr("-x", multiplication))
move_7 = Move(Geometry=move_6.Geometry, Motion=graft(Y_4))  # -> simplify(Geometry), Transform

# ---- group: b_Viz_Rectangles_Grid / b_vi_rectangles_last_row
multiplication_2 = Multiplication(A=integer_division, B=viz_rectangle_extent_x_3)
subtraction_2 = Subtraction(A=out_num_pieces_needed_3, B=multiplication_2)

# b_vi_rectangles_last_row
number_of_pieces_in_last_row = Data(subtraction_2)

# ---- group: b_Viz_Rectangles_Grid / b_viz_rectangles_grid_y
# b_viz_rectangles_grid_y
tstat_3 = TreeStatistics(Tree=move_7.Geometry)  # -> Paths, Length, Count
viz_rectangle_extent_x_4 = RemoteReceiver(viz_rectangle_extent_x_2)
dispdexs = DispatchIndices(List=tstat_3.Paths, Indices=expr("x-1", tstat_3.Count))  # -> AtI, NotI
number_of_pieces_in_last_row_2 = Data(number_of_pieces_in_last_row)
branch = TreeBranch(Tree=move_7.Geometry, Path=dispdexs.NotI, MaintainPaths=True)
subtraction_3 = Subtraction(A=viz_rectangle_extent_x_4, B=number_of_pieces_in_last_row_2)
branch_2 = TreeBranch(Tree=move_7.Geometry, Path=dispdexs.AtI, MaintainPaths=True)
series_5 = Series(Start=number_of_pieces_in_last_row_2, Step=1, Count=subtraction_3)
cull_i = CullIndex(List=branch_2, Indices=series_5, Wrap=True)
entwine_2 = Entwine(Branch0X=branch, Branch1X=cull_i, FlattenInputs=False)
rectangle = Rectangle(Plane=entwine_2, XSize=viz_rectangle_width_3, YSize=x_1000, Radius=0)  # -> flatten(Rectangle), Length

# ---- group: viz_Main_Label / viz_steel_needed
# viz_steel_needed
all_tubes_geo_3 = RemoteReceiver(all_tubes_geo_2)
steel_density_3 = RemoteReceiver(steel_density_2)
volume = Volume(Geometry=all_tubes_geo_3)  # -> Volume, Centroid
panel_13 = Panel("Weight of Steel Bought: ")
ma_2 = MassAddition(Input=volume.Volume)  # -> Result, PartialResults
multiplication_3 = Multiplication(A=ma_2.Result, B=steel_density_3)
new_line_2 = Panel("")
round = Round(Number=multiplication_3)  # -> Nearest, Floor, Ceiling
panel_14 = Panel(" kg")

# ---- group: viz_Main_Label / viz_steel_used
# viz_steel_used
out_length_used_mm_5 = RemoteReceiver(out_length_used_mm_3)
cross_section_area_m2 = Data(area.Area)
x_1000_3 = Number(expr("x/1000", out_length_used_mm_5))
multiplication_4 = Multiplication(A=x_1000_3, B=cross_section_area_m2)
panel_15 = Panel("Weight of Steel Used: ")
ma_3 = MassAddition(Input=multiplication_4)  # -> Result, PartialResults
multiplication_5 = Multiplication(A=ma_3.Result, B=steel_density_3)
round_2 = Round(Number=multiplication_5)  # -> Nearest, Floor, Ceiling
panel_16 = Panel(" kg")
new_line_3 = Panel("")

# ---- group: viz_Main_Label / viz_quanitity steel sections
# viz_quanitity steel sections
section_names_5 = RemoteReceiver(section_names_2)
out_num_pieces_needed_4 = RemoteReceiver(out_num_pieces_needed_2)
sel_section_7 = RemoteReceiver(sel_section_2)
item_10 = ListItem(List=section_names_5, Index=sel_section_7, Wrap=True)
panel_17 = Panel(" x ")

# ---- group: viz_Main_Label / viz_waste
subtraction_4 = Subtraction(A=multiplication_3, B=multiplication_5)
division_2 = Division(A=subtraction_4, B=multiplication_3)
multiplication_6 = Multiplication(A=division_2, B="100")
roundd_2 = RoundToDecimalPlace(NumberX=multiplication_6, DecimalPlace=1, RoundType=0)  # -> Rounded, Difference

# ---- group: viz_tubes_geometry / viz_tubes
# viz_tubes
swatch = ColourSwatch(SwatchColor=RGB(110, 110, 110))
wires_2 = BrepWireframe(Brep=all_tubes_geo, Density=-1)
preview = CustomPreview(Geometry=all_tubes_geo, Material=ColourSwatch(SwatchColor=RGB(56, 105, 122)))
previewlw_3 = CustomPreviewLineweights(Geometry=wires_2, Shader=swatch, Absolute=False)

# ---- group: b_incorporate_cut_width
out_cutting_pattern_5 = RemoteReceiver(out_cutting_pattern_3)
cut_width_mm_4 = RemoteReceiver(cut_width_mm_2)
x_1000_4 = Number(expr("x/1000", cut_width_mm_4))
x_1000_5 = Number(expr("x/1000", out_cutting_pattern_5))
py3_2 = Python3Script(cuts=x_1000_5, cut_width_m=x_1000_4)  # -> out, simplify(cuts_with_widths); inputs cuts: tree of Double, cut_width_m: Double
# ---------- py3_2: Python ----------
import ghpythonlib.treehelpers as th

# Input parameters:
# tree: A data tree of floats, e.g., {0;0}: [4.5, 3.5, 6.0]
# gap: A float representing the gap to insert, e.g., 0.3

def add_gaps_to_tree(tree, gap):
    new_tree = []
    
    # Iterate through each branch in the tree
    for branch in tree.Branches:
        # Initialize a new branch list with gaps
        new_branch = []
        for i, val in enumerate(branch):
            new_branch.append(val)   # Add the original value
            if i < len(branch) - 1:  # Only add a gap if not the last element
                new_branch.append(gap)
        
        # Append the modified branch to the new tree
        new_tree.append(new_branch)
    
    return th.list_to_tree(new_tree)

# Call the function and output the result
output = add_gaps_to_tree(cuts, cut_width_m)
cuts_with_widths = output
# ---------- end py3_2 ----------

# ---- group: viz_ / viz_rectangles_label_pos
# viz_rectangles_label_pos
explode = Explode(Curve=rectangle.Rectangle, Recursive=True)  # -> Segments, Vertices
item_11 = ListItem(List=explode.Segments, Index=0, Wrap=True)
viz_rectangles_id_3 = RemoteReceiver(viz_rectangles_id_2)
midpt = CurveMiddle(Curve=item_11)
Y_5 = UnitY(Factor=expr("-x", viz_rectangles_id_3))
pt_4 = Point(flatten(midpt))
move_8 = Move(Geometry=pt_4, Motion=Y_5)  # -> Geometry, Transform

# ---- group: viz_Main_Label
concat_5 = Concatenate(
    FragmentA=out_num_pieces_needed_4,
    FragmentB=panel_17,
    FragmentC=item_10,
    FragmentD=new_line_2,
    FragmentE=panel_13,
    FragmentF=round.Ceiling,
    FragmentG=panel_14,
    FragmentH=new_line_3,
    FragmentI=panel_15,
    FragmentJ=round_2.Ceiling,
    FragmentK=panel_16,
    FragmentL=new_line,
    FragmentM=panel_2,
    FragmentN=roundd_2.Rounded,
    FragmentO=panel)
tag = TextTag3D(Location=move_4.Geometry, Text=concat_5, Size=1, Colour=ColourSwatch(SwatchColor=RGB(38, 38, 38)), Justification=7)

# ----
results_per_section_type = Panel(concat_5)

# ---- group: viz_ / viz_rectangles_labels
# viz_rectangles_labels
lng_3 = ListLength(List=move_8.Geometry)
series_6 = Series(Start=0, Step=1, Count=lng_3)
cutting_piece_id = Data(series_6)
cutting_piece_id_2 = RemoteSender(cutting_piece_id)
tag_2 = TextTag3D(Location=move_8.Geometry, Text=series_6, Size=1, Colour=ColourSwatch(SwatchColor=RGB(69, 69, 69)), Justification=5)
toggle_2 = GroupToggle(ToggleActive=True, ToggleVisible=False)  # disabled

# ---- group: b_Cutting_Stock_Geometry / b_get_indices_from_pieces
# b_get_indices_from_pieces
in_beams_all_6 = RemoteReceiver(in_beams_all)
len_3 = Length(Curve=in_beams_all_6)
out_cutting_pattern_6 = RemoteReceiver(out_cutting_pattern_3)
cset_2 = CreateSet(List=len_3)  # -> Set, Map
roundd_3 = RoundToDecimalPlace(NumberX=cset_2.Set, DecimalPlace=3, RoundType=0)  # -> Rounded, Difference
x_1000_6 = Number(expr("x * 1000", roundd_3.Rounded))
py3_3 = Python3Script(beam_lengths=x_1000_6, cutting_patterns=out_cutting_pattern_6)  # -> out, cutting_indices; inputs beam_lengths: list of Int32, cutting_patterns: tree of Int32
# ---------- py3_3: Python ----------
import Grasshopper as gh
from Grasshopper.Kernel.Data import GH_Path

def replace_tree_with_indices(tree, values_list):
    # Step 1: Create a value-to-index mapping from the list
    value_index_map = {value: idx for idx, value in enumerate(values_list)}
    print(value_index_map)
    
    
    # Step 2: Create a new Data Tree to store the result
    new_tree = gh.DataTree[object]()
    
    # Step 3: Traverse each branch in the original tree and replace values
    for path in tree.Paths:
        branch = tree.Branch(path)  # Get the branch items at the current path
        new_branch = [value_index_map[item] for item in branch]  # Replace items with indices
        
        # Step 4: Add the modified branch to the new tree at the same path
        new_tree.AddRange(new_branch, path)
    
    return new_tree

# Example usage in a GhPython component:
# Assume `input_tree` is the input data tree and `list_of_values` is the list containing all tree items
cutting_indices = replace_tree_with_indices(cutting_patterns, beam_lengths)
# ---------- end py3_3 ----------

# ---- group: b_Cutting_Stock_Geometry / b_indices_to_colours
# b_indices_to_colours
lng_4 = ListLength(List=in_beams_all_6)
series_7 = Series(Start=0, Step=1, Count=lng_4)
dom = ConstructDomain(DomainStart=0, DomainEnd=lng_4)
remap = RemapNumbers(Value=series_7, Source=dom, Target=Domain(0, 1))  # -> Mapped, Clipped

# ---- group: b_Cutting_Stock_Geometry
cutting_pattern_indices = Data(py3_3.cutting_indices)
cutting_pattern_indices_2 = RemoteSender(cutting_pattern_indices)

# ---- group: out_output_cutting_patterns_to_excel
cutting_pattern_indices_3 = RemoteReceiver(cutting_pattern_indices_2)
cutting_piece_id_3 = RemoteReceiver(cutting_piece_id_2)
py3_4 = Python3Script(cutting_pattern_indices=cutting_pattern_indices_3)  # -> out, a; inputs cutting_pattern_indices: tree
# ---------- py3_4: Python ----------
cutting_pattern_strings = []
tree = cutting_pattern_indices

for b_i in range(tree.BranchCount):
    pattern_string = ""
    for i, el in enumerate(tree.Branch(b_i)):
        if i == 0:
            index_string = str(el)
        else:
            index_string = "_" + str(el) 
        pattern_string += index_string
    cutting_pattern_strings.append(pattern_string)

a = cutting_pattern_strings
# ---------- end py3_4 ----------

# ----
concat_6 = Concatenate(FragmentA=item_6, FragmentC="_", FragmentB=cutting_piece_id_3)

# ---- group: out_output_cutting_patterns_to_excel (continued)
entwine_3 = Entwine(Branch00=concat_6, Branch01=py3_4.a, Branch02=subtraction, FlattenInputs=True)

save_cutting_patterns_to_excel = Python3Script(
    file_path=panel_7,
    sheet_name=panel_11,
    headers=panel_9,
    values_tree=entwine_3,
    notes=concat_2,
    save=save_cutting_patterns_4)  # inputs headers: list, values_tree: tree, save: Boolean
# ---------- save_cutting_patterns_to_excel: Python ----------
from openpyxl import load_workbook, Workbook

def save_data_to_excel(file_path, sheet_name, headers, values, notes="Notes:"):
    # Ensure the number of headers matches the number of value lists
    if len(headers) != len(values):
        raise ValueError("The number of headers must match the number of value lists.")
    
    # Try to load an existing workbook, otherwise create a new one
    try:
        workbook = load_workbook(file_path)
    except FileNotFoundError:
        workbook = Workbook()

    # If the sheet exists, clear its contents; otherwise, create a new sheet
    if sheet_name in workbook.sheetnames:
        sheet = workbook[sheet_name]
        # Clear the sheet by removing all rows
        workbook.remove(sheet)
        # Re-create the cleared sheet
        sheet = workbook.create_sheet(title=sheet_name)
    else:
        # Create a new sheet with the specified name
        sheet = workbook.create_sheet(title=sheet_name)
    
    # Add the "Notes" row at the top of the sheet
    sheet.cell(row=1, column=1, value=notes)
    
    # Write headers to the second row (after the Notes row)
    for col_num, header in enumerate(headers, start=1):
        sheet.cell(row=2, column=col_num, value=header)
    
    # Write values to rows starting from the third row (below Notes and headers)
    for col_num, value_list in enumerate(values, start=1):
        for row_num, value in enumerate(value_list, start=3):  # start=3 for data below Notes and Headers
            sheet.cell(row=row_num, column=col_num, value=value)
    
    # Save the workbook
    workbook.save(file_path)
values = []
for i in range(values_tree.BranchCount):
    values.append(values_tree.Branch(i))

save_data_to_excel(file_path, sheet_name, headers, values, notes)
# ---------- end save_cutting_patterns_to_excel ----------

# ---- group: viz_loft_curves_to_tubes
in_section_types_5 = RemoteReceiver(in_section_types_2)
in_beams_all_7 = RemoteReceiver(in_beams_all)
pframe = PerpFrame(Curve=reparameterize(in_beams_all_7), Parameter=0)
end = EndPoints(Curve=in_beams_all_7)  # -> Start, End
number_slider = Slider(0.05, range=0..0.1)
deplane = DeconstructPlane(Plane=pframe)  # -> Origin, XAxis, YAxis, ZAxis
eval = EvaluateCurve(Curve=reparameterize(in_beams_all_7), Parameter="0.15")  # -> Point, Tangent, Angle
eval_2 = EvaluateCurve(Curve=reparameterize(in_beams_all_7), Parameter="0.85")  # -> Point, Tangent, Angle
circle = CircleCNR(Center=end.Start, Normal=deplane.ZAxis, Radius=number_slider)
circle_2 = CircleCNR(Center=end.End, Normal=deplane.ZAxis, Radius=number_slider)

split_3 = TextSplit(Text=in_section_types_5, Separators=" ")
item_12 = ListItem(List=split_3, Index="1", Wrap=True)
split_4 = TextSplit(Text=item_12, Separators="x")
num_4 = Number(split_4)
item_13 = ListItem(List=num_4, Index=0, Wrap=True)  # -> flatten(Item), flatten(Item1)

division_3 = Division(A=item_13.Item, B=1000)
circle_3 = CircleCNR(Center=eval_2.Point, Normal=deplane.ZAxis, Radius=division_3)
circle_4 = CircleCNR(Center=eval.Point, Normal=deplane.ZAxis, Radius=division_3)
merge_4 = Merge(Data1=graft(circle), Data2=graft(circle_4), Data3=graft(circle_3), Data4=graft(circle_2))  # -> simplify(Result)
loft_2 = Loft(Curves=merge_4, Options={Adjust=False, Closed=False, LoftEnds=0, LoftSimp=0, LoftType=3, Rebuild=10, Refit=0.01})  # -> flatten(Loft)

# ---- group: b_Assembly Sequence / b_pick_steps
# b_pick_steps
assembly_steps = Data(py3_trussemble.line_indices)

# ---- group: b_Assembly Sequence / b_pick_steps / b_pick_steps_until_current_step
# b_pick_steps_until_current_step
tstat_4 = TreeStatistics(Tree=assembly_steps)  # -> Paths, Length, Count
series_8 = Series(Start=0, Step=1, Count=choose_assembly_steps)
item_14 = ListItem(List=tstat_4.Paths, Index=series_8, Wrap=True)
branch_3 = TreeBranch(Tree=assembly_steps, Path=item_14, MaintainPaths=True)

# ---- group: b_Assembly Sequence / b_pick_steps (continued)
item_15 = ListItem(List=in_beams_all_2, Index=branch_3, Wrap=True)
crv = Curve(item_15)

# ---- group: b_Assembly Sequence / b_pick_steps / viz_completed_steps
# viz_completed_steps
number_slider_2 = Slider(3, range=0..10)
previewlw_4 = CustomPreviewLineweights(Geometry=crv, Shader=ColourSwatch(SwatchColor=RGB(255, 255, 255)), Thickness=number_slider_2, Absolute=False)

connected_2 = GetConnectedObjects(Objects=choose_assembly_steps)
dom_2 = ConstructDomain(DomainStart=1, DomainEnd=tstat_4.Count)
set_slider = SetSliderProperties(Slider=connected_2, Range=dom_2, Type=1)

# ---- group: viz_tube_roof
end_2 = EndPoints(Curve=crv)  # -> Start, End
merge_5 = Merge(Data1=end_2.Start, Data2=end_2.End)
item_16 = ListItem(List=loft_2, Index=branch_3, Wrap=True)
cullpt = CullDuplicates(Points=flatten(merge_5), Tolerance=0.1, CullMode=3)  # -> Points, Indices, Valence
brep = Brep(flatten(item_16))
msphere = MeshSphere(Base=cullpt.Points, Radius=Slider(0.2, range=0..1), UCount=10, VCount=20)
preview_2 = CustomPreview(Geometry=brep, Material=ColourSwatch(SwatchColor=RGB(207, 207, 207)))
preview_3 = CustomPreview(Geometry=msphere, Material=ColourSwatch(SwatchColor=RGB(0, 187, 255)))

# ---- group: b_Cutting_Stock_Geometry / b_cut_rectangles_to_cut_pieces
# b_cut_rectangles_to_cut_pieces
srf = Surface(rectangle.Rectangle)
graft_3 = GraftTree(Tree=srf, IncludeEmptyLists=True, IncludeNullItems=True)
dom_3 = Domain²Components(Domain=srf)  # -> UComponent, VComponent
simplify = SimplifyTree(Tree=graft_3, Front=False)

explode_2 = BrepComponents(Brep=srf)  # -> Faces, simplify(Edges), Vertices
ma_4 = MassAddition(Input=py3_2.cuts_with_widths)  # -> Result, PartialResults
item_17 = ListItem(List=explode_2.Edges, Index="1", Wrap=True)
toggle_3 = BooleanToggle(False)
eval_3 = EvaluateLength(Curve=item_17, Length=ma_4.PartialResults, Normalized=toggle_3)  # -> Point, Tangent, Parameter
ins = InsertItems(List=eval_3.Parameter, Item="0", Indices="0", Wrap=True)
consec = ConsecutiveDomains(Numbers=ins, Additive=toggle_3)

dom² = Domain²(DomainU=graft(dom_3.UComponent), DomainV=consec)  # -> simplify(_2DDomain)
subsrf = Isotrim(Surface=simplify, Domain=dom²)
srf_2 = Surface(subsrf)

# ---- group: b_Cutting_Stock_Geometry / b_dont_pick_tool_cuts
# b_dont_pick_tool_cuts
panel_18 = Panel("""1
0""")
cull_4 = CullPattern(List=srf_2, CullPattern=panel_18)  # -> flatten(List)

# ---- group: b_Cutting_Stock_Geometry / viz_waste_pieces
# viz_waste_pieces
brec_2 = BoundingRectangle(Geometry=subsrf, Plane=PlaneXY(0, 0, 0), Axis=0, Slide=0, Union=True)  # -> Bounding, DimensionX, DimensionY
crv_2 = Curve(simplify)
rdiff = RegionDifference(CurvesA=crv_2, CurvesB=brec_2.Bounding)  # -> flatten(Result)
crv_3 = Curve(rdiff)
srf_3 = Surface(rdiff)
cp = ControlPoints(Curve=crv_3)  # -> Points, Weights, Knots
custom_preview = CustomPreview(Geometry=srf_3, Color=ColourSwatch(SwatchColor=RGB(212, 212, 212)), TopMost=False)
item_18 = ListItem(List=cp.Points, Index=0, Wrap=True)  # -> Item, Item1, Item2, Item3
ln = Line(StartPoint=item_18.Item1, EndPoint=item_18.Item3)
ln_2 = Line(StartPoint=item_18.Item, EndPoint=item_18.Item2)
merge_6 = Merge(Data1=ln_2, Data2=ln, Data3=crv_3)  # -> flatten(Result)
toggle_4 = GroupToggle(ToggleActive=True, ToggleVisible=False)  # disabled
previewlw_5 = CustomPreviewLineweights(Geometry=merge_6, Shader=ColourSwatch(SwatchColor=RGB(120, 120, 120)), Absolute=False)

# ---- group: b_Cutting_Stock_Geometry / viz_cutting_stock_rectangles
# viz_cutting_stock_rectangles
item_19 = ListItem(List=remap.Mapped, Index=flatten(py3_3.cutting_indices), Wrap=True)
area_2 = Area(Geometry=cull_4)  # -> Area, Centroid
gradient = Gradient(
    LowerLimit="0",
    UpperLimit="1",
    Parameter=item_19,
    stops=[0: RGB(48, 18, 59), 0.0294: RGB(56, 40, 112), 0.0588: RGB(63, 62, 156), 0.0882: RGB(68, 82, 193), 0.118: RGB(70, 102, 221), 0.147: RGB(71, 122, 241)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])
tag_3 = TextTag3D(
    Location=area_2.Centroid,
    Text=flatten(py3_3.cutting_indices),
    Size=Slider(0.4, range=0..1),
    Colour=ColourSwatch(SwatchColor=RGB(255, 255, 255)),
    Justification=5)
toggle_5 = GroupToggle(ToggleActive=True, ToggleVisible=False)  # disabled
preview_4 = CustomPreview(Geometry=cull_4, Material=gradient)
